# Grasshopper definition IE_trial_HumanUI.gh (Grasshopper 1.0.7)
# plug-ins: Human UI, InstantExtension, Anemone, KinergyUtilities

fastloopstart = FastLoopStart(Iterations=Slider(100, range=0..100), Data=Slider(1, range=0..1))  # -> port, Counter, Data
Z = UnitZ(Factor=1)
brep = Brep(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)
loop_start = LoopStart(Repeat=Slider(100, range=0..100), Trigger=Toggle(False), Data=Slider(1, range=0..1))  # -> port, Counter, Data
number_slider = Slider(1, range=0..1)
addition = Addition(A=fastloopstart.Data, B=Slider(1, range=0..1))
addition_2 = Addition(A=loop_start.Data, B=loop_start.Counter)
ie = InstantExtension(Start=Toggle(True), Model=brep, SpringDirection=Z, Energy=Slider(1, range=0..1), Distance=Slider(0.5, range=0..1))
number_slider_2 = Slider(1, range=0..1)
mr = MotionReader()  # -> Entities, Components, Locks
preprocessie = _01ModelPreprocessOfIE(Motion=ie)  # -> Motion, SpringPositionCandidates
loop_end = LoopEnd(port=loop_start.port, Exit=False, Data=addition_2, TimeOutVal=0, pausedState=False, state="Constant output")
fastloopend = FastLoopEnd(port=fastloopstart.port, Exit=False, Data=addition, RecordData=False, TimeOutVal=0)
sp = SelectPosition(PositionCandidates=preprocessie.SpringPositionCandidates, Select=Toggle(True))
constructspring = _02ConstructSpringOfIE(Motion=preprocessie.Motion, SpringPosition=sp)  # -> Motion, LockDirectionCandidates, Spring
sd = SelectDirection(DirectionCandidates=constructspring.LockDirectionCandidates, Select=Toggle(True))
adjustspringparameter = AdjustSpringParameter(Spring=constructspring.Spring, RadiusAdjustment=number_slider_2, RoundNumberAdjustment=number_slider_2)
nickname = _03GenerateLockPositionCandidateOfIE(Motion=constructspring.Motion, LockDirection=sd)  # -> Motion, LockPositionCandidates
sp_2 = SelectPosition(PositionCandidates=nickname.LockPositionCandidates, Select=Toggle(True))
constructlock = _04ConstructLockOfIE(Motion=nickname.Motion, LockPosition=sp_2)  # -> Motion, Models
ms = MotionSimulator(Motion=constructlock.Motion, Start=Toggle(False))  # -> Model, Models; disabled
launchwin = LaunchWindow(
    Show=Toggle(True),
    Name="3D Model Configurator",
    Width=Slider(387, range=0..1000),
    Height=Slider(634, range=0..1000),
    ChildStatus=0,
    EnableHorizScroll=False)
button = CreateButton(ButtonName="LoadMotion", ButtonStyle=0)
button_2 = CreateButton(ButtonName="Release", ButtonStyle=0)
swatch = Red(SwatchColor=RGB(255, 0, 0))
cyl = Cylinder(Base=PlaneXY(0, 0, 0), Radius=0.5, Length=1)
merge = Merge(Data1=button, Data2=button_2)
_3dview = Create3DView(MeshToDisplay=cyl, MeshColors=swatch, ViewWidth=300, ViewHeight=300)
colorpicker = CreateColorPicker(DefaultColor=swatch)
checkbox = CreateCheckbox(Label="Simulate", StartingValue=False)
stack = CreateStack(UIElements=merge, Horizontal=True)
merge_2 = Merge(Data1=_3dview, Data2=colorpicker, Data3=stack)
values = ValueListener(Elements=colorpicker, SomeProperty=True)  # -> Values, Indices
values_2 = ValueListener(Elements=checkbox, SomeProperty=True)  # -> Values, Indices
values_3 = ValueListener(Elements=button_2, SomeProperty=True)  # -> Values, Indices
values_4 = ValueListener(Elements=button, SomeProperty=True)  # -> Values, Indices
expander = CreateExpander(UIElements=merge_2, Open=True)
merge_3 = Merge(Data1=checkbox, Data2=expander)
addelems = AddElements(Window=launchwin, Elements=flatten(merge_3), DoVLChecking=True)  # -> AddedElements, ElementNames
hideshow = HideShowElement(ElementToHideShow=expander, Show=values_2.Values, Collapse=True, Disable=False)
kms = KinergyMotionSimulatorForHumanUI(
    _3DView=_3dview,
    MotionToSimulate=constructlock.Motion,
    MeshColors=values.Values,
    Load=values_4.Values,
    Release=values_3.Values)
