# Grasshopper definition CamAndFollowerTrial.gh (Grasshopper 1.0.7)
# plug-ins: Human UI

number_slider = Slider(1, range=0..1)
number_slider_2 = Slider(2, range=0..10)
xy = XYPlane(Origin=Point(0, 0, 0))
pt = Point(Point(-4.852445442, 11.31996757, -0.2695185665))
pt_2 = Point(Point(20.69427407, 19.2188174, 0))
camandfollower = CamAndFollower(
    BasePlane=xy,
    CamType=number_slider_2,
    FollowerType=number_slider_2,
    FirstPoint=pt,
    SecondPoint=pt_2,
    MinimalRadiusOfCam=Slider(6, range=0..10),
    MaximumRadiusOfCam=Slider(10, range=0..10),
    RodRadiusOfFollower=Slider(1, range=0..1),
    InitialPositionOfCam=Slider(400, range=0..1080))  # -> Cam, Follower, Models
