# Grasshopper definition GearTrainTest.gh (Grasshopper 1.0.7)
# plug-ins: Human UI

number_slider = Slider(90, range=0..100)
number_slider_2 = Slider(100, range=0..100)
pt = ConstructPoint(XCoordinate=Slider(-10, range=-10..10), YCoordinate=Slider(-10, range=-10..10), ZCoordinate=Slider(150, range=0..1000))
pt_2 = ConstructPoint(XCoordinate=Slider(42, range=0..100), YCoordinate=Slider(100, range=0..100), ZCoordinate=Slider(220, range=0..1000))
pt_3 = ConstructPoint(XCoordinate=Slider(50, range=0..100), YCoordinate=Slider(60, range=0..100), ZCoordinate=Slider(120, range=0..1000))
pt_4 = ConstructPoint(XCoordinate=Slider(-10, range=-10..10), YCoordinate=Slider(-10, range=-10..10), ZCoordinate=Slider(40, range=0..100))
pt_5 = ConstructPoint(XCoordinate=Slider(10, range=-10..10), YCoordinate=Slider(-3, range=-10..10), ZCoordinate=Slider(-10, range=-10..10))
pt_6 = ConstructPoint(XCoordinate=Slider(60, range=0..100), YCoordinate=Slider(26, range=0..100), ZCoordinate=Slider(21, range=0..100))
box = Box2Pt(PointA=pt, PointB=pt_2, Plane=PlaneXY(0, 0, 0))
number_slider_3 = Slider(1, range=0..100)
box_2 = Box2Pt(PointA=pt_4, PointB=pt_3, Plane=PlaneXY(0, 0, 0))
box_3 = Box2Pt(PointA=pt_5, PointB=pt_6, Plane=PlaneXY(0, 0, 0))
number_slider_4 = Slider(8, range=0..10)
number_slider_5 = Slider(1, range=0..100)
Z = UnitZ(Factor=1)
X = UnitX(Factor=1)
Y = UnitY(Factor=1)
X_2 = UnitX(Factor=1)
pt_7 = ConstructPoint(XCoordinate=Slider(5, range=-10..10), YCoordinate=Slider(77, range=0..100), ZCoordinate=Slider(168, range=0..1000))
number_slider_6 = Slider(1, range=0..1)
X_3 = UnitX(Factor=1)
pt_8 = ConstructPoint(XCoordinate=Slider(5, range=-10..10), YCoordinate=Slider(5, range=-10..10), ZCoordinate=Slider(50, range=0..100))
pt_9 = ConstructPoint(XCoordinate=Slider(23, range=0..100), YCoordinate=Slider(27, range=0..100), ZCoordinate=Slider(100, range=0..100))
Z_2 = UnitZ(Factor=1)
pt_10 = ConstructPoint(XCoordinate=Slider(43, range=0..100), YCoordinate=Slider(10, range=-10..10), ZCoordinate=Slider(2, range=-10..10))
number_slider_7 = Slider(1, range=0..1)
number_slider_8 = Slider(1, range=0..1)
vec = VectorXYZ(XComponent=Slider(1, range=0..1), YComponent=Slider(0.5, range=0..1), ZComponent=0)  # -> Vector, Length
vec_2 = VectorXYZ(XComponent=0, YComponent=Slider(1, range=0..1), ZComponent=Slider(0, range=0..1))  # -> Vector, Length
gt = GearTrain(
    MainDirection=Y,
    AxisDirection=X,
    LastGearCenter=pt_7,
    InnerCavityBox=box,
    GearFaceWidth=Slider(4, range=0..10),
    GearRatioUserSelection=Slider(50, range=0..100))  # -> Models, ResultCount
gt_2 = GearTrain(
    MainDirection=Z_2,
    AxisDirection=vec.Vector,
    LastGearCenter=pt_9,
    InnerCavityBox=box_2,
    GearFaceWidth=Slider(4, range=0..10),
    GearRatioUserSelection=Slider(41, range=0..50))  # -> Models, ResultCount
gt_3 = GearTrain(
    MainDirection=X_2,
    AxisDirection=vec_2.Vector,
    LastGearCenter=pt_10,
    InnerCavityBox=box_3,
    GearFaceWidth=Slider(4, range=0..10),
    GearRatioUserSelection=Slider(6, range=0..50))  # -> Models, ResultCount
panel = Panel(gt.ResultCount)
panel_2 = Panel(gt_2.ResultCount)
panel_3 = Panel(gt_3.ResultCount)
