# Grasshopper definition GenevaTest.gh (Grasshopper 1.0.7)
# plug-ins: Human UI

Z = UnitZ(Factor=1)
pt = ConstructPoint(XCoordinate=0, YCoordinate=0, ZCoordinate=0)
X = UnitX(Factor=1)
number_slider = Slider(100, range=0..100)
gg = GenevaGearComponentforTest(
    DriverCenterPoint=pt,
    Normal=Z,
    DriverWheelRadius=Slider(10, range=0..10),
    RollerRadius=Slider(1, range=0..1),
    CenterlinkDirection=X,
    NumberOfSlots=Slider(5, range=0..10))  # -> DriverWheel, DrivenWheel, DriverModel, DrivenModel
