# Grasshopper definition IE_HumanUI.gh (Grasshopper 1.0.7)
# plug-ins: Human UI

# ---- group: arrow
pt = Point(["0,0,0", "20,0,0", "20,4,0", "28,0,0", "20,-4,0", "20,0,0"])
# Slider for max press distance
panel = Panel("true")
pline = PolyLine(Vertices=pt, Closed=panel)
# Set Motion Direction
# Whether treat the model as curved
# Slider for motion energy
crv = Curve(pline)

# ----
# Start button
# Load model button
brep = Brep(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)

# ----
# Button for set spring position
panel_2 = Panel("Set Spring Position")
true_button = CreateTrueOnlyButton(ButtonName=panel_2, ButtonStyle=0)
values = ValueListener(Elements=true_button, SomeProperty=True)  # -> Values, Indices

max_press_distance_of_spring = Slider(0.5, range=0.1..0.9)
slider = CreateSlider(
    Slider=max_press_distance_of_spring,
    ShowBounds=False,
    ShowTicks=False,
    ShowTooltip=False,
    ShowValLabel=True,
    showLabel=True)
values_2 = ValueListener(Elements=slider, SomeProperty=True)  # -> Values, Indices

# ----
# Button for set lock position
panel_3 = Panel("Set Lock Position")
true_button_2 = CreateTrueOnlyButton(ButtonName=panel_3, ButtonStyle=0)
values_3 = ValueListener(Elements=true_button_2, SomeProperty=True)  # -> Values, Indices

# ----
# Button for set lock direction
panel_4 = Panel("Set Lock Direction")
true_button_3 = CreateTrueOnlyButton(ButtonName=panel_4, ButtonStyle=0)
values_4 = ValueListener(Elements=true_button_3, SomeProperty=True)  # -> Values, Indices

# ---- group: Set Direction
true_button_4 = CreateTrueOnlyButton(ButtonName="Set Motion Direction", ButtonStyle=0)
values_5 = ValueListener(Elements=true_button_4, SomeProperty=True)  # -> Values, Indices
setdirection = CSharpScript(ToSet=values_5.Values, arrow=crv)  # -> A, B; inputs ToSet: Boolean, arrow: Curve
# ---------- setdirection: C# ----------
    Vector3d v = Vector3d.Unset;
    B = null;
    //A = v;
    if(ToSet)
    {
      //while(v.IsTiny(Rhino.RhinoMath.ZeroTolerance))
      //{
      Rhino.Input.Custom.GetPoint gp = new Rhino.Input.Custom.GetPoint();
      gp.SetCommandPrompt("Start of line");
      gp.Get();
      //if (gp.CommandResult() != Rhino.Commands.Result.Success)
      //return gp.CommandResult();

      Rhino.Geometry.Point3d pt_start = gp.Point();

      gp.SetCommandPrompt("End of line");
      gp.SetBasePoint(pt_start, false);
      gp.DrawLineFromPoint(pt_start, true);
      gp.Get();
      //if (gp.CommandResult() != Rhino.Commands.Result.Success)
      //return gp.CommandResult();

      Rhino.Geometry.Point3d pt_end = gp.Point();
      v = pt_end - pt_start;
      arrow.Transform(Transform.Translation(new Vector3d(pt_start)));
      arrow.Transform(Transform.Rotation(Vector3d.XAxis, v, pt_start));
      B = arrow;
    }
    A = v;
# ---------- end setdirection ----------

# ----
energy_strength_of_spring = Slider(1, range=0.1..5)
slider_2 = CreateSlider(
    Slider=energy_strength_of_spring,
    ShowBounds=False,
    ShowTicks=False,
    ShowTooltip=False,
    ShowValLabel=True,
    showLabel=True)
values_6 = ValueListener(Elements=slider_2, SomeProperty=True)  # -> Values, Indices

checkbox = CreateCheckbox(Label="Simulate", StartingValue=False)
values_7 = ValueListener(Elements=checkbox, SomeProperty=True)  # -> Values, Indices

# ---- group: Load Kinetic Unit into Model
pickbtn = CreateRhinoPickButton(
    ButtonName="LOAD model",
    Prompt="Please select geometry...",
    AllowMultiple="FALSE",
    AllowNone="FALSE",
    Type=0,
    ButtonStyle=0)
values_8 = ValueListener(Elements=pickbtn, SomeProperty=True)  # -> Values, Indices
brep_2 = Brep(values_8.Values)

# ----
true_button_5 = CreateTrueOnlyButton(ButtonName="start", ButtonStyle=0)
values_9 = ValueListener(Elements=true_button_5, SomeProperty=True)  # -> Values, Indices

checkbox_2 = CreateCheckbox(Label="Curved model", StartingValue=False)
values_10 = ValueListener(Elements=checkbox_2, SomeProperty=True)  # -> Values, Indices

ie = InstantExtension(
    Start=values_9.Values,
    Model=brep_2,
    SpringDirection=setdirection.A,
    CurvedModel=values_10.Values,
    Energy=values_6.Values,
    Distance=values_2.Values)
# Instant Extension major generator
preprocessie = _01ModelPreprocessOfIE(KineticUnit=ie)  # -> KineticUnit, SpringPositionCandidates, ModelSkeleton
sp = SelectPosition(PositionCandidates=preprocessie.SpringPositionCandidates, Select=values.Values)
constructspring = _02ConstructSpringOfIE(KineticUnit=preprocessie.KineticUnit, SpringPosition=sp)  # -> KineticUnit, LockDirectionCandidates, Spring, SpringSkeleton
sd = SelectDirection(DirectionCandidates=constructspring.LockDirectionCandidates, Select=values_4.Values)
nickname = _03GenerateLockPositionCandidateOfIE(KineticUnit=constructspring.KineticUnit, LockDirection=sd)  # -> KineticUnit, LockPositionCandidates
sp_2 = SelectPosition(PositionCandidates=nickname.LockPositionCandidates, Select=values_3.Values)
constructlock = _04ConstructLockOfIE(KineticUnit=nickname.KineticUnit, LockPosition=sp_2)  # -> KineticUnit, Models

# ----
# Simulation
pan = Panel("Release")
# Whether to show simulation
number_slider = Slider(255, range=0..1000)
button = CreateButton(ButtonName="LoadMotion", ButtonStyle=0)
button_2 = CreateButton(ButtonName=pan, ButtonStyle=0)
_3dview = Create3DView(MeshToDisplay=brep_2, MeshColors=RGB(255, 0, 0), ViewWidth=300, ViewHeight=300)
merge = Merge(Data1=button, Data2=button_2)
rgb = ColourRGB(Alpha=255, Red=number_slider, Green=0, Blue=0)
stack = CreateStack(UIElements=merge, Horizontal=True)
merge_2 = Merge(Data3=_3dview, Data5=stack)
values_11 = ValueListener(Elements=button_2, SomeProperty=True)  # -> Values, Indices
values_12 = ValueListener(Elements=button, SomeProperty=True)  # -> Values, Indices
expander = CreateExpander(UIElements=merge_2, Open=True)
kms = KinergyMotionSimulatorForHumanUI(
    _3DView=_3dview,
    KineticUnitToSimulate=constructlock.KineticUnit,
    MeshColors=rgb,
    Start=values_7.Values,
    Load=values_12.Values,
    Release=values_11.Values)
hideshow = HideShowElement(ElementToHideShow=expander, Show=values_7.Values, Collapse=True, Disable=False)

merge_3 = Merge(
    Data1=true_button_5,
    Data2=pickbtn,
    Data3=true_button_4,
    Data4=checkbox_2,
    Data5=slider_2,
    Data6=slider,
    Data7=true_button,
    Data8=true_button_3,
    Data9=true_button_2,
    Data10=checkbox,
    Data11=expander)
launchwin = LaunchWindow(
    Show=Toggle(True),
    Name="Instant Extension",
    Width=Slider(387, range=0..1000),
    Height=Slider(830, range=0..1000),
    ChildStatus=0,
    EnableHorizScroll=False)
addelems = AddElements(Window=launchwin, Elements=flatten(merge_3), DoVLChecking=True)  # -> AddedElements, ElementNames
