# Grasshopper definition IT_Trial.gh (Grasshopper 1.0.7)
# plug-ins: Human UI

brep = Brep(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)
brep_2 = Brep(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)
X = UnitX(Factor=1)
crv = Curve(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)
mp = ModelPreprocess(Brep=brep, Direction=X, InnerSpaceType=Slider(2, range=0..10), Restart=Button())  # -> ModelRegionOfInterest, InnerBox, InnerCylinder, Skeleton, Direction
pipe = Pipe(Curve=crv, Radius=Slider(2, range=0..10), Caps=1)
ckc_it = _01ConstructKineticComponents_IT(
    Model=brep,
    Direction=X,
    InnerCylinder=mp.InnerCylinder,
    Energy=Slider(1, range=0..1),
    MaxAngle=Slider(332, range=0..1000),
    AdjustingParameter=Toggle(False))  # -> KineticUnit, KineticComponents
nickname = _02SettingLock_IT(KineticUnit=ckc_it.KineticUnit)  # -> KineticUnit, LockComponents
launchwin = LaunchWindow(
    Show=Toggle(True),
    Name="Instant Extension",
    Width=Slider(387, range=0..1000),
    Height=Slider(528, range=0..1000),
    ChildStatus=0,
    EnableHorizScroll=False)
nickname_2 = _03EndEffector_IT(KineticUnit=nickname.KineticUnit, EndEffectorModel=pipe)  # -> KineticUnit, EndEffectorComponents

# ----
# Simulation
pan = Panel("Release")
button = CreateButton(ButtonName="LoadMotion", ButtonStyle=0)
button_2 = CreateButton(ButtonName=pan, ButtonStyle=0)
_3dview = Create3DView(MeshToDisplay=brep, MeshColors=RGB(255, 0, 0), ViewWidth=300, ViewHeight=300)
merge = Merge(Data1=button, Data2=button_2)
rgb = ColourRGB(Alpha=255, Red=Slider(255, range=0..1000), Green=0, Blue=0)
stack = CreateStack(UIElements=merge, Horizontal=True)
merge_2 = Merge(Data3=_3dview, Data5=stack)
values = ValueListener(Elements=button_2, SomeProperty=True)  # -> Values, Indices
values_2 = ValueListener(Elements=button, SomeProperty=True)  # -> Values, Indices
kms = KinergyMotionSimulatorForHumanUI(
    _3DView=_3dview,
    KineticUnitToSimulate=nickname_2.KineticUnit,
    MeshColors=rgb,
    Start=Toggle(True),
    Load=values_2.Values,
    Release=values.Values)

addelems = AddElements(Window=launchwin, Elements=flatten(merge_2), DoVLChecking=True)  # -> AddedElements, ElementNames
