# Grasshopper definition InstantRotationTrial.gh (Grasshopper 1.0.7)
# plug-ins: Human UI

number_slider = Slider(5, range=0..10)
brep = Brep(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)
brep_2 = Brep(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)
irmoudle = InstantRotationModule(
    RegionSelection=Button(),
    EndeffectorSetting=Button(),
    AddLock=Toggle(True),
    Preview=Toggle(False),
    Energy=Slider(2, range=0..10),
    MaxAngle=Slider(171, range=-1..360),
    ComponentsBake=Button())  # -> KineticUnit, Models, PreviewLauncher
