# Grasshopper definition Intermediate_ContinuousMoving_Rotate.gh (Grasshopper 1.0.7)
# plug-ins: Human UI, Simulation, Animation, DynamicConnection, PlaceBoxInsideBrep, Kangaroo2 Components

# ---- group: arrow
pt = Point(["0,0,0", "20,0,0", "20,4,0", "28,0,0", "20,-4,0", "20,0,0"])
pline = PolyLine(Vertices=pt, Closed="true")
crv = Curve(pline)

# ---- group: Image Of Kinetic Unit
number_slider = Slider(200, range=0..1000)
panel = Panel("C:\Users\ybliang19970108\Documents\GitHub\Kinergy\Code\Intermediate-ContinousCircling-Rotate/pull-back car.jpg")
image = CreateImage(ImageSource=panel, ImageWidth=number_slider, ImageHeight=number_slider)

# ---- group: Speed Slider
speed = Slider(3, range=1..5)
slider = CreateSlider(Slider=speed, ShowBounds=False, ShowTicks=False, ShowTooltip=False, ShowValLabel=True, showLabel=True)
values = ValueListener(Elements=slider, SomeProperty=True)  # -> Values, Indices

# ---- group: Set Direction
true_button = CreateTrueOnlyButton(ButtonName="DIRECTION", ButtonStyle=0)
values_2 = ValueListener(Elements=true_button, SomeProperty=True)  # -> Values, Indices
setdirection = CSharpScript(ToSet=values_2.Values, arrow=crv)  # -> A, B; inputs ToSet: Boolean, arrow: Curve
# ---------- setdirection: C# ----------
    Vector3d v = Vector3d.Unset;
    B = null;
    //A = v;
    if(ToSet)
    {
      //while(v.IsTiny(Rhino.RhinoMath.ZeroTolerance))
      //{
      Rhino.Input.Custom.GetPoint gp = new Rhino.Input.Custom.GetPoint();
      gp.SetCommandPrompt("Start of line");
      gp.Get();
      //if (gp.CommandResult() != Rhino.Commands.Result.Success)
      //return gp.CommandResult();

      Rhino.Geometry.Point3d pt_start = gp.Point();

      gp.SetCommandPrompt("End of line");
      gp.SetBasePoint(pt_start, false);
      gp.DrawLineFromPoint(pt_start, true);
      gp.Get();
      //if (gp.CommandResult() != Rhino.Commands.Result.Success)
      //return gp.CommandResult();

      Rhino.Geometry.Point3d pt_end = gp.Point();
      v = pt_end - pt_start;
      arrow.Transform(Transform.Translation(new Vector3d(pt_start)));
      arrow.Transform(Transform.Rotation(Vector3d.XAxis, v, pt_start));
      B = arrow;
    }
    A = v;
# ---------- end setdirection ----------

# ---- group: Generate Kinetic Unit
gearradius = Slider(24, range=0..100)
gearthickness = Slider(1, range=0..10)
number_slider_2 = Slider(10, range=0..100)
number_slider_3 = Slider(1, range=0..10)
number_slider_4 = Slider(10, range=0..10)
number_slider_5 = Slider(2, range=0..10)
number_slider_6 = Slider(5, range=0..10)
number_slider_7 = Slider(8, range=0..10)
box = CenterBox(Base=PlaneXY(0, 0, 0), X=number_slider_5, Y=Slider(6, range=0..10), Z=number_slider_5)
addition = Addition(A=number_slider_2, B="0.8")
addition_2 = Addition(A=number_slider_3, B="0.8")
X = UnitX(Factor="-3")
Y = UnitY(Factor="3")
X_2 = UnitX(Factor="3")
Y_2 = UnitY(Factor="-3")
subtraction = Subtraction(A=number_slider_6, B="1")
subtraction_2 = Subtraction(A=number_slider_4, B=number_slider_7)
rotate = Rotate(Geometry=box, Angle=1.570796327, Plane=PlaneXY(0, 0, 0))  # -> Geometry, Transform
division = Division(A=number_slider_4, B="2")
gear = Gear(
    N=Slider(72, range=0..1000),
    R=gearradius,
    F=Slider(0.5, range=0..1),
    A=Slider(4, range=0..10),
    B=Slider(1, range=0..1),
    F_2=gearthickness)
spiralline = SpiralLine(turncount=Slider(7, range=0..10), radius0=Slider(5, range=0..10), radius1=Slider(34, range=0..100))
box_2 = CenterBox(Base=PlaneXY(0, 0, 0), X=number_slider_2, Y=number_slider_3, Z=number_slider_3)
box_3 = CenterBox(Base=PlaneXY(0, 0, 0), X=gearradius, Y=gearradius, Z="0.5")
box_4 = CenterBox(Base=PlaneXY(0, 0, 0), X=addition_2, Y=addition, Z="0.5")
box_corners = BoxCorners(Box=box_4)  # -> CornerA, CornerB, CornerC, CornerD, CornerE, CornerF, CornerG, CornerH
move = Move(Geometry=box_corners.CornerE, Motion=X)  # -> Geometry, Transform
move_2 = Move(Geometry=box_corners.CornerE, Motion=Y)  # -> Geometry, Transform
move_3 = Move(Geometry=box_corners.CornerG, Motion=X_2)  # -> Geometry, Transform
move_4 = Move(Geometry=box_corners.CornerG, Motion=Y_2)  # -> Geometry, Transform
cyl = Cylinder(Base=PlaneXY(0, 0, 0), Radius=number_slider_6, Length=number_slider_4)
cyl_2 = Cylinder(Base=PlaneXY(0, 0, 0), Radius=subtraction, Length=number_slider_7)
cyl_3 = Cylinder(Base=PlaneXY(0, 0, 0), Radius=Slider(2, range=0..10), Length=subtraction_2)
Z = UnitZ(Factor=division)
cap = CapHoles(Brep=cyl_2)
cap_2 = CapHoles(Brep=cyl)
cap_3 = CapHoles(Brep=cyl_3)
Z_2 = UnitZ(Factor=1)
Z_3 = UnitZ(Factor=1)
Z_4 = UnitZ(Factor=number_slider_7)
sdiff = SolidDifference(BrepsA=box_3, BrepsB=box_4)
move_5 = Move(Geometry=[box, rotate.Geometry], Motion=Z)  # -> Geometry, Transform
spiralspring = SpiralSpring(R=spiralline, C=spiralline)
inter = InterconnectPoints(Pts=[move_3.Geometry, move_4.Geometry, box_corners.CornerG])
addition_3 = Addition(A=number_slider_2, B="5")
move_6 = Move(Geometry=cap, Motion=Z_2)  # -> Geometry, Transform
move_7 = Move(Geometry=box_3, Motion=Z_3)  # -> Geometry, Transform
move_8 = Move(Geometry=cap_3, Motion=Z_4)  # -> Geometry, Transform
addition_4 = Addition(A=number_slider_3, B="4.8", C="6")
boundary = BoundarySurfaces(Edges=inter)
Z_5 = UnitZ(Factor=1)
cyl_4 = Cylinder(Base=PlaneXY(0, 0, 0), Radius=addition_3, Length=Slider(2, range=0..10))
Z_6 = UnitZ(Factor=addition_4)
sdiff_2 = SolidDifference(BrepsA=cap_2, BrepsB=[move_8.Geometry, move_6.Geometry, move_5.Geometry])
extr = Extrude(Base=boundary, Direction=Z_5)
cap_4 = CapHoles(Brep=cyl_4)
sdiff_3 = SolidDifference(BrepsA=move_7.Geometry, BrepsB=cap_4)
move_9 = Move(Geometry=box_2, Motion=Z_6)  # -> Geometry, Transform
addition_5 = Addition(A=number_slider_4, B="1")
addition_6 = Addition(A=addition_4, B="2.8")
multiplication = Multiplication(A=addition_5, B="-1")
Z_7 = UnitZ(Factor=addition_6)
Z_8 = UnitZ(Factor=multiplication)
move_10 = Move(Geometry=sdiff_2, Motion=Z_8)  # -> Geometry, Transform
merge = Merge(Data1=flatten(gear), Data2=flatten(spiralspring), Data3=flatten(move_10.Geometry))

# ----
inter_2 = InterconnectPoints(Pts=[move.Geometry, move_2.Geometry, box_corners.CornerE])

# ---- group: Generate Kinetic Unit (continued)
boundary_2 = BoundarySurfaces(Edges=inter_2)
extr_2 = Extrude(Base=boundary_2, Direction=Z_5)
sunion = SolidUnion(Breps=[sdiff_3, sdiff, extr_2, extr])
move_11 = Move(Geometry=sunion, Motion=Z_7)  # -> Geometry, Transform
merge_2 = Merge(
    Data1=flatten(gear),
    Data2=flatten(spiralspring),
    Data3=flatten(move_10.Geometry),
    Data4=flatten(move_9.Geometry),
    Data5=flatten(move_11.Geometry))

# ---- group: Set Energy Control
checkbox = CreateCheckbox(Label="SET ENERGY CONTROL", StartingValue=False)
values_3 = ValueListener(Elements=checkbox, SomeProperty=True)  # -> Values, Indices
haslock = CSharpScript(AddLock=values_3.Values, NonLock=merge, WithLock=merge_2)  # -> A; inputs AddLock: Boolean, NonLock: list of Brep, WithLock: list of Brep
# ---------- haslock: C# ----------
    if(AddLock)
      A = WithLock;
    else
      A = NonLock;
# ---------- end haslock ----------

# ---- group: Load Kinetic Unit into Model
pickbtn = CreateRhinoPickButton(ButtonName="LOAD", Prompt="Please select geometry...", AllowMultiple="FALSE", AllowNone="FALSE", Type=0, ButtonStyle=0)
values_4 = ValueListener(Elements=pickbtn, SomeProperty=True)  # -> Values, Indices
placeboxinsidebrep = PlaceBoxInsideBrep(bp=values_4.Values, Me=haslock, vec=setdirection.A, curve=spiralline, arrow=crv)  # -> axis, bottom, gear, spiral, GearNormal
brep = Brep([placeboxinsidebrep.axis, placeboxinsidebrep.bottom])

# ---- group: Distance Slider
distance = Slider(3, range=1..5)
slider_2 = CreateSlider(Slider=distance, ShowBounds=False, ShowTicks=False, ShowTooltip=False, ShowValLabel=True, showLabel=True)
values_5 = ValueListener(Elements=slider_2, SomeProperty=True)  # -> Values, Indices
adjustspiral = CSharpScript(Distance=values_5.Values)  # -> b, t; inputs Distance: Int32
# ---------- adjustspiral: C# ----------
    b = Distance;
    t = 0.8 + 0.2 * Distance;
# ---------- end adjustspiral ----------
initialvelocity = CSharpScript(b=adjustspiral.b, t=adjustspiral.t, curve=spiralline, r=gearradius)  # -> A; inputs b: Double, t: Double, curve: Curve, r: Double
# ---------- initialvelocity: C# ----------
    double E = 0.394;
    double sita = 810 / 360;
    double M = Math.PI * E * b * t * t * t * sita / (6 * curve.GetLength());
    double F = M / r;
    double m = 12 * Math.PI * Math.Pow(r / 1000, 2) * 0.001;
    double a = F / m;
    double time = 0.2;
    double s = a * time * time / 2 * 1000;
    double w = s / r / time;
    A = w;
# ---------- end initialvelocity ----------
spiralspring_2 = CSharpScript(b=adjustspiral.b, t=adjustspiral.t, spiral=placeboxinsidebrep.spiral, direct=setdirection.A)  # -> A; inputs b: Double, t: Double, spiral: Curve, direct: Vector3d
# ---------- spiralspring_2: C# ----------
    BoundingBox box = spiral.GetBoundingBox(false);
    Plane spiralPlane;
    Plane secPlane;
    Vector3d spiralNormal;
    Rhino.Geometry.Rectangle3d rec;
    if(box.Max.Y - box.Min.Y < 5)
    {
      spiralPlane = Plane.WorldZX;
      secPlane = Plane.WorldXY;
      spiralNormal = Vector3d.YAxis;
      rec = new Rectangle3d(secPlane,t, b);
    }
    else
    {
      spiralPlane = Plane.WorldXY;
      secPlane = Plane.WorldZX;
      spiralNormal = Vector3d.ZAxis;
      rec = new Rectangle3d(secPlane, b, t);
    }
    //Create Spiral Spring

    Curve sec = rec.ToNurbsCurve();
    var xf = Transform.Translation(spiral.PointAtStart - rec.Center);
    sec.Transform(xf);
    var sweep = new Rhino.Geometry.SweepOneRail();
    sweep.AngleToleranceRadians = RhinoMath.SqrtEpsilon;
    sweep.ClosedSweep = false;
    sweep.SweepTolerance = RhinoMath.SqrtEpsilon;
    //sweep.SetToRoadlikeTop();
    var breps = sweep.PerformSweep(spiral, sec);
    Brep spiralSpring = breps[0].CapPlanarHoles(RhinoMath.SqrtEpsilon);
    //Create center support
    double centerRadius = 5.2;
    Curve c = new Circle(spiralPlane, box.Center, centerRadius).ToNurbsCurve();
    Brep surface = Brep.CreatePlanarBreps(c, Rhino.RhinoMath.SqrtEpsilon)[0];
    Curve curve = new Line(box.Center, spiralNormal, b).ToNurbsCurve();
    Brep center = surface.Faces[0].CreateExtrusion(curve, true);
    center.Transform(Transform.Translation(-b / 2 * spiralNormal));
    //merge center and spiral
    //Brep[] springs = {spiralSpring,center};
    //spiralSpring = Brep.CreateBooleanUnion(springs, RhinoMath.SqrtEpsilon)[0];
    //rotate spiralspring to direct
    List<Brep> springs = new List<Brep>();
    springs.Add(center);
    springs.Add(spiralSpring);
    var xrotateBack = Transform.Rotation(Vector3d.XAxis, direct, Point3d.Origin);
    foreach(Brep spring in springs)
      spring.Transform(xrotateBack);

    A = springs;
# ---------- end spiralspring_2 ----------

# ---- group: Create Gears In the Model
pickbtn_2 = CreateRhinoPickButton(
    ButtonName="FUNCTIONAL",
    Prompt="Please select geometry...",
    AllowMultiple="FALSE",
    AllowNone="FALSE",
    Type=0,
    ButtonStyle=0)
values_6 = ValueListener(Elements=pickbtn_2, SomeProperty=True)  # -> Values, Indices
dynamicconnection = DynamicConnection(
    axis=values_6.Values,
    gear=placeboxinsidebrep.gear,
    bp=values_4.Values,
    speed=values.Values,
    vec=setdirection.A,
    initialVelocity=initialvelocity)  # -> gears, axises, angleVelocity, steer, finalGearNormal

# ---- group: Export
true_button_2 = CreateTrueOnlyButton(ButtonName="EXPORT", ButtonStyle=0)
values_7 = ValueListener(Elements=true_button_2, SomeProperty=True)  # -> Values, Indices
merge_3 = Merge(
    Data1=flatten(brep),
    Data2=flatten(dynamicconnection.gears),
    Data3=flatten(dynamicconnection.axises),
    Data4=spiralspring_2)
export = CSharpScript(export=values_7.Values, brep=merge_3)  # inputs export: Boolean, brep: list of Brep
# ---------- export: C# ----------
    if(export)
    {
      RhinoDoc myDoc = RhinoDoc.ActiveDoc;
      foreach(Brep brep0 in brep)
        myDoc.Objects.AddBrep(brep0);
    }
    return;
# ---------- end export ----------

# ---- group: Simulation
int = Integer(1)
timer = Timer(TimerInterval=20, Target=datarecorder)
toggle = CreateToggle(Default=False, Label="SIMULATION")
values_8 = ValueListener(Elements=toggle, SomeProperty=True)  # -> Values, Indices
datarecorder = GhPythonScript(x=int, enable=values_8.Values)  # -> out, a; inputs x: Int32, enable: Boolean
# ---------- datarecorder: Python ----------
__author__ = "ybliang19970108"
__version__ = "2020.01.20"

import rhinoscriptsyntax as rs
from scriptcontext import sticky
if 'x' not in sticky:
    sticky['x']=[]
if enable: 
    sticky['x'].append(x)
else:
    sticky['x']=[]
a=sticky['x']
# ---------- end datarecorder ----------
item = ListItem(List=dynamicconnection.angleVelocity, Index=0, Wrap=True)
ma = MassAddition(Input=datarecorder.a)  # -> Result, PartialResults
simulation = Simulation(Double=item, Brep=values_6.Values)  # -> v0, a, rotate, move, radius
time = CSharpScript(x=ma.Result)  # -> A; inputs x: Int32
# ---------- time: C# ----------
    A = x / 3.0;
# ---------- end time ----------
merge_4 = Merge(Data1=flatten(placeboxinsidebrep.bottom), Data2=flatten(simulation.move))
multiplication_2 = Multiplication(A=simulation.a, B="1000")
animation = Animation(
    v0=simulation.v0,
    a=multiplication_2,
    t=time,
    gears=dynamicconnection.gears,
    rotateAxis=simulation.rotate,
    rotateGear=placeboxinsidebrep.axis,
    move=merge_4,
    w=dynamicconnection.angleVelocity,
    direct=setdirection.A,
    maxRadius=simulation.radius,
    gearNormal=placeboxinsidebrep.GearNormal)

# ---- group: Interface
merge_5 = Merge(Data1=slider_2, Data2=slider, Data3=true_button)
merge_6 = Merge(Data1=image, Data2=checkbox, Data3=pickbtn, Data4=pickbtn_2)
expander = CreateExpander(UIElements=merge_6, Header="CONNECTION CONFIGURATIONS", Open=True)
adjustpos = AdjustElementPositioning(
    ElementsToAdjust=[pickbtn, pickbtn_2, true_button, true_button_2],
    AbsolutePositioning=False,
    Width=Slider(300, range=0..1000))
expander_2 = CreateExpander(UIElements=merge_5, Header="MOTION DESIGN", Open=True)
merge_7 = Merge(Data1=image, Data2=expander_2, Data3=expander, Data4=toggle, Data5=true_button_2)
launchwin = LaunchWindow(
    Show=Toggle(True),
    Name="Control Window",
    Width=Slider(400, range=0..1000),
    Height=Slider(400, range=0..1000),
    ChildStatus=0,
    EnableHorizScroll=False)
addelems = AddElements(Window=launchwin, Elements=flatten(merge_7), DoVLChecking=True)  # -> AddedElements, ElementNames

# ==== cluster Gear
N = ClusterInput()
R = ClusterInput()
F = ClusterInput()
A = ClusterInput()
B = ClusterInput()
F_2 = ClusterInput()
gearline = GearLine(N=N, R=R, F=F, A=A, B=B)
Z = UnitZ(Factor=F_2)
addition = Addition(A="5", B="1")
boundary = BoundarySurfaces(Edges=gearline)
extr = Extrude(Base=boundary, Direction=Z)
Z_2 = UnitZ(Factor=addition)
move = Move(Geometry=extr, Motion=Z_2)  # -> Geometry, Transform
G = ClusterOutput(move.Geometry)

# ==== cluster SpiralLine
Z = UnitZ(Factor=1)
turncount = ClusterInput()
radius0 = ClusterInput()
radius1 = ClusterInput()
createspiral = CSharpScript(axisStart="0,0,0", axisDir=Z, radiusPoint="1,0,0", pitch="0", turnCount=turncount, radius0=radius0, radius1=radius1)  # -> out, A; inputs axisStart: Point3d, axisDir: Vector3d, radiusPoint: Point3d, pitch: Double, turnCount: Double, radius0: Double, radius1: Double
# ---------- createspiral: C# ----------
    Rhino.Geometry.NurbsCurve nc = Rhino.Geometry.NurbsCurve.CreateSpiral(axisStart, axisDir, radiusPoint, pitch, turnCount, radius0, radius1);
    A = nc;
# ---------- end createspiral ----------
A = ClusterOutput(createspiral.A)

# ==== cluster SpiralSpring
C = ClusterInput()
end = EndPoints(Curve=C)  # -> Start, End
xz = XZPlane(Origin=Point(0, 0, 0))
rectangle = Rectangle(Plane=xz, XSize="1.8", YSize="1.8", Radius=0)  # -> Rectangle, Length
move = Move(Geometry=rectangle.Rectangle, Motion=end.Start)  # -> Geometry, Transform
R = ClusterInput()
swp1 = Sweep1(Rail=R, Sections=move.Geometry, Miter=1)
cap = CapHoles(Brep=swp1)
B = ClusterOutput(cap)

# ==== cluster GearLine
R = ClusterInput()
N = ClusterInput()
cir = Circle(Plane=PlaneXY(0, 0, 0), Radius=R)
divide = DivideCurve(Curve=cir, Count=N, Kinks=False)  # -> Points, Tangents, Parameters
dispatch = Dispatch(List=divide.Points, DispatchPattern=[True, False])  # -> ListA, ListB
ln = Line(StartPoint=dispatch.ListA, EndPoint=dispatch.ListB)
vec = Vector(ln)
pi = Pi(Factor=-0.5)
Z = UnitZ(Factor=1)
vrot = Rotate(Vector=vec, Axis=Z, Angle=pi)
A = ClusterInput()
amp = Amplitude(Vector=vrot, Amplitude=A)
move = Move(Geometry=ln, Motion=amp)  # -> Geometry, Transform
crv = Curve(ln)
B = ClusterInput()
eval = EvaluateLength(Curve=move.Geometry, Length=0.5, Normalized=True)  # -> Point, Tangent, Parameter
F = ClusterInput()
division = Division(A="1", B=B)
scale = Scale(Geometry=move.Geometry, Center=eval.Point, Factor=F)  # -> Geometry, Transform
eval_2 = EvaluateLength(Curve=crv, Length=0.5, Normalized=True)  # -> Point, Tangent, Parameter
scale_2 = Scale(Geometry=crv, Center=eval_2.Point, Factor=division)  # -> Geometry, Transform
end = EndPoints(Curve=scale.Geometry)  # -> Start, End
shift = ShiftList(List=scale_2.Geometry, Shift=1, Wrap=True)
end_2 = EndPoints(Curve=scale_2.Geometry)  # -> Start, End
end_3 = EndPoints(Curve=shift)  # -> Start, End
ln_2 = Line(StartPoint=end.Start, EndPoint=end_2.Start)
ln_3 = Line(StartPoint=end.End, EndPoint=end_2.End)
ln_4 = Line(StartPoint=end_2.End, EndPoint=end_3.Start)
merge = Merge(Data1=ln_2, Data2=ln_3, Data3=ln_4, Data4=scale.Geometry)  # -> flatten(Result)
R_2 = ClusterOutput(merge)
