# Grasshopper definition gear example_experiment.gh (Grasshopper 1.0.7)
# plug-ins: Gear

number_slider = Slider(17, range=0..100)
teeth = Slider(7, range=5..20)
pflip = FlipPlane(Plane=PlaneXY(382.821807, 7.740674171, 0), ReverseX=Toggle(True), ReverseY=False, SwapAxes=True)
neg = Negative(Value=number_slider)
addition = Addition(A="150", B=number_slider)
cir = Circle(Plane=pflip, Radius=Slider(11, range=5..20))
number_slider_2 = Slider(23, range=0..50)
pt = ConstructPoint(XCoordinate=addition, YCoordinate=neg, ZCoordinate=0)
pt_2 = ConstructPoint(XCoordinate="150", YCoordinate=0, ZCoordinate=0)
Y = UnitY(Factor=1)
crv = Curve(<curve referenced from the Rhino model>)
ratchet = RatchetPawl(Circle=cir, Teeth=teeth, TeethDeth=2, PawlNumber=3, PawlRadius=0.2, PawlThickness=1)  # -> Ratchet, Pawl, PawlCover
line = LineSDL(Start=pt, Direction=Y, Length=Slider(23, range=0..100))
spurg = SpurGear(Circles=crv, Teeth=Slider(12, range=0..100), Angle=22.5, Shift=0.1, Addendum=1, Dedendum=1.25)  # -> Gears, Pitch, Ratio
Z = UnitZ(Factor=1)
extr = Extrude(Base=ratchet.Ratchet, Direction=Z)

expression = Expression(r=number_slider, t=number_slider_2, Expression="2*r/t")
cir_2 = Circle(Plane=pt_2, Radius=number_slider)

panel = Panel(spurg.Ratio)
panel_2 = Panel(spurg.Gears)
panel_3 = Panel(spurg.Pitch)
cap = CapHoles(Brep=extr)
rack = Rack(Line=line, CircleModule=cir_2, Teeth=number_slider_2, Angle=22.5, Addendum=1, Dedendum=1.25)
number_slider_3 = Slider(66, range=0..100)
number_slider_4 = Slider(0, range=0..100)
Y_2 = UnitY(Factor=1)
pt_3 = ConstructPoint(XCoordinate=number_slider_3, YCoordinate=0, ZCoordinate=0)
pt_4 = ConstructPoint(XCoordinate=number_slider_3, YCoordinate=number_slider_4, ZCoordinate=number_slider_4)
cir_3 = Circle(Plane=pt_3, Radius=Slider(15, range=5..20))
line_2 = LineSDL(Start=pt_4, Direction=Y_2, Length=Slider(37, range=0..100))
rack_2 = Rack(
    Line=line_2,
    CircleModule=cir_3,
    Teeth=Slider(16, range=0..100),
    Angle=Slider(22.5, range=15..35),
    Addendum=1,
    Dedendum=1.25)
