# Grasshopper definition KinergyMainInterface-old.gh (Grasshopper 1.0.7)
# plug-ins: Human UI

# ---- group: Oscillating + Translating / motion basics
separatorheight = Slider(4, range=0..10)
colour = ColourPicker(PickedColour=RGB(230, 230, 230))
separator = CreateSeparator(Thickness=0.5, Horizontal=True, Color=colour, Height=separatorheight)
width = Slider(110, range=0..1000)
height = Slider(35, range=0..1000)
label = CreateLabel(LabelText="Input action:", LabelSize=12, Justification=0)
adjustpos = AdjustElementPositioning(
    ElementsToAdjust=label,
    Margin="10,5,0,10",
    AbsolutePositioning=False,
    Width=width,
    Height=height,
    HorizontalAlignment=Slider(0, range=0..100))
height_2 = Slider(38, range=0..1000)
label_2 = CreateLabel(LabelText="Translating+Oscillating Basics", LabelSize=12, Justification=0)
width_2 = Slider(566, range=0..1000)
width_3 = Slider(110, range=0..1000)
height_3 = Slider(35, range=0..1000)
radiobtn = CreateRadioButton(RadioButtonName="Press/Compress", RadioButtonGroup="translation input action", InitiallySelected=False)
adjustpos_2 = AdjustElementPositioning(
    ElementsToAdjust=label_2,
    Margin="10,5,0,10",
    AbsolutePositioning=False,
    Width=width_2,
    Height=height_2,
    HorizontalAlignment=Slider(0, range=0..100))
adjustpos_3 = AdjustElementPositioning(
    ElementsToAdjust=radiobtn,
    Margin="95,-55,0,10",
    AbsolutePositioning=False,
    Width=width_3,
    Height=height_3,
    HorizontalAlignment=Slider(0, range=0..100))
titlesize = Slider(20, range=0..30)
colour_2 = ColourPicker(PickedColour=RGB(51, 121, 200))
adjustelem = AdjustElementAppearance(ElementsToAdjust=label_2, Foreground=colour_2, FontSize=titlesize)
radiobtn_2 = CreateRadioButton(RadioButtonName="Twist/Turn", RadioButtonGroup="translation input action", InitiallySelected=False)
height_4 = Slider(35, range=0..1000)
width_4 = Slider(115, range=0..1000)
adjustpos_4 = AdjustElementPositioning(
    ElementsToAdjust=radiobtn_2,
    Margin="225,-55,0,10",
    AbsolutePositioning=False,
    Width=width_4,
    Height=height_4,
    HorizontalAlignment=Slider(0, range=0..100))

# ----
panel = Panel("""Circle
Heart
Ecllipse""")
width_5 = Slider(300, range=0..1000)
height_5 = Slider(34, range=0..1000)
pulldown = CreatePulldownMenu(Label="Trajectory", ListItems=panel, showLabel=True)
adjustpos_5 = AdjustElementPositioning(
    ElementsToAdjust=pulldown,
    Margin="10,0,0,5",
    AbsolutePositioning=False,
    Width=width_5,
    Height=height_5,
    HorizontalAlignment=Slider(0, range=0..100))

# ---- group: Reset Motion
width_6 = Slider(50, range=0..1000)
height_6 = Slider(30, range=0..1000)
button = CreateButton(ButtonName="Clear", ButtonStyle=0)
adjustpos_6 = AdjustElementPositioning(
    ElementsToAdjust=button,
    Margin="270,-45,0,10",
    AbsolutePositioning=False,
    Width=width_6,
    Height=height_6,
    HorizontalAlignment=Slider(0, range=0..100))
values = ValueListener(Elements=button, SomeProperty=True)  # -> Values, Indices

# ---- group: Top Menu
number_slider = Slider(0, range=0..100)
width_7 = Slider(426, range=0..1000)
height_7 = Slider(35, range=0..1000)
width_8 = Slider(70, range=0..1000)
height_8 = Slider(35, range=0..1000)
width_9 = Slider(80, range=0..1000)
height_9 = Slider(35, range=0..1000)
width_10 = Slider(196, range=0..1000)
height_10 = Slider(35, range=0..1000)
radiobtn_3 = CreateRadioButton(RadioButtonName="Translating+Oscillating", RadioButtonGroup="motion type", InitiallySelected=False)
adjustpos_7 = AdjustElementPositioning(
    ElementsToAdjust=radiobtn_3,
    Margin="5,-10,0,10",
    AbsolutePositioning=False,
    Width=width_10,
    Height=height_10,
    HorizontalAlignment=Slider(0, range=0..100))
radiobtn_4 = CreateRadioButton(RadioButtonName="Oscillating", RadioButtonGroup="motion type", InitiallySelected=False)
adjustpos_8 = AdjustElementPositioning(
    ElementsToAdjust=radiobtn_4,
    Margin="180,-45,0,10",
    AbsolutePositioning=False,
    Width=width_9,
    Height=height_9,
    HorizontalAlignment=Slider(0, range=0..100))
radiobtn_5 = CreateRadioButton(RadioButtonName="Translating", RadioButtonGroup="motion type", InitiallySelected=False)
adjustpos_9 = AdjustElementPositioning(
    ElementsToAdjust=radiobtn_5,
    Margin="5,-10,0,10",
    AbsolutePositioning=False,
    Width=width_7,
    Height=height_7,
    HorizontalAlignment=number_slider)
radiobtn_6 = CreateRadioButton(RadioButtonName="Rotating", RadioButtonGroup="motion type", InitiallySelected=False)
adjustpos_10 = AdjustElementPositioning(
    ElementsToAdjust=radiobtn_6,
    Margin="100,-45,0,10",
    AbsolutePositioning=False,
    Width=width_8,
    Height=height_8,
    HorizontalAlignment=Slider(0, range=0..100))
label_3 = CreateLabel(LabelText="Select a target motion type:", LabelSize=12, Justification=0)
adjustpos_11 = AdjustElementPositioning(
    ElementsToAdjust=label_3,
    Margin="0,0,0,5",
    AbsolutePositioning=False,
    Width=width_7,
    Height=height_7,
    HorizontalAlignment=number_slider)

# ---- group: Translating / motion basics
separatorheight_2 = Slider(4, range=0..10)
colour_3 = ColourPicker(PickedColour=RGB(230, 230, 230))
width_11 = Slider(110, range=0..1000)
height_11 = Slider(35, range=0..1000)
separator_2 = CreateSeparator(Thickness=0.5, Horizontal=True, Color=colour_3, Height=separatorheight_2)
width_12 = Slider(110, range=0..1000)
height_12 = Slider(35, range=0..1000)
label_4 = CreateLabel(LabelText="Input action:", LabelSize=12, Justification=0)
label_5 = CreateLabel(LabelText="Output motion:", LabelSize=12, Justification=0)
adjustpos_12 = AdjustElementPositioning(
    ElementsToAdjust=label_5,
    Margin="10,-10,0,10",
    AbsolutePositioning=False,
    Width=width_11,
    Height=height_11,
    HorizontalAlignment=Slider(0, range=0..100))
adjustpos_13 = AdjustElementPositioning(
    ElementsToAdjust=label_4,
    Margin="10,5,0,10",
    AbsolutePositioning=False,
    Width=width_12,
    Height=height_12,
    HorizontalAlignment=Slider(0, range=0..100))
width_13 = Slider(110, range=0..1000)
height_13 = Slider(35, range=0..1000)
height_14 = Slider(38, range=0..1000)
label_6 = CreateLabel(LabelText="Translating Basics", LabelSize=12, Justification=0)
width_14 = Slider(566, range=0..1000)
width_15 = Slider(110, range=0..1000)
height_15 = Slider(35, range=0..1000)
radiobtn_7 = CreateRadioButton(RadioButtonName="Last for a while", RadioButtonGroup="translation output type", InitiallySelected=False)
values_2 = ValueListener(Elements=radiobtn_7, SomeProperty=True)  # -> Values, Indices
radiobtn_8 = CreateRadioButton(RadioButtonName="Press/Compress", RadioButtonGroup="translation input action", InitiallySelected=False)
values_3 = ValueListener(Elements=radiobtn_8, SomeProperty=True)  # -> Values, Indices
adjustpos_14 = AdjustElementPositioning(
    ElementsToAdjust=radiobtn_7,
    Margin="110,-55,0,10",
    AbsolutePositioning=False,
    Width=width_13,
    Height=height_13,
    HorizontalAlignment=Slider(0, range=0..100))
adjustpos_15 = AdjustElementPositioning(
    ElementsToAdjust=label_6,
    Margin="10,5,0,10",
    AbsolutePositioning=False,
    Width=width_14,
    Height=height_14,
    HorizontalAlignment=Slider(0, range=0..100))
adjustpos_16 = AdjustElementPositioning(
    ElementsToAdjust=radiobtn_8,
    Margin="95,-55,0,10",
    AbsolutePositioning=False,
    Width=width_15,
    Height=height_15,
    HorizontalAlignment=Slider(0, range=0..100))
width_16 = Slider(115, range=0..1000)
height_16 = Slider(35, range=0..1000)
titlesize_2 = Slider(20, range=0..30)
colour_4 = ColourPicker(PickedColour=RGB(51, 121, 200))
radiobtn_9 = CreateRadioButton(RadioButtonName="Instant", RadioButtonGroup="translation output type", InitiallySelected=False)
adjustpos_17 = AdjustElementPositioning(
    ElementsToAdjust=radiobtn_9,
    Margin="235,-55,0,10",
    AbsolutePositioning=False,
    Width=width_16,
    Height=height_16,
    HorizontalAlignment=Slider(0, range=0..100))
values_4 = ValueListener(Elements=radiobtn_9, SomeProperty=True)  # -> Values, Indices
adjustelem_2 = AdjustElementAppearance(ElementsToAdjust=label_6, Foreground=colour_4, FontSize=titlesize_2)
radiobtn_10 = CreateRadioButton(RadioButtonName="Twist/Turn", RadioButtonGroup="translation input action", InitiallySelected=False)
values_5 = ValueListener(Elements=radiobtn_10, SomeProperty=True)  # -> Values, Indices
python = GhPythonScript(x=values_3.Values, y=values_5.Values)  # -> a, b
# ---------- python: Python ----------
__author__ = "ediga"
__version__ = "2020.07.29"

import rhinoscriptsyntax as rs

if x and not y:
    a = False
    b = False
elif not x and y:
    a = False
    b = True
else:
    a = True
    b = True
# ---------- end python ----------
hideshow = HideShowElement(ElementToHideShow=radiobtn_7, Show=Toggle(True), Collapse=Toggle(False), Disable=python.a)
hideshow_2 = HideShowElement(ElementToHideShow=radiobtn_9, Show=Toggle(True), Collapse=Toggle(False), Disable=python.b)
height_17 = Slider(35, range=0..1000)
width_17 = Slider(115, range=0..1000)
adjustpos_18 = AdjustElementPositioning(
    ElementsToAdjust=radiobtn_10,
    Margin="225,-55,0,10",
    AbsolutePositioning=False,
    Width=width_17,
    Height=height_17,
    HorizontalAlignment=Slider(0, range=0..100))

# ---- group: Motion Selection Logic
values_6 = ValueListener(Elements=radiobtn_5, SomeProperty=True)  # -> Values, Indices
values_7 = ValueListener(Elements=radiobtn_6, SomeProperty=True)  # -> Values, Indices
values_8 = ValueListener(Elements=radiobtn_4, SomeProperty=True)  # -> Values, Indices
values_9 = ValueListener(Elements=radiobtn_3, SomeProperty=True)  # -> Values, Indices
panel_2 = Panel(values_6.Values)
panel_3 = Panel(values_7.Values)
panel_4 = Panel(values_8.Values)
panel_5 = Panel(values_9.Values)
python_2 = GhPythonScript(x=values_6.Values, y=values_7.Values, z=values_8.Values, u=values_9.Values)  # -> a, b, c, d, e
# ---------- python_2: Python ----------
#provides a scripting component.
#    Inputs:
#        x: Translation button listener
#        y: Rotation button listener
#        z: Oscillating button listener
#        u: Translation+oscillating button listener
#    Output:
#        a: Visibility indicator for the translation control panel
#        b: Visibility indicator for the rotation control panel
#        c: Visibility indicator for the oscillating control panel
#        d: Visibility indicator for the translation + oscillating control panel
#        e: Visibility indicator for the default control panel
#
#__author__ = "ediga"
#__version__ = "2020.07.28"

import rhinoscriptsyntax as rs


if x and not y and not z and not u:
    a = True
    b = False
    c = False
    d = False
    e = False
elif not x and y and not z and not u:
    a = False
    b = True
    c = False
    d = False
    e = False
elif not x and not y and z and not u:
    a = False
    b = False
    c = True
    d = False
    e = False
elif not x and not y and not z and u:
    a = False
    b = False
    c = False
    d = True
    e = False
else:
    a = False
    b = False
    c = False
    d = False
    e = True
# ---------- end python_2 ----------

# ---- group: Oscillating + Translating
colour_5 = ColourPicker(PickedColour=RGB(101, 168, 99))
width_18 = Slider(566, range=0..1000)
height_18 = Slider(38, range=0..1000)
titlesize_3 = Slider(20, range=0..30)
label_7 = CreateLabel(LabelText="Kinetic Unit for Trans+Oscillating", LabelSize=12, Justification=0)
strength = Slider(0.5, range=0..1)
repetition = Slider(10, range=0..20)
separatorheight_3 = Slider(10, range=0..10)
colour_6 = ColourPicker(PickedColour=RGB(230, 230, 230))
width_19 = Slider(400, range=0..1000)
adjustpos_19 = AdjustElementPositioning(
    ElementsToAdjust=label_7,
    Margin="10,5,0,20",
    AbsolutePositioning=False,
    Width=width_18,
    Height=height_18,
    HorizontalAlignment=Slider(0, range=0..100))
adjustelem_3 = AdjustElementAppearance(ElementsToAdjust=label_7, Foreground=colour_5, FontSize=titlesize_3)
width_20 = Slider(150, range=0..1000)
height_19 = Slider(30, range=0..1000)
width_21 = Slider(310, range=0..400)
height_20 = Slider(30, range=0..30)
width_22 = Slider(310, range=0..400)
height_21 = Slider(30, range=0..30)
slider = CreateSlider(Slider=strength, ShowBounds=False, ShowTicks=False, ShowTooltip=False, ShowValLabel=True, showLabel=True)
slider_2 = CreateSlider(Slider=repetition, ShowBounds=False, ShowTicks=False, ShowTooltip=False, ShowValLabel=True, showLabel=True)
separator_3 = CreateSeparator(Thickness=0.5, Horizontal=True, Color=colour_6, Width=width_19, Height=separatorheight_3)
separatorheight_4 = Slider(4, range=0..10)
panel_6 = Panel("""Uniform
Modified uniform
Uniform acceleration & deceleration""")
colour_7 = ColourPicker(PickedColour=RGB(230, 230, 230))
width_23 = Slider(400, range=0..1000)
true_button = CreateTrueOnlyButton(ButtonName="Select region of interest", ButtonStyle=0)
adjustpos_20 = AdjustElementPositioning(
    ElementsToAdjust=true_button,
    Margin="10,0,0,10",
    AbsolutePositioning=False,
    Width=width_20,
    Height=height_19,
    HorizontalAlignment=Slider(0, range=0..100))
adjustpos_21 = AdjustElementPositioning(
    ElementsToAdjust=slider,
    Margin="10,5,0,10",
    AbsolutePositioning=False,
    Width=width_21,
    Height=height_20,
    HorizontalAlignment=Slider(0, range=0..100))
adjustpos_22 = AdjustElementPositioning(
    ElementsToAdjust=slider_2,
    Margin="10,0,0,5",
    AbsolutePositioning=False,
    Width=width_22,
    Height=height_21,
    HorizontalAlignment=Slider(0, range=0..100))
width_24 = Slider(300, range=0..1000)
height_22 = Slider(34, range=0..1000)
checkbox = CreateCheckbox(Label="Add a lock", StartingValue=False)
width_25 = Slider(135, range=0..1000)
height_23 = Slider(30, range=0..1000)
width_26 = Slider(135, range=0..1000)
button_2 = CreateButton(ButtonName="Preview", ButtonStyle=0)
height_24 = Slider(30, range=0..1000)
width_27 = Slider(150, range=0..1000)
height_25 = Slider(30, range=0..1000)
separator_4 = CreateSeparator(Thickness=0.5, Horizontal=True, Color=colour_7, Width=width_23, Height=separatorheight_4)
width_28 = Slider(150, range=0..1000)
height_26 = Slider(30, range=0..1000)
width_29 = Slider(450, range=0..1000)
height_27 = Slider(35, range=0..1000)
pulldown_2 = CreatePulldownMenu(Label="Pattern", ListItems=panel_6, showLabel=True)
adjustpos_23 = AdjustElementPositioning(
    ElementsToAdjust=pulldown_2,
    Margin="10,0,0,10",
    AbsolutePositioning=False,
    Width=width_24,
    Height=height_22,
    HorizontalAlignment=Slider(0, range=0..100))
true_button_2 = CreateTrueOnlyButton(ButtonName="Select the input handler", ButtonStyle=0)
true_button_3 = CreateTrueOnlyButton(ButtonName="Select the end effector", ButtonStyle=0)
true_button_4 = CreateTrueOnlyButton(ButtonName="Set translating direction", ButtonStyle=0)
adjustpos_24 = AdjustElementPositioning(ElementsToAdjust=true_button_4, Margin="165,-40,0,10", AbsolutePositioning=False, Width=width_25, Height=height_23)
adjustpos_25 = AdjustElementPositioning(
    ElementsToAdjust=true_button_3,
    Margin="177,-40,0,15",
    AbsolutePositioning=False,
    Width=width_26,
    Height=height_24,
    HorizontalAlignment=Slider(0, range=0..100))
adjustpos_26 = AdjustElementPositioning(
    ElementsToAdjust=true_button_2,
    Margin="10,5,0,10",
    AbsolutePositioning=False,
    Width=width_27,
    Height=height_25,
    HorizontalAlignment=Slider(0, range=0..100))
adjustpos_27 = AdjustElementPositioning(
    ElementsToAdjust=button_2,
    Margin="165,-45,0,10",
    AbsolutePositioning=False,
    Width=width_28,
    Height=height_26,
    HorizontalAlignment=Slider(0, range=0..100))
adjustpos_28 = AdjustElementPositioning(ElementsToAdjust=checkbox, Margin="15,5,0,10", AbsolutePositioning=False, Width=width_29, Height=height_27)
hideshow_3 = HideShowElement(ElementToHideShow=pulldown_2, Show=Toggle(True), Collapse=Toggle(False), Disable=False)
hideshow_4 = HideShowElement(ElementToHideShow=true_button_3, Show=Toggle(True), Collapse=Toggle(False), Disable=False)
hideshow_5 = HideShowElement(ElementToHideShow=true_button_2, Show=Toggle(True), Collapse=Toggle(False), Disable=False)
merge = Merge(
    Data1=separator,
    Data2=label_2,
    Data3=label,
    Data4=radiobtn,
    Data5=radiobtn_2,
    Data9=separator_4,
    Data10=label_7,
    Data11=true_button,
    Data12=true_button_4,
    Data13=true_button_2,
    Data14=true_button_3,
    Data15=pulldown_2,
    Data16=slider,
    Data17=slider_2,
    Data18=pulldown,
    Data21=separator_3,
    Data22=checkbox,
    Data23=button_2)
stack = CreateStack(UIElements=merge, Horizontal=Toggle(False))
hideshow_6 = HideShowElement(ElementToHideShow=stack, Show=python_2.d, Collapse=Toggle(True), Disable=Toggle(False))

# ---- group: Translating
colour_8 = ColourPicker(PickedColour=RGB(101, 168, 99))
width_30 = Slider(566, range=0..1000)
height_28 = Slider(38, range=0..1000)
titlesize_4 = Slider(20, range=0..30)
label_8 = CreateLabel(LabelText="Kinetic Unit for Translating", LabelSize=12, Justification=0)
strength_2 = Slider(0.5, range=0..1)
displacement = Slider(10.187, range=0..20)
separatorheight_5 = Slider(10, range=0..10)
colour_9 = ColourPicker(PickedColour=RGB(230, 230, 230))
width_31 = Slider(400, range=0..1000)
adjustpos_29 = AdjustElementPositioning(
    ElementsToAdjust=label_8,
    Margin="10,5,0,20",
    AbsolutePositioning=False,
    Width=width_30,
    Height=height_28,
    HorizontalAlignment=Slider(0, range=0..100))
adjustelem_4 = AdjustElementAppearance(ElementsToAdjust=label_8, Foreground=colour_8, FontSize=titlesize_4)
width_32 = Slider(150, range=0..1000)
height_29 = Slider(30, range=0..1000)
width_33 = Slider(310, range=0..400)
height_30 = Slider(30, range=0..30)
width_34 = Slider(310, range=0..400)
height_31 = Slider(30, range=0..30)
slider_3 = CreateSlider(Slider=strength_2, ShowBounds=False, ShowTicks=False, ShowTooltip=False, ShowValLabel=True, showLabel=True)
slider_4 = CreateSlider(Slider=displacement, ShowBounds=False, ShowTicks=False, ShowTooltip=False, ShowValLabel=True, showLabel=True)
separator_5 = CreateSeparator(Thickness=0.5, Horizontal=True, Color=colour_9, Width=width_31, Height=separatorheight_5)
separatorheight_6 = Slider(4, range=0..10)
panel_7 = Panel("""Uniform
Modified uniform
Uniform acceleration & deceleration""")
colour_10 = ColourPicker(PickedColour=RGB(230, 230, 230))
width_35 = Slider(400, range=0..1000)
true_button_5 = CreateTrueOnlyButton(ButtonName="Select region of interest", ButtonStyle=0)
adjustpos_30 = AdjustElementPositioning(
    ElementsToAdjust=true_button_5,
    Margin="10,0,0,10",
    AbsolutePositioning=False,
    Width=width_32,
    Height=height_29,
    HorizontalAlignment=Slider(0, range=0..100))
adjustpos_31 = AdjustElementPositioning(
    ElementsToAdjust=slider_3,
    Margin="10,5,0,10",
    AbsolutePositioning=False,
    Width=width_33,
    Height=height_30,
    HorizontalAlignment=Slider(0, range=0..100))
adjustpos_32 = AdjustElementPositioning(
    ElementsToAdjust=slider_4,
    Margin="10,0,0,5",
    AbsolutePositioning=False,
    Width=width_34,
    Height=height_31,
    HorizontalAlignment=Slider(0, range=0..100))
width_36 = Slider(300, range=0..1000)
height_32 = Slider(34, range=0..1000)
checkbox_2 = CreateCheckbox(Label="Add a lock", StartingValue=False)
width_37 = Slider(135, range=0..1000)
height_33 = Slider(30, range=0..1000)
width_38 = Slider(135, range=0..1000)
height_34 = Slider(30, range=0..1000)
button_3 = CreateButton(ButtonName="Preview", ButtonStyle=0)
width_39 = Slider(150, range=0..1000)
height_35 = Slider(30, range=0..1000)
width_40 = Slider(150, range=0..1000)
separator_6 = CreateSeparator(Thickness=0.5, Horizontal=True, Color=colour_10, Width=width_35, Height=separatorheight_6)
height_36 = Slider(30, range=0..1000)
width_41 = Slider(450, range=0..1000)
height_37 = Slider(35, range=0..1000)
pulldown_3 = CreatePulldownMenu(Label="Pattern", ListItems=panel_7, showLabel=True)
adjustpos_33 = AdjustElementPositioning(
    ElementsToAdjust=pulldown_3,
    Margin="10,0,0,10",
    AbsolutePositioning=False,
    Width=width_36,
    Height=height_32,
    HorizontalAlignment=Slider(0, range=0..100))
true_button_6 = CreateTrueOnlyButton(ButtonName="Select the input handler", ButtonStyle=0)
true_button_7 = CreateTrueOnlyButton(ButtonName="Select the end effector", ButtonStyle=0)
true_button_8 = CreateTrueOnlyButton(ButtonName="Set translating direction", ButtonStyle=0)
adjustpos_34 = AdjustElementPositioning(ElementsToAdjust=true_button_8, Margin="165,-40,0,10", AbsolutePositioning=False, Width=width_37, Height=height_33)
adjustpos_35 = AdjustElementPositioning(
    ElementsToAdjust=true_button_7,
    Margin="177,-40,0,15",
    AbsolutePositioning=False,
    Width=width_38,
    Height=height_34,
    HorizontalAlignment=Slider(0, range=0..100))
adjustpos_36 = AdjustElementPositioning(
    ElementsToAdjust=true_button_6,
    Margin="10,5,0,10",
    AbsolutePositioning=False,
    Width=width_39,
    Height=height_35,
    HorizontalAlignment=Slider(0, range=0..100))
adjustpos_37 = AdjustElementPositioning(
    ElementsToAdjust=button_3,
    Margin="165,-45,0,10",
    AbsolutePositioning=False,
    Width=width_40,
    Height=height_36,
    HorizontalAlignment=Slider(0, range=0..100))
adjustpos_38 = AdjustElementPositioning(ElementsToAdjust=checkbox_2, Margin="15,5,0,10", AbsolutePositioning=False, Width=width_41, Height=height_37)
hideshow_7 = HideShowElement(ElementToHideShow=pulldown_3, Show=Toggle(True), Collapse=Toggle(False), Disable=values_4.Values)
hideshow_8 = HideShowElement(ElementToHideShow=true_button_7, Show=Toggle(True), Collapse=Toggle(False), Disable=values_4.Values)
hideshow_9 = HideShowElement(ElementToHideShow=true_button_6, Show=Toggle(True), Collapse=Toggle(False), Disable=values_4.Values)
merge_2 = Merge(
    Data1=separator_2,
    Data2=label_6,
    Data3=label_4,
    Data4=radiobtn_8,
    Data5=radiobtn_10,
    Data6=label_5,
    Data7=radiobtn_7,
    Data8=radiobtn_9,
    Data9=separator_6,
    Data10=label_8,
    Data11=true_button_5,
    Data12=true_button_8,
    Data13=true_button_6,
    Data14=true_button_7,
    Data15=pulldown_3,
    Data16=slider_3,
    Data17=slider_4,
    Data21=separator_5,
    Data22=checkbox_2,
    Data23=button_3)
stack_2 = CreateStack(UIElements=merge_2, Horizontal=Toggle(False))
hideshow_10 = HideShowElement(ElementToHideShow=stack_2, Show=python_2.a, Collapse=Toggle(True), Disable=Toggle(False))

# ---- group: Default Control Panel
width_42 = Slider(860, range=0..1000)
height_38 = Slider(35, range=0..1000)
colour_11 = ColourPicker(PickedColour=RGB(200, 200, 200))
label_9 = CreateLabel(LabelText="Please select the target motion...", LabelSize=12, Justification=0)
adjustpos_39 = AdjustElementPositioning(
    ElementsToAdjust=label_9,
    Margin="70,200,0,10",
    AbsolutePositioning=False,
    Width=width_42,
    Height=height_38,
    HorizontalAlignment=Slider(0, range=0..100))
stack_3 = CreateStack(UIElements=label_9, Horizontal=Toggle(False))
hideshow_11 = HideShowElement(ElementToHideShow=stack_3, Show=python_2.e, Collapse=Toggle(True), Disable=Toggle(False))
adjustelem_5 = AdjustElementAppearance(ElementsToAdjust=label_9, Foreground=colour_11)

# ----
panel_8 = Panel(python_2.b)
panel_9 = Panel(python_2.a)
panel_10 = Panel(python_2.c)
panel_11 = Panel(python_2.d)
panel_12 = Panel(python_2.e)

# ---- group: Oscillating / motion basics
separatorheight_7 = Slider(4, range=0..10)
colour_12 = ColourPicker(PickedColour=RGB(230, 230, 230))
separator_7 = CreateSeparator(Thickness=0.5, Horizontal=True, Color=colour_12, Height=separatorheight_7)
width_43 = Slider(110, range=0..1000)
height_39 = Slider(35, range=0..1000)
label_10 = CreateLabel(LabelText="Input action:", LabelSize=12, Justification=0)
adjustpos_40 = AdjustElementPositioning(
    ElementsToAdjust=label_10,
    Margin="10,5,0,10",
    AbsolutePositioning=False,
    Width=width_43,
    Height=height_39,
    HorizontalAlignment=Slider(0, range=0..100))
height_40 = Slider(38, range=0..1000)
label_11 = CreateLabel(LabelText="Oscillating Basics", LabelSize=12, Justification=0)
width_44 = Slider(566, range=0..1000)
width_45 = Slider(110, range=0..1000)
height_41 = Slider(35, range=0..1000)
radiobtn_11 = CreateRadioButton(RadioButtonName="Press/Compress", RadioButtonGroup="translation input action", InitiallySelected=False)
adjustpos_41 = AdjustElementPositioning(
    ElementsToAdjust=label_11,
    Margin="10,5,0,10",
    AbsolutePositioning=False,
    Width=width_44,
    Height=height_40,
    HorizontalAlignment=Slider(0, range=0..100))
adjustpos_42 = AdjustElementPositioning(
    ElementsToAdjust=radiobtn_11,
    Margin="95,-55,0,10",
    AbsolutePositioning=False,
    Width=width_45,
    Height=height_41,
    HorizontalAlignment=Slider(0, range=0..100))
titlesize_5 = Slider(20, range=0..30)
colour_13 = ColourPicker(PickedColour=RGB(51, 121, 200))
adjustelem_6 = AdjustElementAppearance(ElementsToAdjust=label_11, Foreground=colour_13, FontSize=titlesize_5)
radiobtn_12 = CreateRadioButton(RadioButtonName="Twist/Turn", RadioButtonGroup="translation input action", InitiallySelected=False)
height_42 = Slider(35, range=0..1000)
width_46 = Slider(115, range=0..1000)
adjustpos_43 = AdjustElementPositioning(
    ElementsToAdjust=radiobtn_12,
    Margin="225,-55,0,10",
    AbsolutePositioning=False,
    Width=width_46,
    Height=height_42,
    HorizontalAlignment=Slider(0, range=0..100))

# ----
amplitude = Slider(10, range=0..20)
width_47 = Slider(310, range=0..400)
height_43 = Slider(30, range=0..30)
slider_5 = CreateSlider(Slider=amplitude, ShowBounds=False, ShowTicks=False, ShowTooltip=False, ShowValLabel=True, showLabel=True)

# ---- group: Oscillating
colour_14 = ColourPicker(PickedColour=RGB(101, 168, 99))
width_48 = Slider(566, range=0..1000)
height_44 = Slider(38, range=0..1000)
titlesize_6 = Slider(20, range=0..30)
label_12 = CreateLabel(LabelText="Kinetic Unit for Oscillating", LabelSize=12, Justification=0)
strength_3 = Slider(0.5, range=0..1)
repetitions = Slider(10, range=0..20)
separatorheight_8 = Slider(10, range=0..10)
colour_15 = ColourPicker(PickedColour=RGB(230, 230, 230))
width_49 = Slider(400, range=0..1000)
adjustpos_44 = AdjustElementPositioning(
    ElementsToAdjust=label_12,
    Margin="10,5,0,20",
    AbsolutePositioning=False,
    Width=width_48,
    Height=height_44,
    HorizontalAlignment=Slider(0, range=0..100))
adjustelem_7 = AdjustElementAppearance(ElementsToAdjust=label_12, Foreground=colour_14, FontSize=titlesize_6)
width_50 = Slider(150, range=0..1000)
height_45 = Slider(30, range=0..1000)
width_51 = Slider(310, range=0..400)
height_46 = Slider(30, range=0..30)
width_52 = Slider(310, range=0..400)
height_47 = Slider(30, range=0..30)
slider_6 = CreateSlider(Slider=strength_3, ShowBounds=False, ShowTicks=False, ShowTooltip=False, ShowValLabel=True, showLabel=True)
slider_7 = CreateSlider(Slider=repetitions, ShowBounds=False, ShowTicks=False, ShowTooltip=False, ShowValLabel=True, showLabel=True)
separator_8 = CreateSeparator(Thickness=0.5, Horizontal=True, Color=colour_15, Width=width_49, Height=separatorheight_8)
separatorheight_9 = Slider(4, range=0..10)
panel_13 = Panel("""Uniform
Modified uniform
Uniform acceleration & deceleration""")
colour_16 = ColourPicker(PickedColour=RGB(230, 230, 230))
width_53 = Slider(400, range=0..1000)
true_button_9 = CreateTrueOnlyButton(ButtonName="Select region of interest", ButtonStyle=0)
adjustpos_45 = AdjustElementPositioning(
    ElementsToAdjust=true_button_9,
    Margin="10,0,0,10",
    AbsolutePositioning=False,
    Width=width_50,
    Height=height_45,
    HorizontalAlignment=Slider(0, range=0..100))
adjustpos_46 = AdjustElementPositioning(
    ElementsToAdjust=slider_6,
    Margin="10,5,0,10",
    AbsolutePositioning=False,
    Width=width_51,
    Height=height_46,
    HorizontalAlignment=Slider(0, range=0..100))
adjustpos_47 = AdjustElementPositioning(
    ElementsToAdjust=slider_7,
    Margin="10,0,0,5",
    AbsolutePositioning=False,
    Width=width_52,
    Height=height_47,
    HorizontalAlignment=Slider(0, range=0..100))
width_54 = Slider(300, range=0..1000)
height_48 = Slider(34, range=0..1000)
checkbox_3 = CreateCheckbox(Label="Add a lock", StartingValue=False)
width_55 = Slider(135, range=0..1000)
height_49 = Slider(30, range=0..1000)
width_56 = Slider(135, range=0..1000)
button_4 = CreateButton(ButtonName="Preview", ButtonStyle=0)
height_50 = Slider(30, range=0..1000)
width_57 = Slider(150, range=0..1000)
height_51 = Slider(30, range=0..1000)
width_58 = Slider(150, range=0..1000)
separator_9 = CreateSeparator(Thickness=0.5, Horizontal=True, Color=colour_16, Width=width_53, Height=separatorheight_9)
height_52 = Slider(30, range=0..1000)
width_59 = Slider(450, range=0..1000)
height_53 = Slider(35, range=0..1000)
pulldown_4 = CreatePulldownMenu(Label="Pattern", ListItems=panel_13, showLabel=True)
adjustpos_48 = AdjustElementPositioning(
    ElementsToAdjust=pulldown_4,
    Margin="10,0,0,10",
    AbsolutePositioning=False,
    Width=width_54,
    Height=height_48,
    HorizontalAlignment=Slider(0, range=0..100))
true_button_10 = CreateTrueOnlyButton(ButtonName="Select the input handler", ButtonStyle=0)
true_button_11 = CreateTrueOnlyButton(ButtonName="Select the end effector", ButtonStyle=0)
true_button_12 = CreateTrueOnlyButton(ButtonName="Set oscillating direction", ButtonStyle=0)
adjustpos_49 = AdjustElementPositioning(ElementsToAdjust=true_button_12, Margin="165,-40,0,10", AbsolutePositioning=False, Width=width_55, Height=height_49)
adjustpos_50 = AdjustElementPositioning(
    ElementsToAdjust=true_button_11,
    Margin="177,-40,0,15",
    AbsolutePositioning=False,
    Width=width_56,
    Height=height_50,
    HorizontalAlignment=Slider(0, range=0..100))
adjustpos_51 = AdjustElementPositioning(
    ElementsToAdjust=true_button_10,
    Margin="10,5,0,10",
    AbsolutePositioning=False,
    Width=width_57,
    Height=height_51,
    HorizontalAlignment=Slider(0, range=0..100))
adjustpos_52 = AdjustElementPositioning(
    ElementsToAdjust=button_4,
    Margin="165,-45,0,10",
    AbsolutePositioning=False,
    Width=width_58,
    Height=height_52,
    HorizontalAlignment=Slider(0, range=0..100))
adjustpos_53 = AdjustElementPositioning(ElementsToAdjust=checkbox_3, Margin="15,5,0,10", AbsolutePositioning=False, Width=width_59, Height=height_53)
hideshow_12 = HideShowElement(ElementToHideShow=pulldown_4, Show=Toggle(True), Collapse=Toggle(False), Disable=False)
hideshow_13 = HideShowElement(ElementToHideShow=true_button_11, Show=Toggle(True), Collapse=Toggle(False), Disable=False)
hideshow_14 = HideShowElement(ElementToHideShow=true_button_10, Show=Toggle(True), Collapse=Toggle(False), Disable=False)
merge_3 = Merge(
    Data1=separator_7,
    Data2=label_11,
    Data3=label_10,
    Data4=radiobtn_11,
    Data5=radiobtn_12,
    Data9=separator_9,
    Data10=label_12,
    Data11=true_button_9,
    Data12=true_button_12,
    Data13=true_button_10,
    Data14=true_button_11,
    Data15=pulldown_4,
    Data16=slider_6,
    Data17=slider_7,
    Data18=slider_5,
    Data21=separator_8,
    Data22=checkbox_3,
    Data23=button_4)
stack_4 = CreateStack(UIElements=merge_3, Horizontal=Toggle(False))
hideshow_15 = HideShowElement(ElementToHideShow=stack_4, Show=python_2.c, Collapse=Toggle(True), Disable=Toggle(False))

# ----
adjustpos_54 = AdjustElementPositioning(
    ElementsToAdjust=slider_5,
    Margin="10,0,0,5",
    AbsolutePositioning=False,
    Width=width_47,
    Height=height_43,
    HorizontalAlignment=Slider(0, range=0..100))
radiobtn_13 = CreateRadioButton(RadioButtonName="Hinge pivot", RadioButtonGroup="rotating input action", InitiallySelected=False)
values_10 = ValueListener(Elements=radiobtn_13, SomeProperty=True)  # -> Values, Indices

# ---- group: Rotating / motion basics
separatorheight_10 = Slider(4, range=0..10)
colour_17 = ColourPicker(PickedColour=RGB(230, 230, 230))
width_60 = Slider(110, range=0..1000)
height_54 = Slider(35, range=0..1000)
separator_10 = CreateSeparator(Thickness=0.5, Horizontal=True, Color=colour_17, Height=separatorheight_10)
width_61 = Slider(110, range=0..1000)
height_55 = Slider(35, range=0..1000)
label_13 = CreateLabel(LabelText="Input action:", LabelSize=12, Justification=0)
label_14 = CreateLabel(LabelText="Output motion:", LabelSize=12, Justification=0)
adjustpos_55 = AdjustElementPositioning(
    ElementsToAdjust=label_14,
    Margin="10,-10,0,10",
    AbsolutePositioning=False,
    Width=width_60,
    Height=height_54,
    HorizontalAlignment=Slider(0, range=0..100))
adjustpos_56 = AdjustElementPositioning(
    ElementsToAdjust=label_13,
    Margin="10,5,0,10",
    AbsolutePositioning=False,
    Width=width_61,
    Height=height_55,
    HorizontalAlignment=Slider(0, range=0..100))
width_62 = Slider(110, range=0..1000)
height_56 = Slider(35, range=0..1000)
height_57 = Slider(38, range=0..1000)
label_15 = CreateLabel(LabelText="Rotating Basics", LabelSize=12, Justification=0)
width_63 = Slider(566, range=0..1000)
width_64 = Slider(110, range=0..1000)
height_58 = Slider(35, range=0..1000)
radiobtn_14 = CreateRadioButton(RadioButtonName="Instant", RadioButtonGroup="rotating output type", InitiallySelected=False)
values_11 = ValueListener(Elements=radiobtn_14, SomeProperty=True)  # -> Values, Indices
radiobtn_15 = CreateRadioButton(RadioButtonName="Twist", RadioButtonGroup="rotating input action", InitiallySelected=False)
values_12 = ValueListener(Elements=radiobtn_15, SomeProperty=True)  # -> Values, Indices
adjustpos_57 = AdjustElementPositioning(
    ElementsToAdjust=radiobtn_14,
    Margin="110,-55,0,10",
    AbsolutePositioning=False,
    Width=width_62,
    Height=height_56,
    HorizontalAlignment=Slider(0, range=0..100))
adjustpos_58 = AdjustElementPositioning(
    ElementsToAdjust=label_15,
    Margin="10,5,0,10",
    AbsolutePositioning=False,
    Width=width_63,
    Height=height_57,
    HorizontalAlignment=Slider(0, range=0..100))
adjustpos_59 = AdjustElementPositioning(
    ElementsToAdjust=radiobtn_15,
    Margin="95,-55,0,10",
    AbsolutePositioning=False,
    Width=width_64,
    Height=height_58,
    HorizontalAlignment=Slider(0, range=0..100))
width_65 = Slider(115, range=0..1000)
height_59 = Slider(35, range=0..1000)
titlesize_7 = Slider(20, range=0..30)
colour_18 = ColourPicker(PickedColour=RGB(51, 121, 200))
radiobtn_16 = CreateRadioButton(RadioButtonName="Last for a while", RadioButtonGroup="rotating output type", InitiallySelected=False)
adjustpos_60 = AdjustElementPositioning(
    ElementsToAdjust=radiobtn_16,
    Margin="185,-55,0,10",
    AbsolutePositioning=False,
    Width=width_65,
    Height=height_59,
    HorizontalAlignment=Slider(0, range=0..100))
values_13 = ValueListener(Elements=radiobtn_16, SomeProperty=True)  # -> Values, Indices
adjustelem_8 = AdjustElementAppearance(ElementsToAdjust=label_15, Foreground=colour_18, FontSize=titlesize_7)
radiobtn_17 = CreateRadioButton(RadioButtonName="Press", RadioButtonGroup="rotating input action", InitiallySelected=False)
values_14 = ValueListener(Elements=radiobtn_17, SomeProperty=True)  # -> Values, Indices
height_60 = Slider(35, range=0..1000)
width_66 = Slider(115, range=0..1000)
python_3 = GhPythonScript(x=values_12.Values, y=values_14.Values, z=values_10.Values)  # -> a, b, c, d, e
# ---------- python_3: Python ----------
"""Provides a scripting component.
    Inputs:
        x: twist
        y: press
        z: hinge folding
    Output:
        a: instant
        b: last for a while
        c: button 1 label
        d: button 2 label
        e: visibility of the last two buttons"""

__author__ = "ediga"
__version__ = "2020.07.29"

import rhinoscriptsyntax as rs

if x and not y and not z:
    a = False
    b = False
    c = "Select region of interest"
    d = "Set rotatory axis position"
    e = False
elif not x and y and not z:
    a = True
    b = False
    c = "Select region of interest"
    d = "Set rotatory axis position"
    e = False
elif not x and not y and z:
    a = False
    b = True
    c = "Select two parts of interest"
    d = "Set the hinge position"
    e = True
else:
    a = True
    b = True
    c = "Select region of interest"
    d = "Set rotatory axis position"
    e = False
# ---------- end python_3 ----------
hideshow_16 = HideShowElement(ElementToHideShow=radiobtn_14, Show=Toggle(True), Collapse=Toggle(False), Disable=python_3.a)
hideshow_17 = HideShowElement(ElementToHideShow=radiobtn_16, Show=Toggle(True), Collapse=Toggle(False), Disable=python_3.b)
adjustpos_61 = AdjustElementPositioning(
    ElementsToAdjust=radiobtn_17,
    Margin="160,-55,0,10",
    AbsolutePositioning=False,
    Width=width_66,
    Height=height_60,
    HorizontalAlignment=Slider(0, range=0..100))

# ---- group: Rotating
colour_19 = ColourPicker(PickedColour=RGB(101, 168, 99))
width_67 = Slider(566, range=0..1000)
height_61 = Slider(38, range=0..1000)
titlesize_8 = Slider(20, range=0..30)
label_16 = CreateLabel(LabelText="Kinetic Unit for Rotating", LabelSize=12, Justification=0)
strength_4 = Slider(0.5, range=0..1)
circle_rounds = Slider(10, range=0..20)
separatorheight_11 = Slider(10, range=0..10)
colour_20 = ColourPicker(PickedColour=RGB(230, 230, 230))
width_68 = Slider(400, range=0..1000)
adjustpos_62 = AdjustElementPositioning(
    ElementsToAdjust=label_16,
    Margin="10,5,0,20",
    AbsolutePositioning=False,
    Width=width_67,
    Height=height_61,
    HorizontalAlignment=Slider(0, range=0..100))
adjustelem_9 = AdjustElementAppearance(ElementsToAdjust=label_16, Foreground=colour_19, FontSize=titlesize_8)
panel_14 = Panel(python_3.c)
width_69 = Slider(150, range=0..1000)
height_62 = Slider(30, range=0..1000)
width_70 = Slider(310, range=0..400)
height_63 = Slider(30, range=0..30)
width_71 = Slider(310, range=0..400)
height_64 = Slider(30, range=0..30)
slider_8 = CreateSlider(Slider=strength_4, ShowBounds=False, ShowTicks=False, ShowTooltip=False, ShowValLabel=True, showLabel=True)
slider_9 = CreateSlider(Slider=circle_rounds, ShowBounds=False, ShowTicks=False, ShowTooltip=False, ShowValLabel=True, showLabel=True)
separator_11 = CreateSeparator(Thickness=0.5, Horizontal=True, Color=colour_20, Width=width_68, Height=separatorheight_11)
separatorheight_12 = Slider(4, range=0..10)
colour_21 = ColourPicker(PickedColour=RGB(230, 230, 230))
width_72 = Slider(400, range=0..1000)
true_button_13 = CreateTrueOnlyButton(ButtonName=panel_14, ButtonStyle=0)
adjustpos_63 = AdjustElementPositioning(
    ElementsToAdjust=true_button_13,
    Margin="10,0,0,10",
    AbsolutePositioning=False,
    Width=width_69,
    Height=height_62,
    HorizontalAlignment=Slider(0, range=0..100))
adjustpos_64 = AdjustElementPositioning(
    ElementsToAdjust=slider_8,
    Margin="10,20,0,10",
    AbsolutePositioning=False,
    Width=width_70,
    Height=height_63,
    HorizontalAlignment=Slider(0, range=0..100))
adjustpos_65 = AdjustElementPositioning(
    ElementsToAdjust=slider_9,
    Margin="10,0,0,10",
    AbsolutePositioning=False,
    Width=width_71,
    Height=height_64,
    HorizontalAlignment=Slider(0, range=0..100))
checkbox_4 = CreateCheckbox(Label="Add a lock", StartingValue=False)
panel_15 = Panel(python_3.d)
width_73 = Slider(140, range=0..1000)
height_65 = Slider(30, range=0..1000)
width_74 = Slider(140, range=0..1000)
button_5 = CreateButton(ButtonName="Preview", ButtonStyle=0)
height_66 = Slider(30, range=0..1000)
width_75 = Slider(150, range=0..1000)
height_67 = Slider(30, range=0..1000)
width_76 = Slider(150, range=0..1000)
separator_12 = CreateSeparator(Thickness=0.5, Horizontal=True, Color=colour_21, Width=width_72, Height=separatorheight_12)
height_68 = Slider(30, range=0..1000)
width_77 = Slider(450, range=0..1000)
height_69 = Slider(35, range=0..1000)
true_button_14 = CreateTrueOnlyButton(ButtonName="Select the input handler", ButtonStyle=0)
true_button_15 = CreateTrueOnlyButton(ButtonName="Select the end effector", ButtonStyle=0)
true_button_16 = CreateTrueOnlyButton(ButtonName=panel_15, ButtonStyle=0)
adjustpos_66 = AdjustElementPositioning(
    ElementsToAdjust=true_button_16,
    Margin="175,-40,0,10",
    AbsolutePositioning=False,
    Width=width_73,
    Height=height_65,
    HorizontalAlignment=Slider(0, range=0..100))
adjustpos_67 = AdjustElementPositioning(
    ElementsToAdjust=true_button_15,
    Margin="175,-40,0,15",
    AbsolutePositioning=False,
    Width=width_74,
    Height=height_66,
    HorizontalAlignment=Slider(0, range=0..100))
adjustpos_68 = AdjustElementPositioning(
    ElementsToAdjust=true_button_14,
    Margin="10,5,0,10",
    AbsolutePositioning=False,
    Width=width_75,
    Height=height_67,
    HorizontalAlignment=Slider(0, range=0..100))
adjustpos_69 = AdjustElementPositioning(
    ElementsToAdjust=button_5,
    Margin="165,-45,0,10",
    AbsolutePositioning=False,
    Width=width_76,
    Height=height_68,
    HorizontalAlignment=Slider(0, range=0..100))
adjustpos_70 = AdjustElementPositioning(ElementsToAdjust=checkbox_4, Margin="15,5,0,10", AbsolutePositioning=False, Width=width_77, Height=height_69)
hideshow_18 = HideShowElement(ElementToHideShow=true_button_15, Show=Toggle(True), Collapse=Toggle(False), Disable=values_11.Values)
merge_4 = Merge(
    Data1=separator_10,
    Data2=label_15,
    Data3=label_13,
    Data4=radiobtn_15,
    Data5=radiobtn_17,
    Data6=radiobtn_13,
    Data7=label_14,
    Data8=radiobtn_14,
    Data9=radiobtn_16,
    Data10=separator_12,
    Data11=label_16,
    Data12=true_button_13,
    Data13=true_button_16,
    Data14=true_button_14,
    Data15=true_button_15,
    Data16=slider_8,
    Data17=slider_9,
    Data19=separator_11,
    Data20=checkbox_4,
    Data21=button_5)
hideshow_19 = HideShowElement(ElementToHideShow=true_button_14, Show=Toggle(True), Collapse=Toggle(False), Disable=values_11.Values)
stack_5 = CreateStack(UIElements=merge_4, Horizontal=Toggle(False))
hideshow_20 = HideShowElement(ElementToHideShow=stack_5, Show=python_2.b, Collapse=Toggle(True), Disable=Toggle(False))

# ---- group: MAIN WINDOW
merge_5 = Merge(
    Data1=label_3,
    Data2=radiobtn_5,
    Data3=radiobtn_6,
    Data4=radiobtn_4,
    Data5=radiobtn_3,
    Data6=button,
    Data7=stack_3,
    Data8=stack_2,
    Data9=stack_5,
    Data10=stack_4,
    Data11=stack)
launchwin = LaunchWindow(
    Show=Toggle(True),
    Name="Kinergy Design Tool",
    Width=Slider(345, range=0..1000),
    Height=Slider(650, range=0..1000),
    ChildStatus=0,
    EnableHorizScroll=False)
addelems = AddElements(Window=launchwin, Elements=flatten(merge_5), DoVLChecking=True)  # -> AddedElements, ElementNames

# ----
height_70 = Slider(35, range=0..1000)
width_78 = Slider(115, range=0..1000)
adjustpos_71 = AdjustElementPositioning(
    ElementsToAdjust=radiobtn_13,
    Margin="225,-55,0,10",
    AbsolutePositioning=False,
    Width=width_78,
    Height=height_70,
    HorizontalAlignment=Slider(0, range=0..100))
selectchildwindow = GhPythonScript()  # -> c0_2, c1_2, c2_2, c3_2, c4_2, c5_2, c6_2; inputs c0: Boolean, c1: Boolean, c2: Boolean, c3: Boolean, c4: Boolean, c5: Boolean, c6: Boolean
# ---------- selectchildwindow: Python ----------
__author__ = "liang he"
__version__ = "2020.04.20"

import rhinoscriptsyntax as rs
def compareValue(a,b):
    if(a==b):
        return False;
    return True;

#Make persistent value to keep track of last value
if "lastValue" not in globals():
    lastValue=[c0,c1,c2,c3,c4,c5,c6];

#Check that current value is different from last value
newValue=[c0,c1,c2,c3,c4,c5,c6];
for i,val in enumerate(newValue):
    if val==True:
        lastValue=[False,False,False,False,False,False,False];
        lastValue[i]=True;
        break;
        
c0_2=lastValue[0];
c1_2=lastValue[1];
c2_2=lastValue[2];
c3_2=lastValue[3];
c4_2=lastValue[4];
c5_2=lastValue[5];
c6_2=lastValue[6];
# ---------- end selectchildwindow ----------

# ---- group: TOADD: CHILDWINDOW
it_height = Slider(390, range=0..1000)
cs_height = Slider(390, range=0..1000)
ie_height = Slider(370, range=0..1000)
rm_height = Slider(370, range=0..1000)
is_height = Slider(370, range=0..1000)
ih_height = Slider(380, range=0..1000)
cm_height = Slider(400, range=0..1000)
it_width = Slider(310, range=0..1000)
cs_width = Slider(310, range=0..1000)
rm_width = Slider(310, range=0..1000)
ie_width = Slider(310, range=0..1000)
ih_width = Slider(310, range=0..1000)
is_width = Slider(310, range=0..1000)
cm_width = Slider(310, range=0..1000)
launchwin_2 = LaunchWindow(
    Show=selectchildwindow.c6_2,
    Name="Reciprocal Moving",
    Width=rm_width,
    Height=rm_height,
    ChildStatus=0,
    EnableHorizScroll=False)
launchwin_3 = LaunchWindow(
    Show=selectchildwindow.c0_2,
    Name="Instant Extension Motion",
    Width=ie_width,
    Height=ie_height,
    ChildStatus=0,
    EnableHorizScroll=False)
launchwin_4 = LaunchWindow(
    Show=selectchildwindow.c1_2,
    Name="Instant Spinning Motion",
    Width=is_width,
    Height=is_height,
    ChildStatus=0,
    EnableHorizScroll=False)
launchwin_5 = LaunchWindow(
    Show=selectchildwindow.c5_2,
    Name="Continuous Spinning Motion",
    Width=cs_width,
    Height=cs_height,
    ChildStatus=0,
    EnableHorizScroll=False)
launchwin_6 = LaunchWindow(
    Show=selectchildwindow.c2_2,
    Name="Instant Throwing",
    Width=it_width,
    Height=it_height,
    ChildStatus=0,
    EnableHorizScroll=False)
launchwin_7 = LaunchWindow(
    Show=selectchildwindow.c4_2,
    Name="Continuous Linear Moving Motion",
    Width=cm_width,
    Height=cm_height,
    ChildStatus=0,
    EnableHorizScroll=False)
launchwin_8 = LaunchWindow(
    Show=selectchildwindow.c3_2,
    Name="Intermittent Hopping Motion",
    Width=ih_width,
    Height=ih_height,
    ChildStatus=0,
    EnableHorizScroll=False)
childwin = MakeChildWindow(ChildWindow=launchwin_3)
childwin_2 = MakeChildWindow(ChildWindow=launchwin_4)
childwin_3 = MakeChildWindow(ChildWindow=launchwin_6)
childwin_4 = MakeChildWindow(ChildWindow=launchwin_8)
childwin_5 = MakeChildWindow(ChildWindow=launchwin_7)
childwin_6 = MakeChildWindow(ChildWindow=launchwin_5)
childwin_7 = MakeChildWindow(ChildWindow=launchwin_2)

# ---- group: Playground for testing
c_script = CSharpScript()  # -> out, A
# ---------- c_script: C# ----------
    string str1 = System.AppDomain.CurrentDomain.BaseDirectory;
    A = str1;
# ---------- end c_script ----------
panel_16 = Panel(c_script.A)

# ---- group: Instant Extension Window Style
compression = Slider(0.5, range=0..1)
strength_5 = Slider(0.5, range=0..1)
height_71 = Slider(30, range=0..500)
slider_10 = CreateSlider(Slider=compression, ShowBounds=False, ShowTicks=False, ShowTooltip=False, ShowValLabel=True, showLabel=True)
border_corner_radius = Slider(0, range=0..10)
adjustpos_72 = AdjustElementPositioning(ElementsToAdjust=slider_10, Margin="0,-10,0,0", AbsolutePositioning=False, Height=height_71)
thumbnail_width = Slider(100, range=0..1000)
title_size = Slider(11, range=0..20)
title_size_2 = Slider(16, range=0..20)
border_thickness = Slider(1, range=0..10)
panel_17 = Panel("This unit has three parts: a helical spring, a rod, and a locking mechanism. The spring can be compressed and locked and extends immediately once the lock is released.")
height_72 = Slider(30, range=0..500)
true_button_17 = CreateTrueOnlyButton(ButtonName="Set Motion Direction", ButtonStyle=0)
python_4 = GhPythonScript()  # -> out, a
# ---------- python_4: Python ----------
__author__ = "lianghe"
__version__ = "2020.04.19"

import rhinoscriptsyntax as rs

import os

pre_path = os.path.abspath('.')[:os.path.abspath('.').rfind('\\')]
a=pre_path+"\Plug-ins\Grasshopper\Components\Resources\images\IE.png"
# ---------- end python_4 ----------
slider_11 = CreateSlider(Slider=strength_5, ShowBounds=False, ShowTicks=False, ShowTooltip=False, ShowValLabel=True, showLabel=True)
adjustpos_73 = AdjustElementPositioning(ElementsToAdjust=slider_11, Margin="25,0,0,0", AbsolutePositioning=False, Height=height_72)
height_73 = Slider(30, range=0..500)
width_79 = Slider(123, range=0..500)
height_74 = Slider(30, range=0..500)
width_80 = Slider(150, range=0..500)
image = CreateImage(ImageSource=python_4.a, ImageWidth=thumbnail_width, ImageHeight=thumbnail_width)
checkbox_5 = CreateCheckbox(Label="Energy Control Lock", StartingValue=Toggle(False))
label_17 = CreateLabel(LabelText="Instant Extension", LabelSize=title_size_2, Justification=0)
tb = CreateTextBlock(Text=panel_17, TextSize=title_size, Justification=0)
merge_6 = Merge(Data1=true_button_17, Data2=checkbox_5, Data3=slider_10, Data4=slider_11)
button_6 = CreateButton(ButtonName="Preview Motion", ButtonStyle=0)
expander = CreateExpander(UIElements=merge_6, Header="Motion Control & Design", Open=True)
height_75 = Slider(30, range=0..500)
adjustpos_74 = AdjustElementPositioning(ElementsToAdjust=label_17, Margin="110,-120,0,10", AbsolutePositioning=False)
adjustpos_75 = AdjustElementPositioning(ElementsToAdjust=tb, Margin="110,-90,10,10", AbsolutePositioning=False, Width=width_80)
adjustpos_76 = AdjustElementPositioning(ElementsToAdjust=checkbox_5, Margin="140,-50,0,10", AbsolutePositioning=False)
adjustpos_77 = AdjustElementPositioning(ElementsToAdjust=image, Margin="10,10,10,10", AbsolutePositioning=False)
adjustpos_78 = AdjustElementPositioning(ElementsToAdjust=true_button_17, Margin="-150,0,0,10", AbsolutePositioning=False, Width=width_79, Height=height_73)
true_button_18 = CreateTrueOnlyButton(ButtonName="Add Kinetic Unit", ButtonStyle=0)
adjustpos_79 = AdjustElementPositioning(ElementsToAdjust=button_6, Margin="180,-40,0,10", AbsolutePositioning=False, Height=height_74)
merge_7 = Merge(Data1=image, Data2=label_17, Data3=tb, Data4=expander, Data6=true_button_18, Data7=button_6)
adjustpos_80 = AdjustElementPositioning(ElementsToAdjust=true_button_18, Margin="-180,10,0,10", AbsolutePositioning=False, Height=height_75)
addelems_2 = AddElements(Window=launchwin_3, Elements=flatten(merge_7), DoVLChecking=True)  # -> AddedElements, ElementNames

# ---- group: Instant Spinning Window Style
height_76 = Slider(30, range=0..30)
checkbox_6 = CreateCheckbox(Label="Energy Control Lock", StartingValue=False)
button_7 = CreateButton(ButtonName="Preview Motion", ButtonStyle=0)
adjustpos_81 = AdjustElementPositioning(ElementsToAdjust=button_7, Margin="180,-22,0,10", AbsolutePositioning=False, Height=height_76)
thumbnail_width_2 = Slider(100, range=0..1000)
adjustpos_82 = AdjustElementPositioning(ElementsToAdjust=checkbox_6, Margin="0,15,0,0", AbsolutePositioning=False)
title_size_3 = Slider(16, range=0..20)
title_size_4 = Slider(11, range=0..20)
panel_18 = Panel("This unit has a spiral spring and a locking mechanism. The energy can be stored by twising this unit. Once the twisted spring is released, the body will spin immediately.")
width_81 = Slider(162, range=0..200)
python_5 = GhPythonScript()  # -> out, a
# ---------- python_5: Python ----------
__author__ = "lianghe"
__version__ = "2020.04.19"

import rhinoscriptsyntax as rs

import os

pre_path = os.path.abspath('.')[:os.path.abspath('.').rfind('\\')]
a=pre_path+"\Plug-ins\Grasshopper\Components\Resources\images\IS.png"
# ---------- end python_5 ----------
height_77 = Slider(30, range=0..30)
width_82 = Slider(175, range=0..300)
button_8 = CreateButton(ButtonName="Select & Set Motion Direction", ButtonStyle=0)
image_2 = CreateImage(ImageSource=python_5.a, ImageWidth=thumbnail_width_2, ImageHeight=thumbnail_width_2)
tb_2 = CreateTextBlock(Text=panel_18, TextSize=title_size_4, Justification=0)
label_18 = CreateLabel(LabelText="Instant Spinning", LabelSize=title_size_3, Justification=0)
adjustpos_83 = AdjustElementPositioning(ElementsToAdjust=button_8, Margin="100,0,0,10", AbsolutePositioning=False, Width=width_81, Height=height_77)
adjustpos_84 = AdjustElementPositioning(ElementsToAdjust=tb_2, Margin="115,-90,0,10", AbsolutePositioning=False, Width=width_82)
adjustpos_85 = AdjustElementPositioning(ElementsToAdjust=label_18, Margin="110,-120,0,10", AbsolutePositioning=False)
adjustpos_86 = AdjustElementPositioning(ElementsToAdjust=image_2, Margin="0,0,10,10", AbsolutePositioning=False)
max_angle = Slider(60, range=60..180)
height_78 = Slider(30, range=0..30)
strength_6 = Slider(0.5, range=0..1)
height_79 = Slider(30, range=0..30)
slider_12 = CreateSlider(Slider=max_angle, ShowBounds=False, ShowTicks=False, ShowTooltip=False, ShowValLabel=True, showLabel=True)
slider_13 = CreateSlider(Slider=strength_6, ShowBounds=False, ShowTicks=False, ShowTooltip=False, ShowValLabel=True, showLabel=True)
adjustpos_87 = AdjustElementPositioning(ElementsToAdjust=slider_12, AbsolutePositioning=False, Height=height_78)
adjustpos_88 = AdjustElementPositioning(ElementsToAdjust=slider_13, AbsolutePositioning=False, Height=height_79)
merge_8 = Merge(Data1=slider_12, Data2=slider_13)
expander_2 = CreateExpander(UIElements=merge_8, Header="Motion Control & Design", Open=True)
merge_9 = Merge(Data1=image_2, Data2=label_18, Data3=tb_2, Data4=button_8, Data5=expander_2, Data6=checkbox_6, Data7=button_7)
addelems_3 = AddElements(Window=launchwin_4, Elements=flatten(merge_9), DoVLChecking=True)  # -> AddedElements, ElementNames

# ---- group: Intermittent Hopping Window Style
height_80 = Slider(30, range=0..30)
checkbox_7 = CreateCheckbox(Label="Energy Control Lock", StartingValue=False)
button_9 = CreateButton(ButtonName="Preview Motion", ButtonStyle=0)
adjustpos_89 = AdjustElementPositioning(ElementsToAdjust=button_9, Margin="180,-22,0,10", AbsolutePositioning=False, Height=height_80)
adjustpos_90 = AdjustElementPositioning(ElementsToAdjust=checkbox_7, Margin="0,15,0,0", AbsolutePositioning=False)
thumbnail_width_3 = Slider(100, range=0..1000)
title_size_5 = Slider(16, range=0..20)
title_size_6 = Slider(11, range=0..20)
panel_19 = Panel("This unit is composed of a helical spring, a gearbox, a geneva drive, and a spiral spring. Once the spiral spring is unlocked, the body will perform an intermittent hopping motion.")
python_6 = GhPythonScript()  # -> out, a
# ---------- python_6: Python ----------
__author__ = "lianghe"
__version__ = "2020.04.19"

import rhinoscriptsyntax as rs

import os

pre_path = os.path.abspath('.')[:os.path.abspath('.').rfind('\\')]
a=pre_path+"\Plug-ins\Grasshopper\Components\Resources\images\IH.png"
# ---------- end python_6 ----------
width_83 = Slider(162, range=0..200)
height_81 = Slider(30, range=0..30)
width_84 = Slider(175, range=0..300)
button_10 = CreateButton(ButtonName="Select & Set Motion Direction", ButtonStyle=0)
image_3 = CreateImage(ImageSource=python_6.a, ImageWidth=thumbnail_width_3, ImageHeight=thumbnail_width_3)
tb_3 = CreateTextBlock(Text=panel_19, TextSize=title_size_6, Justification=0)
label_19 = CreateLabel(LabelText="Intermittent Hopping", LabelSize=title_size_5, Justification=0)
adjustpos_91 = AdjustElementPositioning(ElementsToAdjust=tb_3, Margin="115,-100,0,10", AbsolutePositioning=False, Width=width_84)
adjustpos_92 = AdjustElementPositioning(ElementsToAdjust=button_10, Margin="100,0,0,10", AbsolutePositioning=False, Width=width_83, Height=height_81)
adjustpos_93 = AdjustElementPositioning(ElementsToAdjust=label_19, Margin="110,-130,0,10", AbsolutePositioning=False)
adjustpos_94 = AdjustElementPositioning(ElementsToAdjust=image_3, Margin="0,10,10,10", AbsolutePositioning=False)
frequency = Slider(60, range=10..90)
height_82 = Slider(30, range=0..30)
amplitude_2 = Slider(0.5, range=0..1)
height_83 = Slider(30, range=0..30)
slider_14 = CreateSlider(Slider=amplitude_2, ShowBounds=False, ShowTicks=False, ShowTooltip=False, ShowValLabel=True, showLabel=True)
slider_15 = CreateSlider(Slider=frequency, ShowBounds=False, ShowTicks=False, ShowTooltip=False, ShowValLabel=True, showLabel=True)
adjustpos_95 = AdjustElementPositioning(ElementsToAdjust=slider_15, AbsolutePositioning=False, Height=height_82)
merge_10 = Merge(Data1=slider_15, Data2=slider_14)
adjustpos_96 = AdjustElementPositioning(ElementsToAdjust=slider_14, AbsolutePositioning=False, Height=height_83)
expander_3 = CreateExpander(UIElements=merge_10, Header="Motion Control & Design", Open=True)
merge_11 = Merge(Data1=image_3, Data2=label_19, Data3=tb_3, Data4=button_10, Data5=expander_3, Data6=checkbox_7, Data7=button_9)
addelems_4 = AddElements(Window=launchwin_8, Elements=flatten(merge_11), DoVLChecking=True)  # -> AddedElements, ElementNames

# ---- group: Continuous Moving Window Style
title_size_7 = Slider(13, range=0..20)
thumbnail_width_4 = Slider(100, range=0..1000)
title_size_8 = Slider(11, range=0..20)
title_size_9 = Slider(16, range=0..20)
panel_20 = Panel("This unit has a helical spring, a rack and pinion, and a gearbox. When the helial spring is pressed, the object attached to the rear axis in the gearbox will rotate, activating the whole body to move forward.")
python_7 = GhPythonScript()  # -> out, a
# ---------- python_7: Python ----------
__author__ = "lianghe"
__version__ = "2020.04.19"

import rhinoscriptsyntax as rs

import os

pre_path = os.path.abspath('.')[:os.path.abspath('.').rfind('\\')]
a=pre_path+"\Plug-ins\Grasshopper\Components\Resources\images\CLMP.png"
# ---------- end python_7 ----------
label_20 = CreateLabel(LabelText="(by pressing)", LabelSize=title_size_7, Justification=0)
width_85 = Slider(175, range=0..300)
width_86 = Slider(165, range=0..200)
image_4 = CreateImage(ImageSource=python_7.a, ImageWidth=thumbnail_width_4, ImageHeight=thumbnail_width_4)
height_84 = Slider(30, range=0..30)
label_21 = CreateLabel(LabelText="Continues Moving", LabelSize=title_size_9, Justification=0)
tb_4 = CreateTextBlock(Text=panel_20, TextSize=title_size_8, Justification=0)
adjustpos_97 = AdjustElementPositioning(ElementsToAdjust=label_20, Margin="110,-110,0,10", AbsolutePositioning=False)
button_11 = CreateButton(ButtonName="Set Motion Direction", ButtonStyle=0)
radiobtn_18 = CreateRadioButton(RadioButtonName="By Pressing", RadioButtonGroup="Ratio Group 1", InitiallySelected=Toggle(True))
adjustpos_98 = AdjustElementPositioning(ElementsToAdjust=label_21, Margin="110,-130,0,10", AbsolutePositioning=False)
adjustpos_99 = AdjustElementPositioning(ElementsToAdjust=image_4, Margin="0,10,10,10", AbsolutePositioning=False)
adjustpos_100 = AdjustElementPositioning(ElementsToAdjust=tb_4, Margin="115,-85,0,10", AbsolutePositioning=False, Width=width_85)
adjustpos_101 = AdjustElementPositioning(ElementsToAdjust=button_11, Margin="100,-50,0,10", AbsolutePositioning=False, Width=width_86, Height=height_84)
adjustpos_102 = AdjustElementPositioning(ElementsToAdjust=radiobtn_18, Margin="0,-25,0,0", AbsolutePositioning=False)
radiobtn_19 = CreateRadioButton(RadioButtonName="By Rotating", RadioButtonGroup="Ratio Group 1", InitiallySelected=Toggle(False))
adjustpos_103 = AdjustElementPositioning(ElementsToAdjust=radiobtn_19, Margin="0,-25,0,0", AbsolutePositioning=False)
height_85 = Slider(30, range=0..30)
distance = Slider(60, range=10..90)
height_86 = Slider(30, range=0..30)
speed = Slider(0.5, range=0..1)
height_87 = Slider(30, range=0..30)
checkbox_8 = CreateCheckbox(Label="Energy Control Lock", StartingValue=False)
button_12 = CreateButton(ButtonName="Preview Motion", ButtonStyle=0)
slider_16 = CreateSlider(Slider=distance, ShowBounds=False, ShowTicks=False, ShowTooltip=False, ShowValLabel=True, showLabel=True)
slider_17 = CreateSlider(Slider=speed, ShowBounds=False, ShowTicks=False, ShowTooltip=False, ShowValLabel=True, showLabel=True)
adjustpos_104 = AdjustElementPositioning(ElementsToAdjust=button_12, Margin="180,-22,0,10", AbsolutePositioning=False, Height=height_85)
adjustpos_105 = AdjustElementPositioning(ElementsToAdjust=checkbox_8, Margin="0,15,0,0", AbsolutePositioning=False)
adjustpos_106 = AdjustElementPositioning(ElementsToAdjust=slider_16, AbsolutePositioning=False, Height=height_86)
adjustpos_107 = AdjustElementPositioning(ElementsToAdjust=slider_17, AbsolutePositioning=False, Height=height_87)
merge_12 = Merge(Data1=slider_16, Data2=slider_17)
expander_4 = CreateExpander(UIElements=merge_12, Header="Motion Control & Design", Open=True)
merge_13 = Merge(
    Data1=image_4,
    Data2=label_21,
    Data3=label_20,
    Data4=tb_4,
    Data5=radiobtn_18,
    Data6=radiobtn_19,
    Data7=button_11,
    Data8=expander_4,
    Data9=checkbox_8,
    Data10=button_12)
addelems_5 = AddElements(Window=launchwin_7, Elements=flatten(merge_13), DoVLChecking=True)  # -> AddedElements, ElementNames

# ---- group: Instant Throwing Window Style
thumbnail_width_5 = Slider(100, range=0..1000)
title_size_10 = Slider(16, range=0..20)
title_size_11 = Slider(11, range=0..20)
panel_21 = Panel("With this unit, the body can be bended and locked at different angles. Once the lock is released, the bended body will immediately recover its initial position, resulting in a throwing motion.")
python_8 = GhPythonScript()  # -> out, a
# ---------- python_8: Python ----------
__author__ = "lianghe"
__version__ = "2020.04.19"

import rhinoscriptsyntax as rs

import os

pre_path = os.path.abspath('.')[:os.path.abspath('.').rfind('\\')]
a=pre_path+"\Plug-ins\Grasshopper\Components\Resources\images\IT.png"
# ---------- end python_8 ----------
height_88 = Slider(30, range=0..30)
width_87 = Slider(80, range=0..200)
height_89 = Slider(30, range=0..30)
width_88 = Slider(175, range=0..300)
width_89 = Slider(80, range=0..200)
height_90 = Slider(30, range=0..30)
width_90 = Slider(115, range=0..200)
button_13 = CreateButton(ButtonName="Select an arm", ButtonStyle=0)
button_14 = CreateButton(ButtonName="Select a base", ButtonStyle=0)
image_5 = CreateImage(ImageSource=python_8.a, ImageWidth=thumbnail_width_5, ImageHeight=thumbnail_width_5)
tb_5 = CreateTextBlock(Text=panel_21, TextSize=title_size_11, Justification=0)
label_22 = CreateLabel(LabelText="Instant Throwing", LabelSize=title_size_10, Justification=0)
button_15 = CreateButton(ButtonName="Set motion direction", ButtonStyle=0)
adjustpos_108 = AdjustElementPositioning(ElementsToAdjust=tb_5, Margin="115,-100,0,10", AbsolutePositioning=False, Width=width_88)
adjustpos_109 = AdjustElementPositioning(ElementsToAdjust=button_13, Margin="-210,0,0,10", AbsolutePositioning=False, Width=width_87, Height=height_88)
adjustpos_110 = AdjustElementPositioning(ElementsToAdjust=label_22, Margin="110,-130,0,10", AbsolutePositioning=False)
adjustpos_111 = AdjustElementPositioning(ElementsToAdjust=button_14, Margin="-38,-40,0,10", AbsolutePositioning=False, Width=width_89, Height=height_89)
adjustpos_112 = AdjustElementPositioning(ElementsToAdjust=button_15, Margin="170,-40,0,10", AbsolutePositioning=False, Width=width_90, Height=height_90)
adjustpos_113 = AdjustElementPositioning(ElementsToAdjust=image_5, Margin="0,20,10,10", AbsolutePositioning=False)
height_91 = Slider(30, range=0..30)
max_angle_2 = Slider(60, range=60..180)
height_92 = Slider(30, range=0..30)
strength_7 = Slider(0.5, range=0..1)
height_93 = Slider(30, range=0..30)
slider_18 = CreateSlider(Slider=max_angle_2, ShowBounds=False, ShowTicks=False, ShowTooltip=False, ShowValLabel=True, showLabel=True)
slider_19 = CreateSlider(Slider=strength_7, ShowBounds=False, ShowTicks=False, ShowTooltip=False, ShowValLabel=True, showLabel=True)
checkbox_9 = CreateCheckbox(Label="Energy Control Lock", StartingValue=False)
button_16 = CreateButton(ButtonName="Preview Motion", ButtonStyle=0)
adjustpos_114 = AdjustElementPositioning(ElementsToAdjust=slider_18, AbsolutePositioning=False, Height=height_92)
adjustpos_115 = AdjustElementPositioning(ElementsToAdjust=slider_19, AbsolutePositioning=False, Height=height_93)
adjustpos_116 = AdjustElementPositioning(ElementsToAdjust=button_16, Margin="180,-22,0,10", AbsolutePositioning=False, Height=height_91)
adjustpos_117 = AdjustElementPositioning(ElementsToAdjust=checkbox_9, Margin="0,15,0,0", AbsolutePositioning=False)
merge_14 = Merge(Data1=slider_18, Data2=slider_19)
expander_5 = CreateExpander(UIElements=merge_14, Header="Motion Control & Design", Open=True)
merge_15 = Merge(
    Data1=image_5,
    Data2=label_22,
    Data3=tb_5,
    Data4=button_13,
    Data5=button_14,
    Data6=button_15,
    Data7=expander_5,
    Data8=checkbox_9,
    Data9=button_16)
addelems_6 = AddElements(Window=launchwin_6, Elements=flatten(merge_15), DoVLChecking=True)  # -> AddedElements, ElementNames

# ---- group: Reciprocal Moving Window Style
thumbnail_width_6 = Slider(100, range=0..1000)
title_size_12 = Slider(16, range=0..20)
title_size_13 = Slider(11, range=0..20)
panel_22 = Panel("This unit is composed of a spiral spring, a cam, and a movable piston. Once the spiral spring is unlocked, the piston part will perform a reciprocal movement.")
python_9 = GhPythonScript()  # -> out, a
# ---------- python_9: Python ----------
__author__ = "lianghe"
__version__ = "2020.04.19"

import rhinoscriptsyntax as rs

import os

pre_path = os.path.abspath('.')[:os.path.abspath('.').rfind('\\')]
a=pre_path+"\Plug-ins\Grasshopper\Components\Resources\images\RLM.png"
# ---------- end python_9 ----------
height_94 = Slider(30, range=0..30)
width_91 = Slider(80, range=0..200)
height_95 = Slider(30, range=0..30)
width_92 = Slider(80, range=0..200)
height_96 = Slider(30, range=0..30)
width_93 = Slider(115, range=0..200)
width_94 = Slider(175, range=0..300)
button_17 = CreateButton(ButtonName="Select a body", ButtonStyle=0)
button_18 = CreateButton(ButtonName="Select a piston", ButtonStyle=0)
image_6 = CreateImage(ImageSource=python_9.a, ImageWidth=thumbnail_width_6, ImageHeight=thumbnail_width_6)
tb_6 = CreateTextBlock(Text=panel_22, TextSize=title_size_13, Justification=0)
button_19 = CreateButton(ButtonName="Set motion direction", ButtonStyle=0)
label_23 = CreateLabel(LabelText="Reciprocal Moving", LabelSize=title_size_12, Justification=0)
adjustpos_118 = AdjustElementPositioning(ElementsToAdjust=button_17, Margin="-210,0,0,10", AbsolutePositioning=False, Width=width_91, Height=height_94)
adjustpos_119 = AdjustElementPositioning(ElementsToAdjust=tb_6, Margin="115,-90,0,10", AbsolutePositioning=False, Width=width_94)
adjustpos_120 = AdjustElementPositioning(ElementsToAdjust=button_18, Margin="-38,-40,0,10", AbsolutePositioning=False, Width=width_92, Height=height_95)
adjustpos_121 = AdjustElementPositioning(ElementsToAdjust=button_19, Margin="170,-40,0,10", AbsolutePositioning=False, Width=width_93, Height=height_96)
adjustpos_122 = AdjustElementPositioning(ElementsToAdjust=image_6, Margin="0,0,10,10", AbsolutePositioning=False)
adjustpos_123 = AdjustElementPositioning(ElementsToAdjust=label_23, Margin="110,-120,0,10", AbsolutePositioning=False)
height_97 = Slider(30, range=0..30)
cycles = Slider(60, range=10..90)
height_98 = Slider(30, range=0..30)
speed_2 = Slider(0.5, range=0..1)
height_99 = Slider(30, range=0..30)
checkbox_10 = CreateCheckbox(Label="Energy Control Lock", StartingValue=False)
button_20 = CreateButton(ButtonName="Preview Motion", ButtonStyle=0)
slider_20 = CreateSlider(Slider=cycles, ShowBounds=False, ShowTicks=False, ShowTooltip=False, ShowValLabel=True, showLabel=True)
slider_21 = CreateSlider(Slider=speed_2, ShowBounds=False, ShowTicks=False, ShowTooltip=False, ShowValLabel=True, showLabel=True)
adjustpos_124 = AdjustElementPositioning(ElementsToAdjust=button_20, Margin="180,-22,0,10", AbsolutePositioning=False, Height=height_97)
adjustpos_125 = AdjustElementPositioning(ElementsToAdjust=checkbox_10, Margin="0,15,0,0", AbsolutePositioning=False)
adjustpos_126 = AdjustElementPositioning(ElementsToAdjust=slider_20, AbsolutePositioning=False, Height=height_98)
adjustpos_127 = AdjustElementPositioning(ElementsToAdjust=slider_21, AbsolutePositioning=False, Height=height_99)
merge_16 = Merge(Data1=slider_20, Data2=slider_21)
expander_6 = CreateExpander(UIElements=merge_16, Header="Motion Control & Design", Open=True)
merge_17 = Merge(
    Data1=image_6,
    Data2=label_23,
    Data3=tb_6,
    Data4=button_17,
    Data5=button_18,
    Data6=button_19,
    Data7=expander_6,
    Data8=checkbox_10,
    Data9=button_20)
addelems_7 = AddElements(Window=launchwin_2, Elements=flatten(merge_17), DoVLChecking=True)  # -> AddedElements, ElementNames

# ---- group: Continuous Spinning Window Style
title_size_14 = Slider(13, range=0..20)
thumbnail_width_7 = Slider(100, range=0..1000)
title_size_15 = Slider(11, range=0..20)
panel_23 = Panel("This unit has a helical spring, a rack and pinion, and gears. When the helial spring is pressed, the object attached to the rear gear will rotate, activating a spinning motion.")
title_size_16 = Slider(16, range=0..20)
python_10 = GhPythonScript()  # -> out, a
# ---------- python_10: Python ----------
__author__ = "lianghe"
__version__ = "2020.04.19"

import rhinoscriptsyntax as rs

import os

pre_path = os.path.abspath('.')[:os.path.abspath('.').rfind('\\')]
a=pre_path+"\Plug-ins\Grasshopper\Components\Resources\images\CRP.png"
# ---------- end python_10 ----------
width_95 = Slider(165, range=0..200)
label_24 = CreateLabel(LabelText="(by pressing)", LabelSize=title_size_14, Justification=0)
height_100 = Slider(30, range=0..30)
button_21 = CreateButton(ButtonName="Set Motion Direction ", ButtonStyle=0)
width_96 = Slider(175, range=0..300)
image_7 = CreateImage(ImageSource=python_10.a, ImageWidth=thumbnail_width_7, ImageHeight=thumbnail_width_7)
tb_7 = CreateTextBlock(Text=panel_23, TextSize=title_size_15, Justification=0)
label_25 = CreateLabel(LabelText="Continues Spinning", LabelSize=title_size_16, Justification=0)
adjustpos_128 = AdjustElementPositioning(ElementsToAdjust=label_24, Margin="110,-100,0,10", AbsolutePositioning=False)
adjustpos_129 = AdjustElementPositioning(ElementsToAdjust=button_21, Margin="100,-50,0,10", AbsolutePositioning=False, Width=width_95, Height=height_100)
adjustpos_130 = AdjustElementPositioning(ElementsToAdjust=tb_7, Margin="115,-75,0,10", AbsolutePositioning=False, Width=width_96)
adjustpos_131 = AdjustElementPositioning(ElementsToAdjust=label_25, Margin="110,-120,0,10", AbsolutePositioning=False)
adjustpos_132 = AdjustElementPositioning(ElementsToAdjust=image_7, Margin="0,0,10,10", AbsolutePositioning=False)
height_101 = Slider(30, range=0..30)
checkbox_11 = CreateCheckbox(Label="Energy Control Lock", StartingValue=False)
button_22 = CreateButton(ButtonName="Preview Motion", ButtonStyle=0)
adjustpos_133 = AdjustElementPositioning(ElementsToAdjust=button_22, Margin="180,-22,0,10", AbsolutePositioning=False, Height=height_101)
adjustpos_134 = AdjustElementPositioning(ElementsToAdjust=checkbox_11, Margin="0,15,0,0", AbsolutePositioning=False)
radiobtn_20 = CreateRadioButton(RadioButtonName="By Pressing", RadioButtonGroup="Ratio Group 1", InitiallySelected=Toggle(True))
rounds = Slider(60, range=10..90)
height_102 = Slider(30, range=0..30)
speed_3 = Slider(0.5, range=0..1)
height_103 = Slider(30, range=0..30)
slider_22 = CreateSlider(Slider=rounds, ShowBounds=False, ShowTicks=False, ShowTooltip=False, ShowValLabel=True, showLabel=True)
slider_23 = CreateSlider(Slider=speed_3, ShowBounds=False, ShowTicks=False, ShowTooltip=False, ShowValLabel=True, showLabel=True)
adjustpos_135 = AdjustElementPositioning(ElementsToAdjust=radiobtn_20, Margin="0,-20,0,0", AbsolutePositioning=False)
adjustpos_136 = AdjustElementPositioning(ElementsToAdjust=slider_22, AbsolutePositioning=False, Height=height_102)
adjustpos_137 = AdjustElementPositioning(ElementsToAdjust=slider_23, AbsolutePositioning=False, Height=height_103)
merge_18 = Merge(Data1=slider_22, Data2=slider_23)
radiobtn_21 = CreateRadioButton(RadioButtonName="By Rotating", RadioButtonGroup="Ratio Group 1", InitiallySelected=Toggle(False))
expander_7 = CreateExpander(UIElements=merge_18, Header="Motion Control & Design", Open=True)
merge_19 = Merge(
    Data1=image_7,
    Data2=label_25,
    Data3=label_24,
    Data4=tb_7,
    Data5=radiobtn_20,
    Data6=radiobtn_21,
    Data7=button_21,
    Data8=expander_7,
    Data9=checkbox_11,
    Data10=button_22)
addelems_8 = AddElements(Window=launchwin_5, Elements=flatten(merge_19), DoVLChecking=True)  # -> AddedElements, ElementNames
adjustpos_138 = AdjustElementPositioning(ElementsToAdjust=radiobtn_21, Margin="0,-25,0,0", AbsolutePositioning=False)

# ---- group: Instant Extension Events
values_15 = ValueListener(Elements=slider_10, SomeProperty=True)  # -> Values, Indices
values_16 = ValueListener(Elements=slider_11, SomeProperty=True)  # -> Values, Indices
values_17 = ValueListener(Elements=true_button_18, SomeProperty=True)  # -> Values, Indices
values_18 = ValueListener(Elements=true_button_17, SomeProperty=True)  # -> Values, Indices
setdir = SetDirection(Select=values_18.Values)  # -> DirVector, ArrowCrv, SelectedBrep
ie = InstantExtension(
    Start=values_17.Values,
    Model=setdir.SelectedBrep,
    SpringDirection=setdir.DirVector,
    Energy=values_16.Values,
    Distance=values_15.Values)
preprocessie = _01ModelPreprocessOfIE(Motion=ie)  # -> Motion, SpringPositionCandidates, ModelSkeleton
sp = SelectPosition(PositionCandidates=preprocessie.SpringPositionCandidates, Select=Toggle(True))
constructspring = _02ConstructSpringOfIE(Motion=preprocessie.Motion, SpringPosition=sp)  # -> Motion, LockDirectionCandidates, Spring, SpringSkeleton
sd = SelectDirection(DirectionCandidates=constructspring.LockDirectionCandidates, Select=Toggle(True))
nickname = _03GenerateLockPositionCandidateOfIE(Motion=constructspring.Motion, LockDirection=sd)  # -> Motion, LockPositionCandidates
sp_2 = SelectPosition(PositionCandidates=nickname.LockPositionCandidates, Select=Toggle(True))
constructlock = _04ConstructLockOfIE(Motion=nickname.Motion, LockPosition=sp_2)  # -> Motion, Models
