# Grasshopper definition KinergyMainInterface.gh (Grasshopper 1.0.7)
# plug-ins: Human UI

checkbox = CreateCheckbox(Label=" Reverse instant rotation direction", StartingValue=False)
width = Slider(280, range=0..400)
height = Slider(40, range=0..60)
adjustpos = AdjustElementPositioning(
    ElementsToAdjust=checkbox,
    Margin="25,-15,0,0",
    AbsolutePositioning=False,
    Width=width,
    Height=height,
    HorizontalAlignment=Slider(0, range=0..100))
checkbox_2 = CreateCheckbox(Label=" Reverse instant rotation direction", StartingValue=False)
rotationdirectionreverse = ValueListener(Elements=checkbox, SomeProperty=True)  # -> Values, Indices
width_2 = Slider(280, range=0..400)
height_2 = Slider(40, range=0..60)
adjustpos_2 = AdjustElementPositioning(
    ElementsToAdjust=checkbox_2,
    Margin="25,-15,0,0",
    AbsolutePositioning=False,
    Width=width_2,
    Height=height_2,
    HorizontalAlignment=Slider(0, range=0..100))
rotationdirectionreverse_2 = ValueListener(Elements=checkbox_2, SomeProperty=True)  # -> Values, Indices

# ---- group: Interface Logic
c_script = CSharpScript()  # -> out, A
# ---------- c_script: C# ----------
    GH_Document gh_d = owner.OnPingDocument();

    if (gh_d.IsFilePathDefined)
    {
      Print("A path is defined.");
      A = gh_d.FilePath;
    }
    else
    {
      Print("No path defined.");
    }
# ---------- end c_script ----------
python = GhPythonScript(x=c_script.A)  # -> a
# ---------- python: Python ----------
__author__ = "ediga"
__version__ = "2020.08.24"

import rhinoscriptsyntax as rs

idx = x.index("KinergyMainInterface.gh")

a = x[0:idx] + "Resources\images\conrot.png"
# ---------- end python ----------
width_3 = Slider(75, range=0..1000)
height_3 = Slider(75, range=0..1000)
panel = Panel(python)
button = CreateButton(ImagePath=panel, ButtonStyle=0)
adjustpos_3 = AdjustElementPositioning(
    ElementsToAdjust=button,
    Margin="5,-10,0,5",
    AbsolutePositioning=False,
    Width=width_3,
    Height=height_3,
    HorizontalAlignment=Slider(0, range=0..100))
c_script_2 = CSharpScript()  # -> out, A; same code as c_script
python_2 = GhPythonScript(x=c_script_2.A)  # -> a
# ---------- python_2: Python ----------
__author__ = "ediga"
__version__ = "2020.08.24"

import rhinoscriptsyntax as rs

idx = x.index("KinergyMainInterface.gh")

a = x[0:idx] + "Resources\images\\reciprocate.png"
# ---------- end python_2 ----------
c_script_3 = CSharpScript()  # -> out, A; same code as c_script
height_4 = Slider(35, range=0..1000)
width_4 = Slider(186, range=0..1000)
height_5 = Slider(75, range=0..1000)
width_5 = Slider(75, range=0..1000)
height_6 = Slider(40, range=0..1000)
python_3 = GhPythonScript(x=c_script_3.A)  # -> a
# ---------- python_3: Python ----------
__author__ = "ediga"
__version__ = "2020.08.24"

import rhinoscriptsyntax as rs

idx = x.index("KinergyMainInterface.gh")

a = x[0:idx] + "Resources\images\instrans.png"
# ---------- end python_3 ----------
width_6 = Slider(186, range=0..1000)
width_7 = Slider(75, range=0..1000)
height_7 = Slider(75, range=0..1000)
panel_2 = Panel(python_2)
panel_3 = Panel(python_3)
label = CreateLabel(LabelText="Periodic Motion", LabelSize=12, Justification=0)
adjustpos_4 = AdjustElementPositioning(
    ElementsToAdjust=label,
    Margin="0,0,0,5",
    AbsolutePositioning=False,
    Width=width_4,
    Height=height_4,
    HorizontalAlignment=Slider(0, range=0..100))
label_2 = CreateLabel(LabelText="Non-periodic Motion", LabelSize=12, Justification=0)
adjustpos_5 = AdjustElementPositioning(
    ElementsToAdjust=label_2,
    Margin="0,0,0,5",
    AbsolutePositioning=False,
    Width=width_6,
    Height=height_6,
    HorizontalAlignment=Slider(0, range=0..100))
button_2 = CreateButton(ImagePath=panel_2, ButtonStyle=0)
adjustpos_6 = AdjustElementPositioning(
    ElementsToAdjust=button_2,
    Margin="85,-80,0,5",
    AbsolutePositioning=False,
    Width=width_5,
    Height=height_5,
    HorizontalAlignment=Slider(0, range=0..100))
button_3 = CreateButton(ImagePath=panel_3, ButtonStyle=0)
adjustpos_7 = AdjustElementPositioning(
    ElementsToAdjust=button_3,
    Margin="5,-15,0,5",
    AbsolutePositioning=False,
    Width=width_7,
    Height=height_7,
    HorizontalAlignment=Slider(0, range=0..100))
c_script_4 = CSharpScript()  # -> out, A; same code as c_script
c_script_5 = CSharpScript()  # -> out, A; same code as c_script
python_4 = GhPythonScript(x=c_script_4.A)  # -> a
# ---------- python_4: Python ----------
__author__ = "ediga"
__version__ = "2020.08.24"

import rhinoscriptsyntax as rs

idx = x.index("KinergyMainInterface.gh")

a = x[0:idx] + "Resources\images\intosci.png"
# ---------- end python_4 ----------
python_5 = GhPythonScript(x=c_script_5.A)  # -> a
# ---------- python_5: Python ----------
__author__ = "ediga"
__version__ = "2020.08.24"

import rhinoscriptsyntax as rs

idx = x.index("KinergyMainInterface.gh")

a = x[0:idx] + "Resources\images\insrot.png"
# ---------- end python_5 ----------
width_8 = Slider(75, range=0..1000)
height_8 = Slider(75, range=0..1000)
width_9 = Slider(75, range=0..1000)
height_9 = Slider(75, range=0..1000)
panel_4 = Panel(python_4)
panel_5 = Panel(python_5)
button_4 = CreateButton(ImagePath=panel_4, ButtonStyle=0)
adjustpos_8 = AdjustElementPositioning(
    ElementsToAdjust=button_4,
    Margin="165,-80,0,5",
    AbsolutePositioning=False,
    Width=width_8,
    Height=height_8,
    HorizontalAlignment=Slider(0, range=0..100))
button_5 = CreateButton(ImagePath=panel_5, ButtonStyle=0)
adjustpos_9 = AdjustElementPositioning(
    ElementsToAdjust=button_5,
    Margin="85,-80,0,5",
    AbsolutePositioning=False,
    Width=width_9,
    Height=height_9,
    HorizontalAlignment=Slider(0, range=0..100))
c_script_6 = CSharpScript()  # -> out, A; same code as c_script
python_6 = GhPythonScript(x=c_script_6.A)  # -> a
# ---------- python_6: Python ----------
__author__ = "ediga"
__version__ = "2020.08.24"

import rhinoscriptsyntax as rs

idx = x.index("KinergyMainInterface.gh")

a = x[0:idx] + "Resources\images\introt.png"
# ---------- end python_6 ----------
c_script_7 = CSharpScript()  # -> out, A; same code as c_script
width_10 = Slider(75, range=0..1000)
height_10 = Slider(75, range=0..1000)
width_11 = Slider(329, range=0..1000)
height_11 = Slider(30, range=0..1000)
python_7 = GhPythonScript(x=c_script_7.A)  # -> a
# ---------- python_7: Python ----------
__author__ = "ediga"
__version__ = "2020.08.24"

import rhinoscriptsyntax as rs

idx = x.index("KinergyMainInterface.gh")

a = x[0:idx] + "Resources\images\contrans.png"
# ---------- end python_7 ----------
panel_6 = Panel(python_6)
width_12 = Slider(75, range=0..1000)
height_12 = Slider(75, range=0..1000)
panel_7 = Panel(python_7)
titlesize = Slider(15, range=0..30)
button_6 = CreateButton(ImagePath=panel_6, ButtonStyle=0)
adjustpos_10 = AdjustElementPositioning(
    ElementsToAdjust=button_6,
    Margin="245,-80,0,5",
    AbsolutePositioning=False,
    Width=width_10,
    Height=height_10,
    HorizontalAlignment=Slider(0, range=0..100))
button_7 = CreateButton(ImagePath=panel_7, ButtonStyle=0)
adjustpos_11 = AdjustElementPositioning(
    ElementsToAdjust=button_7,
    Margin="165,-80,0,10",
    AbsolutePositioning=False,
    Width=width_12,
    Height=height_12,
    HorizontalAlignment=Slider(0, range=0..100))
label_3 = CreateLabel(LabelText="Select a target motion type:", LabelSize=12, Justification=0)
adjustpos_12 = AdjustElementPositioning(
    ElementsToAdjust=label_3,
    Margin="0,0,0,0",
    AbsolutePositioning=False,
    Width=width_11,
    Height=height_11,
    HorizontalAlignment=Slider(0, range=0..100))
adjustelem = AdjustElementAppearance(ElementsToAdjust=label_3, FontSize=titlesize)

# ----
height_13 = Slider(30, range=0..30)
width_13 = Slider(50, range=0..400)
label_4 = CreateLabel(LabelText="Max", LabelSize=12, Justification=0)
adjustpos_13 = AdjustElementPositioning(
    ElementsToAdjust=label_4,
    Margin="280,-45,0,5",
    AbsolutePositioning=False,
    Width=width_13,
    Height=height_13,
    HorizontalAlignment=Slider(0, range=0..100))
adjustelem_2 = AdjustElementAppearance(ElementsToAdjust=label_4, Background="255,255,255")

# ---- group: Interface Button Logic
values = ValueListener(Elements=button_4, SomeProperty=True)  # -> Values, Indices
values_2 = ValueListener(Elements=button_6, SomeProperty=True)  # -> Values, Indices
values_3 = ValueListener(Elements=button_7, SomeProperty=True)  # -> Values, Indices
values_4 = ValueListener(Elements=button_3, SomeProperty=True)  # -> Values, Indices
values_5 = ValueListener(Elements=button_5, SomeProperty=True)  # -> Values, Indices
values_6 = ValueListener(Elements=button_2, SomeProperty=True)  # -> Values, Indices
values_7 = ValueListener(Elements=button, SomeProperty=True)  # -> Values, Indices
motionselection = BtnSelectionComponent(
    InsTransBtnClicked=values_4.Values,
    InsRotationBtnClicked=values_5.Values,
    ConTransBtnClicked=values_3.Values,
    ConRotBtnClicked=values_7.Values,
    RecipBtnClicked=values_6.Values,
    InterOscillationBtnClicked=values.Values,
    InterRotBtnClicked=values_2.Values)  # -> InsTransPanel, InsRotationPanel, ConTransPanel, ConRotPanel, RecipPanel, InterOscillationPanel, InterRotPanel, DefaultPanel

# ---- group: Intermittent Rotation Kinetic Unit
font_size = Slider(15, range=0..1000)
width_14 = Slider(300, range=0..1000)
width_15 = Slider(300, range=0..1000)
font_size_2 = Slider(15, range=0..1000)
height_14 = Slider(35, range=0..1000)
font_size_3 = Slider(15, range=0..1000)
height_15 = Slider(35, range=0..1000)
width_16 = Slider(300, range=0..1000)
height_16 = Slider(35, range=0..1000)
font_size_4 = Slider(15, range=0..1000)
width_17 = Slider(300, range=0..1000)
width_18 = Slider(300, range=0..1000)
font_size_5 = Slider(15, range=0..1000)
height_17 = Slider(35, range=0..1000)
font_size_6 = Slider(15, range=0..1000)
height_18 = Slider(35, range=0..1000)
height_19 = Slider(30, range=0..30)
width_19 = Slider(300, range=0..400)
height_20 = Slider(30, range=0..30)
width_20 = Slider(50, range=0..400)
energy_min = Slider(5, range=1..10)
label_5 = CreateLabel(LabelText="Max", LabelSize=12, Justification=0)
label_6 = CreateLabel(LabelText="Step3:", LabelSize=font_size_2, Justification=0)
adjustpos_14 = AdjustElementPositioning(
    ElementsToAdjust=label_6,
    Margin="10,0,0,10",
    AbsolutePositioning=False,
    Width=width_14,
    Height=height_14,
    HorizontalAlignment=Slider(0, range=0..100))
label_7 = CreateLabel(LabelText="Step2:", LabelSize=font_size_3, Justification=0)
adjustpos_15 = AdjustElementPositioning(
    ElementsToAdjust=label_7,
    Margin="10,-10,0,10",
    AbsolutePositioning=False,
    Width=width_15,
    Height=height_15,
    HorizontalAlignment=Slider(0, range=0..100))
label_8 = CreateLabel(LabelText="Step4:", LabelSize=font_size_4, Justification=0)
adjustpos_16 = AdjustElementPositioning(
    ElementsToAdjust=label_8,
    Margin="10,0,0,10",
    AbsolutePositioning=False,
    Width=width_16,
    Height=height_16,
    HorizontalAlignment=Slider(0, range=0..100))
width_21 = Slider(290, range=0..400)
label_9 = CreateLabel(LabelText="Motion control method:", LabelSize=font_size_5, Justification=0)
adjustpos_17 = AdjustElementPositioning(
    ElementsToAdjust=label_9,
    Margin="10,0,0,10",
    AbsolutePositioning=False,
    Width=width_17,
    Height=height_17,
    HorizontalAlignment=Slider(0, range=0..100))
height_21 = Slider(30, range=0..30)
label_10 = CreateLabel(LabelText="Step1:", LabelSize=font_size_6, Justification=0)
adjustpos_18 = AdjustElementPositioning(
    ElementsToAdjust=label_10,
    Margin="10,-10,0,10",
    AbsolutePositioning=False,
    Width=width_18,
    Height=height_18,
    HorizontalAlignment=Slider(0, range=0..100))
adjustpos_19 = AdjustElementPositioning(
    ElementsToAdjust=label_5,
    Margin="280,-45,0,5",
    AbsolutePositioning=False,
    Width=width_20,
    Height=height_20,
    HorizontalAlignment=Slider(0, range=0..100))
adjustelem_3 = AdjustElementAppearance(ElementsToAdjust=label_5, Background="255,255,255")
width_22 = Slider(100, range=0..1000)
height_22 = Slider(35, range=0..1000)
label_11 = CreateLabel(LabelText="Step5:   Adjust the motion characteristics", LabelSize=font_size, Justification=0)
adjustelem_4 = AdjustElementAppearance(ElementsToAdjust=label_11, Background="255,255,255")
adjustpos_20 = AdjustElementPositioning(
    ElementsToAdjust=label_11,
    Margin="10,5,0,0",
    AbsolutePositioning=False,
    Width=width_19,
    Height=height_19,
    HorizontalAlignment=Slider(0, range=0..100))
interval_angle_min = Slider(5, range=1..10)
slider = CreateSlider(Slider=energy_min, ShowBounds=False, ShowTicks=False, ShowTooltip=False, ShowValLabel=True, showLabel=True)
width_23 = Slider(290, range=0..400)
width_24 = Slider(240, range=0..1000)
height_23 = Slider(35, range=0..1000)
height_24 = Slider(30, range=0..30)
width_25 = Slider(240, range=0..1000)
height_25 = Slider(35, range=0..1000)
width_26 = Slider(240, range=0..1000)
height_26 = Slider(35, range=0..1000)
width_27 = Slider(240, range=0..1000)
height_27 = Slider(35, range=0..1000)
radiobtn = CreateRadioButton(RadioButtonName="Press", RadioButtonGroup="MCM", InitiallySelected=False)
adjustpos_21 = AdjustElementPositioning(
    ElementsToAdjust=slider,
    Margin="20,-10,0,10",
    AbsolutePositioning=False,
    Width=width_21,
    Height=height_21,
    HorizontalAlignment=Slider(0, range=0..100))
width_28 = Slider(100, range=0..1000)
height_28 = Slider(35, range=0..1000)
speed_min = Slider(5, range=1..10)
adjustpos_22 = AdjustElementPositioning(
    ElementsToAdjust=radiobtn,
    Margin="185,-50,0,10",
    AbsolutePositioning=False,
    Width=width_22,
    Height=height_22,
    HorizontalAlignment=Slider(0, range=0..100))
slider_2 = CreateSlider(Slider=interval_angle_min, ShowBounds=False, ShowTicks=False, ShowTooltip=False, ShowValLabel=True, showLabel=True)
button_8 = CreateButton(ButtonName="Select the position of the end-effector", ButtonStyle=0)
button_9 = CreateButton(ButtonName="Set the rotation axis direction ", ButtonStyle=0)
button_10 = CreateButton(ButtonName="Select the segment and motion control position", ButtonStyle=0)
height_29 = Slider(30, range=0..30)
width_29 = Slider(50, range=0..400)
button_11 = CreateButton(ButtonName="Select the target body  for embedding the unit", ButtonStyle=0)
adjustpos_23 = AdjustElementPositioning(
    ElementsToAdjust=button_8,
    Margin="70,-45,0,10",
    AbsolutePositioning=False,
    Width=width_24,
    Height=height_23,
    HorizontalAlignment=Slider(0, range=0..100))
radiobtn_2 = CreateRadioButton(RadioButtonName="Turn", RadioButtonGroup="MCM", InitiallySelected=False)
adjustpos_24 = AdjustElementPositioning(
    ElementsToAdjust=button_9,
    Margin="70,-45,0,10",
    AbsolutePositioning=False,
    Width=width_25,
    Height=height_25,
    HorizontalAlignment=Slider(0, range=0..100))
adjustpos_25 = AdjustElementPositioning(
    ElementsToAdjust=slider_2,
    Margin="20,-15,0,10",
    AbsolutePositioning=False,
    Width=width_23,
    Height=height_24,
    HorizontalAlignment=Slider(0, range=0..100))
slider_3 = CreateSlider(Slider=speed_min, ShowBounds=False, ShowTicks=False, ShowTooltip=False, ShowValLabel=True, showLabel=True)
adjustpos_26 = AdjustElementPositioning(
    ElementsToAdjust=button_10,
    Margin="70,-45,0,10",
    AbsolutePositioning=False,
    Width=width_26,
    Height=height_26,
    HorizontalAlignment=Slider(0, range=0..100))
label_12 = CreateLabel(LabelText="Max", LabelSize=12, Justification=0)
adjustpos_27 = AdjustElementPositioning(
    ElementsToAdjust=button_11,
    Margin="70,-45,0,10",
    AbsolutePositioning=False,
    Width=width_27,
    Height=height_27,
    HorizontalAlignment=Slider(0, range=0..100))
height_30 = Slider(30, range=0..30)
width_30 = Slider(50, range=0..400)
adjustpos_28 = AdjustElementPositioning(
    ElementsToAdjust=radiobtn_2,
    Margin="250,-50,0,10",
    AbsolutePositioning=False,
    Width=width_28,
    Height=height_28,
    HorizontalAlignment=Slider(0, range=0..100))
adjustpos_29 = AdjustElementPositioning(
    ElementsToAdjust=label_12,
    Margin="280,-60,0,5",
    AbsolutePositioning=False,
    Width=width_29,
    Height=height_29,
    HorizontalAlignment=Slider(0, range=0..100))
adjustelem_5 = AdjustElementAppearance(ElementsToAdjust=label_12, Background="255,255,255")
label_13 = CreateLabel(LabelText="Max", LabelSize=12, Justification=0)
stroke_min = Slider(5, range=1..10)
width_31 = Slider(290, range=0..400)
height_31 = Slider(40, range=0..60)
separatorheight = Slider(10, range=0..10)
colour = ColourPicker(PickedColour=RGB(230, 230, 230))
colour_2 = ColourPicker(PickedColour=RGB(51, 121, 200))
adjustpos_30 = AdjustElementPositioning(
    ElementsToAdjust=label_13,
    Margin="280,-45,0,5",
    AbsolutePositioning=False,
    Width=width_30,
    Height=height_30,
    HorizontalAlignment=Slider(0, range=0..100))
width_32 = Slider(290, range=0..400)
button_12 = CreateButton(ButtonName="Preview", ButtonStyle=0)
adjustelem_6 = AdjustElementAppearance(ElementsToAdjust=label_13, Background="255,255,255")
height_32 = Slider(30, range=0..30)
width_33 = Slider(400, range=0..1000)
width_34 = Slider(80, range=0..1000)
height_33 = Slider(30, range=0..1000)
width_35 = Slider(80, range=0..1000)
height_34 = Slider(30, range=0..1000)
adjustpos_31 = AdjustElementPositioning(
    ElementsToAdjust=slider_3,
    Margin="20,10,0,5",
    AbsolutePositioning=False,
    Width=width_31,
    Height=height_31,
    HorizontalAlignment=Slider(0, range=0..100))
button_13 = CreateButton(ButtonName="Finish", ButtonStyle=0)
slider_4 = CreateSlider(Slider=stroke_min, ShowBounds=False, ShowTicks=False, ShowTooltip=False, ShowValLabel=True, showLabel=True)
titlesize_2 = Slider(15, range=0..30)
separator = CreateSeparator(Thickness=0.5, Horizontal=True, Color=colour, Width=width_33, Height=separatorheight)
adjustpos_32 = AdjustElementPositioning(
    ElementsToAdjust=button_12,
    Margin="150,-45,0,10",
    AbsolutePositioning=False,
    Width=width_34,
    Height=height_33,
    HorizontalAlignment=Slider(0, range=0..100))
adjustpos_33 = AdjustElementPositioning(
    ElementsToAdjust=slider_4,
    Margin="20,-10,0,10",
    AbsolutePositioning=False,
    Width=width_32,
    Height=height_32,
    HorizontalAlignment=Slider(0, range=0..100))
width_36 = Slider(566, range=0..1000)
height_35 = Slider(38, range=0..1000)
adjustpos_34 = AdjustElementPositioning(
    ElementsToAdjust=button_13,
    Margin="240,-45,0,10",
    AbsolutePositioning=False,
    Width=width_35,
    Height=height_34,
    HorizontalAlignment=Slider(0, range=0..100))
height_36 = Slider(35, range=0..1000)
width_37 = Slider(450, range=0..1000)
label_14 = CreateLabel(LabelText="Intermittent Rotation Kinetic Unit", LabelSize=12, Justification=0)
adjustelem_7 = AdjustElementAppearance(ElementsToAdjust=label_14, Foreground=colour_2, FontSize=titlesize_2)
adjustpos_35 = AdjustElementPositioning(
    ElementsToAdjust=label_14,
    Margin="0,5,0,10",
    AbsolutePositioning=False,
    Width=width_36,
    Height=height_35,
    HorizontalAlignment=Slider(0, range=0..100))
checkbox_3 = CreateCheckbox(Label="Add a lock", StartingValue=False)
adjustpos_36 = AdjustElementPositioning(ElementsToAdjust=separator, Margin="5,-5,0,10", AbsolutePositioning=False)
height_37 = Slider(30, range=0..30)
width_38 = Slider(50, range=0..400)
label_15 = CreateLabel(LabelText="Max", LabelSize=12, Justification=0)
merge = Merge(
    Data1=label_14,
    Data2=label_10,
    Data3=button_11,
    Data4=label_9,
    Data5=radiobtn,
    Data6=radiobtn_2,
    Data7=label_7,
    Data8=button_10,
    Data9=label_6,
    Data10=button_8,
    Data11=label_8,
    Data12=button_9,
    Data13=label_11,
    Data14=slider_3,
    Data15=label_12,
    Data16=slider_2,
    Data17=label_4,
    Data18=label_15,
    Data19=slider_4,
    Data20=label_15,
    Data21=slider,
    Data22=label_13,
    Data23=checkbox_2,
    Data26=separator,
    Data27=checkbox_3,
    Data28=button_12,
    Data29=button_13)
stack = CreateStack(UIElements=merge, Horizontal=Toggle(False))
hideshow = HideShowElement(ElementToHideShow=stack, Show=motionselection.InterRotPanel, Collapse=Toggle(True), Disable=Toggle(False))
adjustpos_37 = AdjustElementPositioning(ElementsToAdjust=checkbox_3, Margin="15,0,0,10", AbsolutePositioning=False, Width=width_37, Height=height_36)
adjustpos_38 = AdjustElementPositioning(
    ElementsToAdjust=label_15,
    Margin="280,-45,0,5",
    AbsolutePositioning=False,
    Width=width_38,
    Height=height_37,
    HorizontalAlignment=Slider(0, range=0..100))
adjustelem_8 = AdjustElementAppearance(ElementsToAdjust=label_15, Background="255,255,255")

# ---- group: Intermittent Oscillation Kinetic Unit
font_size_7 = Slider(15, range=0..1000)
width_39 = Slider(300, range=0..1000)
font_size_8 = Slider(15, range=0..1000)
height_38 = Slider(35, range=0..1000)
width_40 = Slider(300, range=0..1000)
font_size_9 = Slider(15, range=0..1000)
height_39 = Slider(35, range=0..1000)
width_41 = Slider(300, range=0..1000)
font_size_10 = Slider(15, range=0..1000)
height_40 = Slider(35, range=0..1000)
width_42 = Slider(300, range=0..1000)
font_size_11 = Slider(15, range=0..1000)
height_41 = Slider(35, range=0..1000)
width_43 = Slider(300, range=0..1000)
font_size_12 = Slider(15, range=0..1000)
height_42 = Slider(35, range=0..1000)
height_43 = Slider(30, range=0..30)
width_44 = Slider(300, range=0..400)
height_44 = Slider(30, range=0..30)
width_45 = Slider(50, range=0..400)
label_16 = CreateLabel(LabelText="Max", LabelSize=12, Justification=0)
label_17 = CreateLabel(LabelText="Step3:", LabelSize=font_size_8, Justification=0)
adjustpos_39 = AdjustElementPositioning(
    ElementsToAdjust=label_17,
    Margin="10,0,0,10",
    AbsolutePositioning=False,
    Width=width_39,
    Height=height_38,
    HorizontalAlignment=Slider(0, range=0..100))
label_18 = CreateLabel(LabelText="Step2:", LabelSize=font_size_9, Justification=0)
adjustpos_40 = AdjustElementPositioning(
    ElementsToAdjust=label_18,
    Margin="10,-10,0,10",
    AbsolutePositioning=False,
    Width=width_40,
    Height=height_39,
    HorizontalAlignment=Slider(0, range=0..100))
label_19 = CreateLabel(LabelText="Step4:", LabelSize=font_size_10, Justification=0)
adjustpos_41 = AdjustElementPositioning(
    ElementsToAdjust=label_19,
    Margin="10,0,0,10",
    AbsolutePositioning=False,
    Width=width_41,
    Height=height_40,
    HorizontalAlignment=Slider(0, range=0..100))
label_20 = CreateLabel(LabelText="Motion control method:", LabelSize=font_size_11, Justification=0)
adjustpos_42 = AdjustElementPositioning(
    ElementsToAdjust=label_20,
    Margin="10,0,0,10",
    AbsolutePositioning=False,
    Width=width_42,
    Height=height_41,
    HorizontalAlignment=Slider(0, range=0..100))
label_21 = CreateLabel(LabelText="Step1:", LabelSize=font_size_12, Justification=0)
adjustpos_43 = AdjustElementPositioning(
    ElementsToAdjust=label_21,
    Margin="10,-10,0,10",
    AbsolutePositioning=False,
    Width=width_43,
    Height=height_42,
    HorizontalAlignment=Slider(0, range=0..100))
adjustpos_44 = AdjustElementPositioning(
    ElementsToAdjust=label_16,
    Margin="280,-45,0,5",
    AbsolutePositioning=False,
    Width=width_45,
    Height=height_44,
    HorizontalAlignment=Slider(0, range=0..100))
adjustelem_9 = AdjustElementAppearance(ElementsToAdjust=label_16, Background="255,255,255")
width_46 = Slider(100, range=0..1000)
height_45 = Slider(35, range=0..1000)
label_22 = CreateLabel(LabelText="Step5:   Adjust the motion characteristics", LabelSize=font_size_7, Justification=0)
adjustelem_10 = AdjustElementAppearance(ElementsToAdjust=label_22, Background="255,255,255")
adjustpos_45 = AdjustElementPositioning(
    ElementsToAdjust=label_22,
    Margin="10,5,0,0",
    AbsolutePositioning=False,
    Width=width_44,
    Height=height_43,
    HorizontalAlignment=Slider(0, range=0..100))
amplitude_min = Slider(5, range=1..10)
width_47 = Slider(290, range=0..400)
width_48 = Slider(240, range=0..1000)
height_46 = Slider(35, range=0..1000)
height_47 = Slider(30, range=0..30)
width_49 = Slider(240, range=0..1000)
height_48 = Slider(35, range=0..1000)
width_50 = Slider(240, range=0..1000)
height_49 = Slider(35, range=0..1000)
width_51 = Slider(240, range=0..1000)
height_50 = Slider(35, range=0..1000)
radiobtn_3 = CreateRadioButton(RadioButtonName="Press", RadioButtonGroup="MCM", InitiallySelected=False)
energy_min_2 = Slider(5, range=1..10)
width_52 = Slider(100, range=0..1000)
height_51 = Slider(35, range=0..1000)
speed_min_2 = Slider(5, range=1..10)
width_53 = Slider(290, range=0..400)
height_52 = Slider(30, range=0..30)
adjustpos_46 = AdjustElementPositioning(
    ElementsToAdjust=radiobtn_3,
    Margin="185,-50,0,10",
    AbsolutePositioning=False,
    Width=width_46,
    Height=height_45,
    HorizontalAlignment=Slider(0, range=0..100))
slider_5 = CreateSlider(Slider=amplitude_min, ShowBounds=False, ShowTicks=False, ShowTooltip=False, ShowValLabel=True, showLabel=True)
button_14 = CreateButton(ButtonName="Select the position of the end-effector", ButtonStyle=0)
button_15 = CreateButton(ButtonName="Set the oscillation axis direction ", ButtonStyle=0)
button_16 = CreateButton(ButtonName="Select the segment and motion control position", ButtonStyle=0)
height_53 = Slider(30, range=0..30)
width_54 = Slider(50, range=0..400)
button_17 = CreateButton(ButtonName="Select the target body  for embedding the unit", ButtonStyle=0)
adjustpos_47 = AdjustElementPositioning(
    ElementsToAdjust=button_14,
    Margin="70,-45,0,10",
    AbsolutePositioning=False,
    Width=width_48,
    Height=height_46,
    HorizontalAlignment=Slider(0, range=0..100))
radiobtn_4 = CreateRadioButton(RadioButtonName="Turn", RadioButtonGroup="MCM", InitiallySelected=False)
adjustpos_48 = AdjustElementPositioning(
    ElementsToAdjust=button_15,
    Margin="70,-45,0,10",
    AbsolutePositioning=False,
    Width=width_49,
    Height=height_48,
    HorizontalAlignment=Slider(0, range=0..100))
adjustpos_49 = AdjustElementPositioning(
    ElementsToAdjust=slider_5,
    Margin="20,-15,0,10",
    AbsolutePositioning=False,
    Width=width_47,
    Height=height_47,
    HorizontalAlignment=Slider(0, range=0..100))
slider_6 = CreateSlider(Slider=speed_min_2, ShowBounds=False, ShowTicks=False, ShowTooltip=False, ShowValLabel=True, showLabel=True)
adjustpos_50 = AdjustElementPositioning(
    ElementsToAdjust=button_16,
    Margin="70,-45,0,10",
    AbsolutePositioning=False,
    Width=width_50,
    Height=height_49,
    HorizontalAlignment=Slider(0, range=0..100))
label_23 = CreateLabel(LabelText="Max", LabelSize=12, Justification=0)
adjustpos_51 = AdjustElementPositioning(
    ElementsToAdjust=button_17,
    Margin="70,-45,0,10",
    AbsolutePositioning=False,
    Width=width_51,
    Height=height_50,
    HorizontalAlignment=Slider(0, range=0..100))
slider_7 = CreateSlider(Slider=energy_min_2, ShowBounds=False, ShowTicks=False, ShowTooltip=False, ShowValLabel=True, showLabel=True)
adjustpos_52 = AdjustElementPositioning(
    ElementsToAdjust=radiobtn_4,
    Margin="250,-50,0,10",
    AbsolutePositioning=False,
    Width=width_52,
    Height=height_51,
    HorizontalAlignment=Slider(0, range=0..100))
stroke_min_2 = Slider(5, range=1..10)
adjustpos_53 = AdjustElementPositioning(
    ElementsToAdjust=label_23,
    Margin="280,-60,0,5",
    AbsolutePositioning=False,
    Width=width_54,
    Height=height_53,
    HorizontalAlignment=Slider(0, range=0..100))
adjustelem_11 = AdjustElementAppearance(ElementsToAdjust=label_23, Background="255,255,255")
width_55 = Slider(290, range=0..400)
height_54 = Slider(30, range=0..30)
adjustpos_54 = AdjustElementPositioning(
    ElementsToAdjust=slider_7,
    Margin="20,-10,0,10",
    AbsolutePositioning=False,
    Width=width_53,
    Height=height_52,
    HorizontalAlignment=Slider(0, range=0..100))
width_56 = Slider(290, range=0..400)
height_55 = Slider(40, range=0..60)
separatorheight_2 = Slider(10, range=0..10)
colour_3 = ColourPicker(PickedColour=RGB(230, 230, 230))
colour_4 = ColourPicker(PickedColour=RGB(51, 121, 200))
button_18 = CreateButton(ButtonName="Preview", ButtonStyle=0)
width_57 = Slider(400, range=0..1000)
width_58 = Slider(80, range=0..1000)
height_56 = Slider(30, range=0..1000)
slider_8 = CreateSlider(Slider=stroke_min_2, ShowBounds=False, ShowTicks=False, ShowTooltip=False, ShowValLabel=True, showLabel=True)
width_59 = Slider(80, range=0..1000)
height_57 = Slider(30, range=0..1000)
adjustpos_55 = AdjustElementPositioning(
    ElementsToAdjust=slider_6,
    Margin="20,10,0,5",
    AbsolutePositioning=False,
    Width=width_56,
    Height=height_55,
    HorizontalAlignment=Slider(0, range=0..100))
button_19 = CreateButton(ButtonName="Finish", ButtonStyle=0)
height_58 = Slider(30, range=0..30)
width_60 = Slider(50, range=0..400)
adjustpos_56 = AdjustElementPositioning(
    ElementsToAdjust=slider_8,
    Margin="20,-10,0,10",
    AbsolutePositioning=False,
    Width=width_55,
    Height=height_54,
    HorizontalAlignment=Slider(0, range=0..100))
titlesize_3 = Slider(15, range=0..30)
separator_2 = CreateSeparator(Thickness=0.5, Horizontal=True, Color=colour_3, Width=width_57, Height=separatorheight_2)
label_24 = CreateLabel(LabelText="Max", LabelSize=12, Justification=0)
adjustpos_57 = AdjustElementPositioning(
    ElementsToAdjust=button_18,
    Margin="150,-45,0,10",
    AbsolutePositioning=False,
    Width=width_58,
    Height=height_56,
    HorizontalAlignment=Slider(0, range=0..100))
width_61 = Slider(566, range=0..1000)
height_59 = Slider(38, range=0..1000)
adjustpos_58 = AdjustElementPositioning(
    ElementsToAdjust=button_19,
    Margin="240,-45,0,10",
    AbsolutePositioning=False,
    Width=width_59,
    Height=height_57,
    HorizontalAlignment=Slider(0, range=0..100))
adjustpos_59 = AdjustElementPositioning(
    ElementsToAdjust=label_24,
    Margin="280,-45,0,5",
    AbsolutePositioning=False,
    Width=width_60,
    Height=height_58,
    HorizontalAlignment=Slider(0, range=0..100))
adjustelem_12 = AdjustElementAppearance(ElementsToAdjust=label_24, Background="255,255,255")
height_60 = Slider(35, range=0..1000)
width_62 = Slider(450, range=0..1000)
height_61 = Slider(30, range=0..30)
width_63 = Slider(50, range=0..400)
label_25 = CreateLabel(LabelText="Intermittent Oscillation Kinetic Unit", LabelSize=12, Justification=0)
adjustelem_13 = AdjustElementAppearance(ElementsToAdjust=label_25, Foreground=colour_4, FontSize=titlesize_3)
adjustpos_60 = AdjustElementPositioning(
    ElementsToAdjust=label_25,
    Margin="0,5,0,10",
    AbsolutePositioning=False,
    Width=width_61,
    Height=height_59,
    HorizontalAlignment=Slider(0, range=0..100))
checkbox_4 = CreateCheckbox(Label="Add a lock", StartingValue=False)
adjustpos_61 = AdjustElementPositioning(ElementsToAdjust=separator_2, Margin="5,-5,0,10", AbsolutePositioning=False)
label_26 = CreateLabel(LabelText="Max", LabelSize=12, Justification=0)
merge_2 = Merge(
    Data1=label_25,
    Data2=label_21,
    Data3=button_17,
    Data4=label_20,
    Data5=radiobtn_3,
    Data6=radiobtn_4,
    Data7=label_18,
    Data8=button_16,
    Data9=label_17,
    Data10=button_14,
    Data11=label_19,
    Data12=button_15,
    Data13=label_22,
    Data14=slider_6,
    Data15=label_23,
    Data16=slider_5,
    Data17=label_26,
    Data18=slider_8,
    Data19=slider_7,
    Data20=label_24,
    Data21=label_16,
    Data23=separator_2,
    Data24=checkbox_4,
    Data25=button_18,
    Data26=button_19)
stack_2 = CreateStack(UIElements=merge_2, Horizontal=Toggle(False))
hideshow_2 = HideShowElement(ElementToHideShow=stack_2, Show=motionselection.InterOscillationPanel, Collapse=Toggle(True), Disable=Toggle(False))
adjustpos_62 = AdjustElementPositioning(
    ElementsToAdjust=label_26,
    Margin="280,-45,0,5",
    AbsolutePositioning=False,
    Width=width_63,
    Height=height_61,
    HorizontalAlignment=Slider(0, range=0..100))
adjustelem_14 = AdjustElementAppearance(ElementsToAdjust=label_26, Background="255,255,255")
adjustpos_63 = AdjustElementPositioning(ElementsToAdjust=checkbox_4, Margin="15,0,0,10", AbsolutePositioning=False, Width=width_62, Height=height_60)

# ---- group: Reciprocation Kinetic Unit
font_size_13 = Slider(15, range=0..1000)
width_64 = Slider(300, range=0..1000)
font_size_14 = Slider(15, range=0..1000)
height_62 = Slider(35, range=0..1000)
width_65 = Slider(300, range=0..1000)
font_size_15 = Slider(15, range=0..1000)
height_63 = Slider(35, range=0..1000)
width_66 = Slider(300, range=0..1000)
font_size_16 = Slider(15, range=0..1000)
height_64 = Slider(35, range=0..1000)
width_67 = Slider(300, range=0..1000)
height_65 = Slider(35, range=0..1000)
width_68 = Slider(300, range=0..1000)
font_size_17 = Slider(15, range=0..1000)
font_size_18 = Slider(15, range=0..1000)
height_66 = Slider(35, range=0..1000)
height_67 = Slider(30, range=0..30)
width_69 = Slider(300, range=0..400)
height_68 = Slider(30, range=0..30)
width_70 = Slider(50, range=0..400)
energy_min_3 = Slider(5, range=1..10)
label_27 = CreateLabel(LabelText="Max", LabelSize=12, Justification=0)
label_28 = CreateLabel(LabelText="Step3:", LabelSize=font_size_14, Justification=0)
adjustpos_64 = AdjustElementPositioning(
    ElementsToAdjust=label_28,
    Margin="10,0,0,10",
    AbsolutePositioning=False,
    Width=width_64,
    Height=height_62,
    HorizontalAlignment=Slider(0, range=0..100))
label_29 = CreateLabel(LabelText="Step2:", LabelSize=font_size_15, Justification=0)
adjustpos_65 = AdjustElementPositioning(
    ElementsToAdjust=label_29,
    Margin="10,-10,0,10",
    AbsolutePositioning=False,
    Width=width_65,
    Height=height_63,
    HorizontalAlignment=Slider(0, range=0..100))
width_71 = Slider(290, range=0..400)
label_30 = CreateLabel(LabelText="Step4:", LabelSize=font_size_16, Justification=0)
adjustpos_66 = AdjustElementPositioning(
    ElementsToAdjust=label_30,
    Margin="10,0,0,10",
    AbsolutePositioning=False,
    Width=width_66,
    Height=height_64,
    HorizontalAlignment=Slider(0, range=0..100))
height_69 = Slider(30, range=0..30)
label_31 = CreateLabel(LabelText="Motion control method:", LabelSize=font_size_17, Justification=0)
adjustpos_67 = AdjustElementPositioning(
    ElementsToAdjust=label_31,
    Margin="10,0,0,10",
    AbsolutePositioning=False,
    Width=width_67,
    Height=height_65,
    HorizontalAlignment=Slider(0, range=0..100))
label_32 = CreateLabel(LabelText="Step1:", LabelSize=font_size_18, Justification=0)
adjustpos_68 = AdjustElementPositioning(
    ElementsToAdjust=label_32,
    Margin="10,-10,0,10",
    AbsolutePositioning=False,
    Width=width_68,
    Height=height_66,
    HorizontalAlignment=Slider(0, range=0..100))
adjustpos_69 = AdjustElementPositioning(
    ElementsToAdjust=label_27,
    Margin="280,-45,0,5",
    AbsolutePositioning=False,
    Width=width_70,
    Height=height_68,
    HorizontalAlignment=Slider(0, range=0..100))
adjustelem_15 = AdjustElementAppearance(ElementsToAdjust=label_27, Background="255,255,255")
width_72 = Slider(100, range=0..1000)
height_70 = Slider(35, range=0..1000)
label_33 = CreateLabel(LabelText="Step5:   Adjust the motion characteristics", LabelSize=font_size_13, Justification=0)
adjustelem_16 = AdjustElementAppearance(ElementsToAdjust=label_33, Background="255,255,255")
adjustpos_70 = AdjustElementPositioning(
    ElementsToAdjust=label_33,
    Margin="10,5,0,0",
    AbsolutePositioning=False,
    Width=width_69,
    Height=height_67,
    HorizontalAlignment=Slider(0, range=0..100))
displacement_min = Slider(5, range=1..10)
slider_9 = CreateSlider(Slider=energy_min_3, ShowBounds=False, ShowTicks=False, ShowTooltip=False, ShowValLabel=True, showLabel=True)
width_73 = Slider(290, range=0..400)
width_74 = Slider(240, range=0..1000)
height_71 = Slider(35, range=0..1000)
height_72 = Slider(30, range=0..30)
width_75 = Slider(240, range=0..1000)
height_73 = Slider(35, range=0..1000)
width_76 = Slider(240, range=0..1000)
height_74 = Slider(35, range=0..1000)
width_77 = Slider(240, range=0..1000)
height_75 = Slider(35, range=0..1000)
radiobtn_5 = CreateRadioButton(RadioButtonName="Press", RadioButtonGroup="MCM", InitiallySelected=False)
adjustpos_71 = AdjustElementPositioning(
    ElementsToAdjust=slider_9,
    Margin="20,-10,0,10",
    AbsolutePositioning=False,
    Width=width_71,
    Height=height_69,
    HorizontalAlignment=Slider(0, range=0..100))
width_78 = Slider(100, range=0..1000)
height_76 = Slider(35, range=0..1000)
speed_min_3 = Slider(5, range=1..10)
adjustpos_72 = AdjustElementPositioning(
    ElementsToAdjust=radiobtn_5,
    Margin="185,-50,0,10",
    AbsolutePositioning=False,
    Width=width_72,
    Height=height_70,
    HorizontalAlignment=Slider(0, range=0..100))
slider_10 = CreateSlider(Slider=displacement_min, ShowBounds=False, ShowTicks=False, ShowTooltip=False, ShowValLabel=True, showLabel=True)
button_20 = CreateButton(ButtonName="Select the position of the end-effector", ButtonStyle=0)
button_21 = CreateButton(ButtonName="Set the reciprocation axis direction", ButtonStyle=0)
button_22 = CreateButton(ButtonName="Select the segment and motion control position", ButtonStyle=0)
height_77 = Slider(30, range=0..30)
width_79 = Slider(50, range=0..400)
button_23 = CreateButton(ButtonName="Select the target body  for embedding the unit", ButtonStyle=0)
adjustpos_73 = AdjustElementPositioning(
    ElementsToAdjust=button_20,
    Margin="70,-45,0,10",
    AbsolutePositioning=False,
    Width=width_74,
    Height=height_71,
    HorizontalAlignment=Slider(0, range=0..100))
radiobtn_6 = CreateRadioButton(RadioButtonName="Turn", RadioButtonGroup="MCM", InitiallySelected=False)
adjustpos_74 = AdjustElementPositioning(
    ElementsToAdjust=button_21,
    Margin="70,-45,0,10",
    AbsolutePositioning=False,
    Width=width_75,
    Height=height_73,
    HorizontalAlignment=Slider(0, range=0..100))
adjustpos_75 = AdjustElementPositioning(
    ElementsToAdjust=slider_10,
    Margin="20,-15,0,10",
    AbsolutePositioning=False,
    Width=width_73,
    Height=height_72,
    HorizontalAlignment=Slider(0, range=0..100))
slider_11 = CreateSlider(Slider=speed_min_3, ShowBounds=False, ShowTicks=False, ShowTooltip=False, ShowValLabel=True, showLabel=True)
adjustpos_76 = AdjustElementPositioning(
    ElementsToAdjust=button_22,
    Margin="70,-45,0,10",
    AbsolutePositioning=False,
    Width=width_76,
    Height=height_74,
    HorizontalAlignment=Slider(0, range=0..100))
label_34 = CreateLabel(LabelText="Max", LabelSize=12, Justification=0)
adjustpos_77 = AdjustElementPositioning(
    ElementsToAdjust=button_23,
    Margin="70,-45,0,10",
    AbsolutePositioning=False,
    Width=width_77,
    Height=height_75,
    HorizontalAlignment=Slider(0, range=0..100))
height_78 = Slider(30, range=0..30)
width_80 = Slider(50, range=0..400)
adjustpos_78 = AdjustElementPositioning(
    ElementsToAdjust=radiobtn_6,
    Margin="250,-50,0,10",
    AbsolutePositioning=False,
    Width=width_78,
    Height=height_76,
    HorizontalAlignment=Slider(0, range=0..100))
adjustpos_79 = AdjustElementPositioning(
    ElementsToAdjust=label_34,
    Margin="280,-60,0,5",
    AbsolutePositioning=False,
    Width=width_79,
    Height=height_77,
    HorizontalAlignment=Slider(0, range=0..100))
adjustelem_17 = AdjustElementAppearance(ElementsToAdjust=label_34, Background="255,255,255")
stroke_min_3 = Slider(5, range=1..10)
label_35 = CreateLabel(LabelText="Max", LabelSize=12, Justification=0)
width_81 = Slider(290, range=0..400)
width_82 = Slider(290, range=0..400)
height_79 = Slider(40, range=0..60)
height_80 = Slider(30, range=0..30)
separatorheight_3 = Slider(10, range=0..10)
colour_5 = ColourPicker(PickedColour=RGB(230, 230, 230))
adjustpos_80 = AdjustElementPositioning(
    ElementsToAdjust=label_35,
    Margin="280,-45,0,5",
    AbsolutePositioning=False,
    Width=width_80,
    Height=height_78,
    HorizontalAlignment=Slider(0, range=0..100))
colour_6 = ColourPicker(PickedColour=RGB(51, 121, 200))
button_24 = CreateButton(ButtonName="Preview", ButtonStyle=0)
width_83 = Slider(400, range=0..1000)
width_84 = Slider(80, range=0..1000)
height_81 = Slider(30, range=0..1000)
slider_12 = CreateSlider(Slider=stroke_min_3, ShowBounds=False, ShowTicks=False, ShowTooltip=False, ShowValLabel=True, showLabel=True)
width_85 = Slider(80, range=0..1000)
height_82 = Slider(30, range=0..1000)
adjustpos_81 = AdjustElementPositioning(
    ElementsToAdjust=slider_11,
    Margin="20,10,0,5",
    AbsolutePositioning=False,
    Width=width_82,
    Height=height_79,
    HorizontalAlignment=Slider(0, range=0..100))
button_25 = CreateButton(ButtonName="Finish", ButtonStyle=0)
titlesize_4 = Slider(15, range=0..30)
separator_3 = CreateSeparator(Thickness=0.5, Horizontal=True, Color=colour_5, Width=width_83, Height=separatorheight_3)
adjustpos_82 = AdjustElementPositioning(
    ElementsToAdjust=slider_12,
    Margin="20,-10,0,10",
    AbsolutePositioning=False,
    Width=width_81,
    Height=height_80,
    HorizontalAlignment=Slider(0, range=0..100))
adjustpos_83 = AdjustElementPositioning(
    ElementsToAdjust=button_24,
    Margin="150,-45,0,10",
    AbsolutePositioning=False,
    Width=width_84,
    Height=height_81,
    HorizontalAlignment=Slider(0, range=0..100))
width_86 = Slider(566, range=0..1000)
height_83 = Slider(38, range=0..1000)
adjustpos_84 = AdjustElementPositioning(
    ElementsToAdjust=button_25,
    Margin="240,-45,0,10",
    AbsolutePositioning=False,
    Width=width_85,
    Height=height_82,
    HorizontalAlignment=Slider(0, range=0..100))
adjustelem_18 = AdjustElementAppearance(ElementsToAdjust=label_35, Background="255,255,255")
height_84 = Slider(35, range=0..1000)
width_87 = Slider(450, range=0..1000)
height_85 = Slider(30, range=0..30)
width_88 = Slider(50, range=0..400)
label_36 = CreateLabel(LabelText="Reciprocation Kinetic Unit", LabelSize=12, Justification=0)
adjustelem_19 = AdjustElementAppearance(ElementsToAdjust=label_36, Foreground=colour_6, FontSize=titlesize_4)
adjustpos_85 = AdjustElementPositioning(
    ElementsToAdjust=label_36,
    Margin="0,5,0,10",
    AbsolutePositioning=False,
    Width=width_86,
    Height=height_83,
    HorizontalAlignment=Slider(0, range=0..100))
checkbox_5 = CreateCheckbox(Label="Add a lock", StartingValue=False)
adjustpos_86 = AdjustElementPositioning(ElementsToAdjust=separator_3, Margin="5,-5,0,10", AbsolutePositioning=False)
label_37 = CreateLabel(LabelText="Max", LabelSize=12, Justification=0)
merge_3 = Merge(
    Data1=label_36,
    Data2=label_32,
    Data3=button_23,
    Data4=label_31,
    Data5=radiobtn_5,
    Data6=radiobtn_6,
    Data7=label_29,
    Data8=button_22,
    Data9=label_28,
    Data10=button_20,
    Data11=label_30,
    Data12=button_21,
    Data13=label_33,
    Data14=slider_11,
    Data15=label_34,
    Data16=slider_10,
    Data17=label_37,
    Data18=slider_12,
    Data19=slider_9,
    Data20=label_35,
    Data21=label_27,
    Data23=separator_3,
    Data24=checkbox_5,
    Data25=button_24,
    Data26=button_25)
stack_3 = CreateStack(UIElements=merge_3, Horizontal=Toggle(False))
hideshow_3 = HideShowElement(ElementToHideShow=stack_3, Show=motionselection.RecipPanel, Collapse=Toggle(True), Disable=Toggle(False))
adjustpos_87 = AdjustElementPositioning(
    ElementsToAdjust=label_37,
    Margin="280,-45,0,5",
    AbsolutePositioning=False,
    Width=width_88,
    Height=height_85,
    HorizontalAlignment=Slider(0, range=0..100))
adjustelem_20 = AdjustElementAppearance(ElementsToAdjust=label_37, Background="255,255,255")
adjustpos_88 = AdjustElementPositioning(ElementsToAdjust=checkbox_5, Margin="15,0,0,10", AbsolutePositioning=False, Width=width_87, Height=height_84)

# ---- group: Continuous Rotation Kinetic Unit
font_size_19 = Slider(15, range=0..1000)
width_89 = Slider(300, range=0..1000)
height_86 = Slider(35, range=0..1000)
width_90 = Slider(300, range=0..1000)
font_size_20 = Slider(15, range=0..1000)
height_87 = Slider(35, range=0..1000)
font_size_21 = Slider(15, range=0..1000)
width_91 = Slider(300, range=0..1000)
font_size_22 = Slider(15, range=0..1000)
height_88 = Slider(35, range=0..1000)
width_92 = Slider(300, range=0..1000)
height_89 = Slider(35, range=0..1000)
width_93 = Slider(300, range=0..1000)
font_size_23 = Slider(15, range=0..1000)
height_90 = Slider(35, range=0..1000)
font_size_24 = Slider(15, range=0..1000)
height_91 = Slider(30, range=0..30)
width_94 = Slider(300, range=0..400)
height_92 = Slider(30, range=0..30)
width_95 = Slider(50, range=0..400)
label_38 = CreateLabel(LabelText="Max", LabelSize=12, Justification=0)
label_39 = CreateLabel(LabelText="Step3:", LabelSize=font_size_20, Justification=0)
adjustpos_89 = AdjustElementPositioning(
    ElementsToAdjust=label_39,
    Margin="10,0,0,10",
    AbsolutePositioning=False,
    Width=width_89,
    Height=height_86,
    HorizontalAlignment=Slider(0, range=0..100))
label_40 = CreateLabel(LabelText="Step2:", LabelSize=font_size_21, Justification=0)
adjustpos_90 = AdjustElementPositioning(
    ElementsToAdjust=label_40,
    Margin="10,-10,0,10",
    AbsolutePositioning=False,
    Width=width_90,
    Height=height_87,
    HorizontalAlignment=Slider(0, range=0..100))
label_41 = CreateLabel(LabelText="Step4:", LabelSize=font_size_22, Justification=0)
adjustpos_91 = AdjustElementPositioning(
    ElementsToAdjust=label_41,
    Margin="10,0,0,10",
    AbsolutePositioning=False,
    Width=width_91,
    Height=height_88,
    HorizontalAlignment=Slider(0, range=0..100))
label_42 = CreateLabel(LabelText="Motion control method:", LabelSize=font_size_23, Justification=0)
adjustpos_92 = AdjustElementPositioning(
    ElementsToAdjust=label_42,
    Margin="10,0,0,10",
    AbsolutePositioning=False,
    Width=width_92,
    Height=height_89,
    HorizontalAlignment=Slider(0, range=0..100))
label_43 = CreateLabel(LabelText="Step1:", LabelSize=font_size_24, Justification=0)
adjustpos_93 = AdjustElementPositioning(
    ElementsToAdjust=label_43,
    Margin="10,-10,0,10",
    AbsolutePositioning=False,
    Width=width_93,
    Height=height_90,
    HorizontalAlignment=Slider(0, range=0..100))
adjustpos_94 = AdjustElementPositioning(
    ElementsToAdjust=label_38,
    Margin="280,-45,0,5",
    AbsolutePositioning=False,
    Width=width_95,
    Height=height_92,
    HorizontalAlignment=Slider(0, range=0..100))
adjustelem_21 = AdjustElementAppearance(ElementsToAdjust=label_38, Background="255,255,255")
width_96 = Slider(100, range=0..1000)
height_93 = Slider(35, range=0..1000)
label_44 = CreateLabel(LabelText="Step5:   Adjust the motion characteristics", LabelSize=font_size_19, Justification=0)
adjustelem_22 = AdjustElementAppearance(ElementsToAdjust=label_44, Background="255,255,255")
adjustpos_95 = AdjustElementPositioning(
    ElementsToAdjust=label_44,
    Margin="10,5,0,0",
    AbsolutePositioning=False,
    Width=width_94,
    Height=height_91,
    HorizontalAlignment=Slider(0, range=0..100))
revolutions_min = Slider(5, range=1..10)
width_97 = Slider(290, range=0..400)
width_98 = Slider(240, range=0..1000)
height_94 = Slider(35, range=0..1000)
height_95 = Slider(30, range=0..30)
width_99 = Slider(240, range=0..1000)
height_96 = Slider(35, range=0..1000)
width_100 = Slider(240, range=0..1000)
height_97 = Slider(35, range=0..1000)
width_101 = Slider(240, range=0..1000)
height_98 = Slider(35, range=0..1000)
radiobtn_7 = CreateRadioButton(RadioButtonName="Press", RadioButtonGroup="MCM", InitiallySelected=False)
width_102 = Slider(100, range=0..1000)
height_99 = Slider(35, range=0..1000)
speed_min_4 = Slider(5, range=1..10)
adjustpos_96 = AdjustElementPositioning(
    ElementsToAdjust=radiobtn_7,
    Margin="185,-50,0,10",
    AbsolutePositioning=False,
    Width=width_96,
    Height=height_93,
    HorizontalAlignment=Slider(0, range=0..100))
slider_13 = CreateSlider(Slider=revolutions_min, ShowBounds=False, ShowTicks=False, ShowTooltip=False, ShowValLabel=True, showLabel=True)
button_26 = CreateButton(ButtonName="Select the position of the end-effector", ButtonStyle=0)
button_27 = CreateButton(ButtonName="Unused, to be removed", ButtonStyle=0)
button_28 = CreateButton(ButtonName="Select the segment and motion control position", ButtonStyle=0)
height_100 = Slider(30, range=0..30)
width_103 = Slider(50, range=0..400)
button_29 = CreateButton(ButtonName="Select the target body  for embedding the unit", ButtonStyle=0)
adjustpos_97 = AdjustElementPositioning(
    ElementsToAdjust=button_26,
    Margin="70,-45,0,10",
    AbsolutePositioning=False,
    Width=width_98,
    Height=height_94,
    HorizontalAlignment=Slider(0, range=0..100))
radiobtn_8 = CreateRadioButton(RadioButtonName="Turn", RadioButtonGroup="MCM", InitiallySelected=False)
adjustpos_98 = AdjustElementPositioning(
    ElementsToAdjust=button_27,
    Margin="70,-45,0,10",
    AbsolutePositioning=False,
    Width=width_99,
    Height=height_96,
    HorizontalAlignment=Slider(0, range=0..100))
adjustpos_99 = AdjustElementPositioning(
    ElementsToAdjust=slider_13,
    Margin="20,-15,0,10",
    AbsolutePositioning=False,
    Width=width_97,
    Height=height_95,
    HorizontalAlignment=Slider(0, range=0..100))
slider_14 = CreateSlider(Slider=speed_min_4, ShowBounds=False, ShowTicks=False, ShowTooltip=False, ShowValLabel=True, showLabel=True)
adjustpos_100 = AdjustElementPositioning(
    ElementsToAdjust=button_28,
    Margin="70,-45,0,10",
    AbsolutePositioning=False,
    Width=width_100,
    Height=height_97,
    HorizontalAlignment=Slider(0, range=0..100))
label_45 = CreateLabel(LabelText="Max", LabelSize=12, Justification=0)
adjustpos_101 = AdjustElementPositioning(
    ElementsToAdjust=button_29,
    Margin="70,-45,0,10",
    AbsolutePositioning=False,
    Width=width_101,
    Height=height_98,
    HorizontalAlignment=Slider(0, range=0..100))
adjustpos_102 = AdjustElementPositioning(
    ElementsToAdjust=radiobtn_8,
    Margin="250,-50,0,10",
    AbsolutePositioning=False,
    Width=width_102,
    Height=height_99,
    HorizontalAlignment=Slider(0, range=0..100))
adjustpos_103 = AdjustElementPositioning(
    ElementsToAdjust=label_45,
    Margin="280,-60,0,5",
    AbsolutePositioning=False,
    Width=width_103,
    Height=height_100,
    HorizontalAlignment=Slider(0, range=0..100))
adjustelem_23 = AdjustElementAppearance(ElementsToAdjust=label_45, Background="255,255,255")
height_101 = Slider(30, range=0..30)
width_104 = Slider(50, range=0..400)
width_105 = Slider(290, range=0..400)
height_102 = Slider(40, range=0..60)
button_30 = CreateButton(ButtonName="Preview", ButtonStyle=0)
separatorheight_4 = Slider(10, range=0..10)
colour_7 = ColourPicker(PickedColour=RGB(230, 230, 230))
colour_8 = ColourPicker(PickedColour=RGB(51, 121, 200))
width_106 = Slider(400, range=0..1000)
label_46 = CreateLabel(LabelText="Max", LabelSize=12, Justification=0)
button_31 = CreateButton(ButtonName="Finish", ButtonStyle=0)
width_107 = Slider(80, range=0..1000)
height_103 = Slider(30, range=0..1000)
adjustpos_104 = AdjustElementPositioning(
    ElementsToAdjust=label_46,
    Margin="280,-45,0,5",
    AbsolutePositioning=False,
    Width=width_104,
    Height=height_101,
    HorizontalAlignment=Slider(0, range=0..100))
adjustelem_24 = AdjustElementAppearance(ElementsToAdjust=label_46, Background="255,255,255")
width_108 = Slider(80, range=0..1000)
height_104 = Slider(30, range=0..1000)
adjustpos_105 = AdjustElementPositioning(
    ElementsToAdjust=slider_14,
    Margin="20,10,0,5",
    AbsolutePositioning=False,
    Width=width_105,
    Height=height_102,
    HorizontalAlignment=Slider(0, range=0..100))
energy_min_4 = Slider(5, range=1..10)
titlesize_5 = Slider(15, range=0..30)
separator_4 = CreateSeparator(Thickness=0.5, Horizontal=True, Color=colour_7, Width=width_106, Height=separatorheight_4)
width_109 = Slider(290, range=0..400)
height_105 = Slider(30, range=0..30)
adjustpos_106 = AdjustElementPositioning(
    ElementsToAdjust=button_30,
    Margin="150,-45,0,10",
    AbsolutePositioning=False,
    Width=width_107,
    Height=height_103,
    HorizontalAlignment=Slider(0, range=0..100))
width_110 = Slider(566, range=0..1000)
height_106 = Slider(38, range=0..1000)
adjustpos_107 = AdjustElementPositioning(
    ElementsToAdjust=button_31,
    Margin="240,-45,0,10",
    AbsolutePositioning=False,
    Width=width_108,
    Height=height_104,
    HorizontalAlignment=Slider(0, range=0..100))
height_107 = Slider(35, range=0..1000)
width_111 = Slider(450, range=0..1000)
slider_15 = CreateSlider(Slider=energy_min_4, ShowBounds=False, ShowTicks=False, ShowTooltip=False, ShowValLabel=True, showLabel=True)
label_47 = CreateLabel(LabelText="Continuous Rotation Kinetic Unit", LabelSize=12, Justification=0)
adjustelem_25 = AdjustElementAppearance(ElementsToAdjust=label_47, Foreground=colour_8, FontSize=titlesize_5)
adjustpos_108 = AdjustElementPositioning(
    ElementsToAdjust=label_47,
    Margin="0,5,0,10",
    AbsolutePositioning=False,
    Width=width_110,
    Height=height_106,
    HorizontalAlignment=Slider(0, range=0..100))
checkbox_6 = CreateCheckbox(Label="Add a lock", StartingValue=False)
merge_4 = Merge(
    Data1=label_47,
    Data2=label_43,
    Data3=button_29,
    Data4=label_42,
    Data5=radiobtn_7,
    Data6=radiobtn_8,
    Data7=label_40,
    Data8=button_28,
    Data9=label_39,
    Data10=button_26,
    Data11=label_41,
    Data12=button_27,
    Data13=label_44,
    Data14=slider_14,
    Data15=label_45,
    Data16=slider_13,
    Data17=label_38,
    Data18=slider_15,
    Data19=label_46,
    Data20=checkbox,
    Data21=separator_4,
    Data22=checkbox_6,
    Data23=button_30,
    Data24=button_31)
stack_4 = CreateStack(UIElements=merge_4, Horizontal=Toggle(False))
hideshow_4 = HideShowElement(ElementToHideShow=stack_4, Show=motionselection.ConRotPanel, Collapse=Toggle(True), Disable=Toggle(False))
adjustpos_109 = AdjustElementPositioning(ElementsToAdjust=separator_4, Margin="5,-5,0,10", AbsolutePositioning=False)
adjustpos_110 = AdjustElementPositioning(
    ElementsToAdjust=slider_15,
    Margin="20,-10,0,10",
    AbsolutePositioning=False,
    Width=width_109,
    Height=height_105,
    HorizontalAlignment=Slider(0, range=0..100))
adjustpos_111 = AdjustElementPositioning(ElementsToAdjust=checkbox_6, Margin="15,0,0,10", AbsolutePositioning=False, Width=width_111, Height=height_107)

# ---- group: Contiunous Translation Kinetic Unit
font_size_25 = Slider(15, range=0..1000)
width_112 = Slider(300, range=0..1000)
font_size_26 = Slider(15, range=0..1000)
height_108 = Slider(35, range=0..1000)
width_113 = Slider(300, range=0..1000)
font_size_27 = Slider(15, range=0..1000)
height_109 = Slider(35, range=0..1000)
width_114 = Slider(300, range=0..1000)
height_110 = Slider(35, range=0..1000)
font_size_28 = Slider(15, range=0..1000)
width_115 = Slider(300, range=0..1000)
width_116 = Slider(300, range=0..1000)
font_size_29 = Slider(15, range=0..1000)
height_111 = Slider(35, range=0..1000)
font_size_30 = Slider(15, range=0..1000)
height_112 = Slider(35, range=0..1000)
height_113 = Slider(30, range=0..30)
width_117 = Slider(300, range=0..400)
height_114 = Slider(30, range=0..30)
width_118 = Slider(50, range=0..400)
label_48 = CreateLabel(LabelText="Max", LabelSize=12, Justification=0)
label_49 = CreateLabel(LabelText="Step3:", LabelSize=font_size_26, Justification=0)
adjustpos_112 = AdjustElementPositioning(
    ElementsToAdjust=label_49,
    Margin="10,0,0,10",
    AbsolutePositioning=False,
    Width=width_112,
    Height=height_108,
    HorizontalAlignment=Slider(0, range=0..100))
label_50 = CreateLabel(LabelText="Step2:", LabelSize=font_size_27, Justification=0)
adjustpos_113 = AdjustElementPositioning(
    ElementsToAdjust=label_50,
    Margin="10,-10,0,10",
    AbsolutePositioning=False,
    Width=width_113,
    Height=height_109,
    HorizontalAlignment=Slider(0, range=0..100))
label_51 = CreateLabel(LabelText="Step4:", LabelSize=font_size_28, Justification=0)
adjustpos_114 = AdjustElementPositioning(
    ElementsToAdjust=label_51,
    Margin="10,0,0,10",
    AbsolutePositioning=False,
    Width=width_114,
    Height=height_110,
    HorizontalAlignment=Slider(0, range=0..100))
label_52 = CreateLabel(LabelText="Motion control method:", LabelSize=font_size_29, Justification=0)
adjustpos_115 = AdjustElementPositioning(
    ElementsToAdjust=label_52,
    Margin="10,0,0,10",
    AbsolutePositioning=False,
    Width=width_115,
    Height=height_111,
    HorizontalAlignment=Slider(0, range=0..100))
label_53 = CreateLabel(LabelText="Step1:", LabelSize=font_size_30, Justification=0)
adjustpos_116 = AdjustElementPositioning(
    ElementsToAdjust=label_53,
    Margin="10,-10,0,10",
    AbsolutePositioning=False,
    Width=width_116,
    Height=height_112,
    HorizontalAlignment=Slider(0, range=0..100))
adjustpos_117 = AdjustElementPositioning(
    ElementsToAdjust=label_48,
    Margin="280,-45,0,5",
    AbsolutePositioning=False,
    Width=width_118,
    Height=height_114,
    HorizontalAlignment=Slider(0, range=0..100))
adjustelem_26 = AdjustElementAppearance(ElementsToAdjust=label_48, Background="255,255,255")
width_119 = Slider(100, range=0..1000)
height_115 = Slider(35, range=0..1000)
label_54 = CreateLabel(LabelText="Step5:   Adjust the motion characteristics", LabelSize=font_size_25, Justification=0)
adjustelem_27 = AdjustElementAppearance(ElementsToAdjust=label_54, Background="255,255,255")
adjustpos_118 = AdjustElementPositioning(
    ElementsToAdjust=label_54,
    Margin="10,5,0,0",
    AbsolutePositioning=False,
    Width=width_117,
    Height=height_113,
    HorizontalAlignment=Slider(0, range=0..100))
distance_min = Slider(5, range=1..10)
width_120 = Slider(240, range=0..1000)
height_116 = Slider(35, range=0..1000)
width_121 = Slider(290, range=0..400)
height_117 = Slider(30, range=0..30)
width_122 = Slider(240, range=0..1000)
height_118 = Slider(35, range=0..1000)
width_123 = Slider(240, range=0..1000)
height_119 = Slider(35, range=0..1000)
width_124 = Slider(240, range=0..1000)
height_120 = Slider(35, range=0..1000)
radiobtn_9 = CreateRadioButton(RadioButtonName="Press", RadioButtonGroup="MCM", InitiallySelected=False)
width_125 = Slider(100, range=0..1000)
height_121 = Slider(35, range=0..1000)
speed_min_5 = Slider(5, range=1..10)
adjustpos_119 = AdjustElementPositioning(
    ElementsToAdjust=radiobtn_9,
    Margin="185,-50,0,10",
    AbsolutePositioning=False,
    Width=width_119,
    Height=height_115,
    HorizontalAlignment=Slider(0, range=0..100))
button_32 = CreateButton(ButtonName="Select the position of the end-effector", ButtonStyle=0)
slider_16 = CreateSlider(Slider=distance_min, ShowBounds=False, ShowTicks=False, ShowTooltip=False, ShowValLabel=True, showLabel=True)
button_33 = CreateButton(ButtonName="Set the translation axis direction ", ButtonStyle=0)
button_34 = CreateButton(ButtonName="Select the segment and motion control position", ButtonStyle=0)
height_122 = Slider(30, range=0..30)
width_126 = Slider(50, range=0..400)
button_35 = CreateButton(ButtonName="Select the target body  for embedding the unit", ButtonStyle=0)
adjustpos_120 = AdjustElementPositioning(
    ElementsToAdjust=button_32,
    Margin="70,-45,0,10",
    AbsolutePositioning=False,
    Width=width_120,
    Height=height_116,
    HorizontalAlignment=Slider(0, range=0..100))
radiobtn_10 = CreateRadioButton(RadioButtonName="Turn", RadioButtonGroup="MCM", InitiallySelected=False)
adjustpos_121 = AdjustElementPositioning(
    ElementsToAdjust=button_33,
    Margin="70,-45,0,10",
    AbsolutePositioning=False,
    Width=width_122,
    Height=height_118,
    HorizontalAlignment=Slider(0, range=0..100))
slider_17 = CreateSlider(Slider=speed_min_5, ShowBounds=False, ShowTicks=False, ShowTooltip=False, ShowValLabel=True, showLabel=True)
adjustpos_122 = AdjustElementPositioning(
    ElementsToAdjust=slider_16,
    Margin="20,-15,0,10",
    AbsolutePositioning=False,
    Width=width_121,
    Height=height_117,
    HorizontalAlignment=Slider(0, range=0..100))
adjustpos_123 = AdjustElementPositioning(
    ElementsToAdjust=button_34,
    Margin="70,-45,0,10",
    AbsolutePositioning=False,
    Width=width_123,
    Height=height_119,
    HorizontalAlignment=Slider(0, range=0..100))
label_55 = CreateLabel(LabelText="Max", LabelSize=12, Justification=0)
adjustpos_124 = AdjustElementPositioning(
    ElementsToAdjust=button_35,
    Margin="70,-45,0,10",
    AbsolutePositioning=False,
    Width=width_124,
    Height=height_120,
    HorizontalAlignment=Slider(0, range=0..100))
adjustpos_125 = AdjustElementPositioning(
    ElementsToAdjust=radiobtn_10,
    Margin="250,-50,0,10",
    AbsolutePositioning=False,
    Width=width_125,
    Height=height_121,
    HorizontalAlignment=Slider(0, range=0..100))
adjustpos_126 = AdjustElementPositioning(
    ElementsToAdjust=label_55,
    Margin="280,-60,0,5",
    AbsolutePositioning=False,
    Width=width_126,
    Height=height_122,
    HorizontalAlignment=Slider(0, range=0..100))
adjustelem_28 = AdjustElementAppearance(ElementsToAdjust=label_55, Background="255,255,255")
width_127 = Slider(290, range=0..400)
height_123 = Slider(40, range=0..60)
height_124 = Slider(30, range=0..30)
width_128 = Slider(50, range=0..400)
separatorheight_5 = Slider(10, range=0..10)
colour_9 = ColourPicker(PickedColour=RGB(230, 230, 230))
colour_10 = ColourPicker(PickedColour=RGB(51, 121, 200))
button_36 = CreateButton(ButtonName="Preview", ButtonStyle=0)
width_129 = Slider(400, range=0..1000)
label_56 = CreateLabel(LabelText="Max", LabelSize=12, Justification=0)
width_130 = Slider(80, range=0..1000)
height_125 = Slider(30, range=0..1000)
width_131 = Slider(80, range=0..1000)
height_126 = Slider(30, range=0..1000)
adjustpos_127 = AdjustElementPositioning(
    ElementsToAdjust=slider_17,
    Margin="20,10,0,5",
    AbsolutePositioning=False,
    Width=width_127,
    Height=height_123,
    HorizontalAlignment=Slider(0, range=0..100))
button_37 = CreateButton(ButtonName="Finish", ButtonStyle=0)
adjustpos_128 = AdjustElementPositioning(
    ElementsToAdjust=label_56,
    Margin="280,-45,0,5",
    AbsolutePositioning=False,
    Width=width_128,
    Height=height_124,
    HorizontalAlignment=Slider(0, range=0..100))
adjustelem_29 = AdjustElementAppearance(ElementsToAdjust=label_56, Background="255,255,255")
titlesize_6 = Slider(15, range=0..30)
separator_5 = CreateSeparator(Thickness=0.5, Horizontal=True, Color=colour_9, Width=width_129, Height=separatorheight_5)
energy_min_5 = Slider(5, range=1..10)
adjustpos_129 = AdjustElementPositioning(
    ElementsToAdjust=button_36,
    Margin="150,-45,0,10",
    AbsolutePositioning=False,
    Width=width_130,
    Height=height_125,
    HorizontalAlignment=Slider(0, range=0..100))
width_132 = Slider(290, range=0..400)
height_127 = Slider(30, range=0..30)
width_133 = Slider(566, range=0..1000)
height_128 = Slider(38, range=0..1000)
adjustpos_130 = AdjustElementPositioning(
    ElementsToAdjust=button_37,
    Margin="240,-45,0,10",
    AbsolutePositioning=False,
    Width=width_131,
    Height=height_126,
    HorizontalAlignment=Slider(0, range=0..100))
height_129 = Slider(35, range=0..1000)
width_134 = Slider(450, range=0..1000)
slider_18 = CreateSlider(Slider=energy_min_5, ShowBounds=False, ShowTicks=False, ShowTooltip=False, ShowValLabel=True, showLabel=True)
label_57 = CreateLabel(LabelText="Continuous Translation Kinetic Unit", LabelSize=12, Justification=0)
adjustelem_30 = AdjustElementAppearance(ElementsToAdjust=label_57, Foreground=colour_10, FontSize=titlesize_6)
adjustpos_131 = AdjustElementPositioning(
    ElementsToAdjust=label_57,
    Margin="0,5,0,10",
    AbsolutePositioning=False,
    Width=width_133,
    Height=height_128,
    HorizontalAlignment=Slider(0, range=0..100))
checkbox_7 = CreateCheckbox(Label="Add a lock", StartingValue=False)
merge_5 = Merge(
    Data1=label_57,
    Data2=label_53,
    Data3=button_35,
    Data4=label_52,
    Data5=radiobtn_9,
    Data6=radiobtn_10,
    Data7=label_50,
    Data8=button_34,
    Data9=label_49,
    Data10=button_32,
    Data11=label_51,
    Data12=button_33,
    Data13=label_54,
    Data14=slider_17,
    Data15=label_55,
    Data16=slider_16,
    Data17=label_48,
    Data18=slider_18,
    Data19=label_56,
    Data20=separator_5,
    Data21=checkbox_7,
    Data22=button_36,
    Data23=button_37)
stack_5 = CreateStack(UIElements=merge_5, Horizontal=Toggle(False))
adjustpos_132 = AdjustElementPositioning(ElementsToAdjust=separator_5, Margin="5,-5,0,10", AbsolutePositioning=False)
hideshow_5 = HideShowElement(ElementToHideShow=stack_5, Show=motionselection.ConTransPanel, Collapse=Toggle(True), Disable=Toggle(False))
adjustpos_133 = AdjustElementPositioning(
    ElementsToAdjust=slider_18,
    Margin="20,-5,0,10",
    AbsolutePositioning=False,
    Width=width_132,
    Height=height_127,
    HorizontalAlignment=Slider(0, range=0..100))
adjustpos_134 = AdjustElementPositioning(ElementsToAdjust=checkbox_7, Margin="15,0,0,10", AbsolutePositioning=False, Width=width_134, Height=height_129)

# ---- group: Instant Rotation Unit
font_size_31 = Slider(15, range=0..1000)
height_130 = Slider(30, range=0..30)
width_135 = Slider(300, range=0..400)
width_136 = Slider(300, range=0..1000)
font_size_32 = Slider(15, range=0..1000)
height_131 = Slider(35, range=0..1000)
width_137 = Slider(300, range=0..1000)
height_132 = Slider(35, range=0..1000)
width_138 = Slider(300, range=0..1000)
font_size_33 = Slider(15, range=0..1000)
font_size_34 = Slider(15, range=0..1000)
height_133 = Slider(35, range=0..1000)
label_58 = CreateLabel(LabelText="Step4:   Adjust the motion characteristics", LabelSize=font_size_31, Justification=0)
adjustelem_31 = AdjustElementAppearance(ElementsToAdjust=label_58, Background="255,255,255")
adjustpos_135 = AdjustElementPositioning(
    ElementsToAdjust=label_58,
    Margin="10,5,0,0",
    AbsolutePositioning=False,
    Width=width_135,
    Height=height_130,
    HorizontalAlignment=Slider(0, range=0..100))
label_59 = CreateLabel(LabelText="Step3:", LabelSize=font_size_32, Justification=0)
adjustpos_136 = AdjustElementPositioning(
    ElementsToAdjust=label_59,
    Margin="10,5,0,10",
    AbsolutePositioning=False,
    Width=width_136,
    Height=height_131,
    HorizontalAlignment=Slider(0, range=0..100))
label_60 = CreateLabel(LabelText="Step2:", LabelSize=font_size_33, Justification=0)
adjustpos_137 = AdjustElementPositioning(
    ElementsToAdjust=label_60,
    Margin="10,0,0,10",
    AbsolutePositioning=False,
    Width=width_137,
    Height=height_132,
    HorizontalAlignment=Slider(0, range=0..100))
label_61 = CreateLabel(LabelText="Step1:", LabelSize=font_size_34, Justification=0)
adjustpos_138 = AdjustElementPositioning(
    ElementsToAdjust=label_61,
    Margin="10,-10,0,10",
    AbsolutePositioning=False,
    Width=width_138,
    Height=height_133,
    HorizontalAlignment=Slider(0, range=0..100))
height_134 = Slider(30, range=0..30)
width_139 = Slider(50, range=0..400)
label_62 = CreateLabel(LabelText="Max", LabelSize=12, Justification=0)
width_140 = Slider(240, range=0..1000)
width_141 = Slider(240, range=0..1000)
height_135 = Slider(35, range=0..1000)
height_136 = Slider(35, range=0..1000)
width_142 = Slider(240, range=0..1000)
height_137 = Slider(35, range=0..1000)
adjustpos_139 = AdjustElementPositioning(
    ElementsToAdjust=label_62,
    Margin="280,-45,0,5",
    AbsolutePositioning=False,
    Width=width_139,
    Height=height_134,
    HorizontalAlignment=Slider(0, range=0..100))
adjustelem_32 = AdjustElementAppearance(ElementsToAdjust=label_62, Background="255,255,255")
height_138 = Slider(30, range=0..30)
width_143 = Slider(50, range=0..400)
checkbox_8 = CreateCheckbox(Label=" Reverse instant rotation direction", StartingValue=False)
button_38 = CreateButton(ButtonName="Select the end-effector", ButtonStyle=0)
button_39 = CreateButton(ButtonName="Select the rotation axis and the segment", ButtonStyle=0)
button_40 = CreateButton(ButtonName="Select the target body  for embedding the unit", ButtonStyle=0)
label_63 = CreateLabel(LabelText="Max", LabelSize=12, Justification=0)
revolutions_min_2 = Slider(5, range=1..10)
width_144 = Slider(280, range=0..400)
height_139 = Slider(40, range=0..60)
adjustpos_140 = AdjustElementPositioning(
    ElementsToAdjust=label_63,
    Margin="280,-45,0,5",
    AbsolutePositioning=False,
    Width=width_143,
    Height=height_138,
    HorizontalAlignment=Slider(0, range=0..100))
adjustpos_141 = AdjustElementPositioning(
    ElementsToAdjust=button_40,
    Margin="70,-45,0,10",
    AbsolutePositioning=False,
    Width=width_142,
    Height=height_137,
    HorizontalAlignment=Slider(0, range=0..100))
adjustelem_33 = AdjustElementAppearance(ElementsToAdjust=label_63, Background="255,255,255")
adjustpos_142 = AdjustElementPositioning(
    ElementsToAdjust=button_38,
    Margin="70,-45,0,10",
    AbsolutePositioning=False,
    Width=width_140,
    Height=height_135,
    HorizontalAlignment=Slider(0, range=0..100))
adjustpos_143 = AdjustElementPositioning(
    ElementsToAdjust=button_39,
    Margin="70,-45,0,10",
    AbsolutePositioning=False,
    Width=width_141,
    Height=height_136,
    HorizontalAlignment=Slider(0, range=0..100))
energy_min_6 = Slider(5, range=1..10)
slider_19 = CreateSlider(Slider=revolutions_min_2, ShowBounds=False, ShowTicks=False, ShowTooltip=False, ShowValLabel=True, showLabel=True)
colour_11 = ColourPicker(PickedColour=RGB(51, 121, 200))
width_145 = Slider(290, range=0..400)
height_140 = Slider(30, range=0..30)
adjustpos_144 = AdjustElementPositioning(
    ElementsToAdjust=checkbox_8,
    Margin="25,-15,0,0",
    AbsolutePositioning=False,
    Width=width_144,
    Height=height_139,
    HorizontalAlignment=Slider(0, range=0..100))
width_146 = Slider(290, range=0..400)
height_141 = Slider(40, range=0..60)
slider_20 = CreateSlider(Slider=energy_min_6, ShowBounds=False, ShowTicks=False, ShowTooltip=False, ShowValLabel=True, showLabel=True)
titlesize_7 = Slider(15, range=0..30)
width_147 = Slider(566, range=0..1000)
height_142 = Slider(38, range=0..1000)
adjustpos_145 = AdjustElementPositioning(
    ElementsToAdjust=slider_20,
    Margin="20,-15,0,10",
    AbsolutePositioning=False,
    Width=width_145,
    Height=height_140,
    HorizontalAlignment=Slider(0, range=0..100))
adjustpos_146 = AdjustElementPositioning(
    ElementsToAdjust=slider_19,
    Margin="20,10,0,5",
    AbsolutePositioning=False,
    Width=width_146,
    Height=height_141,
    HorizontalAlignment=Slider(0, range=0..100))
colour_12 = ColourPicker(PickedColour=RGB(230, 230, 230))
separatorheight_6 = Slider(10, range=0..10)
button_41 = CreateButton(ButtonName="Preview", ButtonStyle=0)
width_148 = Slider(400, range=0..1000)
label_64 = CreateLabel(LabelText="Instant Rotation Kinetic Unit", LabelSize=12, Justification=0)
adjustelem_34 = AdjustElementAppearance(ElementsToAdjust=label_64, Foreground=colour_11, FontSize=titlesize_7)
adjustpos_147 = AdjustElementPositioning(
    ElementsToAdjust=label_64,
    Margin="0,5,0,10",
    AbsolutePositioning=False,
    Width=width_147,
    Height=height_142,
    HorizontalAlignment=Slider(0, range=0..100))
width_149 = Slider(80, range=0..1000)
height_143 = Slider(30, range=0..1000)
width_150 = Slider(450, range=0..1000)
height_144 = Slider(35, range=0..1000)
checkbox_9 = CreateCheckbox(Label="Add a lock", StartingValue=False)
width_151 = Slider(80, range=0..1000)
height_145 = Slider(30, range=0..1000)
button_42 = CreateButton(ButtonName="Finish", ButtonStyle=0)
separator_6 = CreateSeparator(Thickness=0.5, Horizontal=True, Color=colour_12, Width=width_148, Height=separatorheight_6)
adjustpos_148 = AdjustElementPositioning(
    ElementsToAdjust=button_41,
    Margin="150,-45,0,10",
    AbsolutePositioning=False,
    Width=width_149,
    Height=height_143,
    HorizontalAlignment=Slider(0, range=0..100))
merge_6 = Merge(
    Data2=label_64,
    Data3=label_61,
    Data4=button_40,
    Data5=label_60,
    Data6=button_39,
    Data7=label_59,
    Data8=button_38,
    Data9=label_58,
    Data10=slider_19,
    Data11=label_63,
    Data12=slider_20,
    Data13=label_62,
    Data14=checkbox_8,
    Data16=separator_6,
    Data17=checkbox_9,
    Data18=button_41,
    Data19=button_42)
adjustpos_149 = AdjustElementPositioning(ElementsToAdjust=checkbox_9, Margin="15,15,0,10", AbsolutePositioning=False, Width=width_150, Height=height_144)
stack_6 = CreateStack(UIElements=merge_6, Horizontal=Toggle(False))
adjustpos_150 = AdjustElementPositioning(
    ElementsToAdjust=button_42,
    Margin="240,-45,0,10",
    AbsolutePositioning=False,
    Width=width_151,
    Height=height_145,
    HorizontalAlignment=Slider(0, range=0..100))
hideshow_6 = HideShowElement(ElementToHideShow=stack_6, Show=motionselection.InsRotationPanel, Collapse=Toggle(True), Disable=Toggle(False))

# ---- group: Instant Translation Kinetic Unit
font_size_35 = Slider(15, range=0..1000)
width_152 = Slider(300, range=0..1000)
height_146 = Slider(35, range=0..1000)
height_147 = Slider(30, range=0..30)
font_size_36 = Slider(15, range=0..1000)
width_153 = Slider(300, range=0..400)
width_154 = Slider(300, range=0..1000)
height_148 = Slider(35, range=0..1000)
font_size_37 = Slider(15, range=0..1000)
width_155 = Slider(300, range=0..1000)
height_149 = Slider(35, range=0..1000)
font_size_38 = Slider(15, range=0..1000)
label_65 = CreateLabel(LabelText="Step4:", LabelSize=font_size_36, Justification=0)
adjustpos_151 = AdjustElementPositioning(
    ElementsToAdjust=label_65,
    Margin="10,5,0,10",
    AbsolutePositioning=False,
    Width=width_152,
    Height=height_146,
    HorizontalAlignment=Slider(0, range=0..100))
label_66 = CreateLabel(LabelText="Step2:", LabelSize=font_size_37, Justification=0)
adjustpos_152 = AdjustElementPositioning(
    ElementsToAdjust=label_66,
    Margin="10,5,0,10",
    AbsolutePositioning=False,
    Width=width_154,
    Height=height_148,
    HorizontalAlignment=Slider(0, range=0..100))
label_67 = CreateLabel(LabelText="Step3:   Adjust the motion characteristics", LabelSize=font_size_35, Justification=0)
adjustelem_35 = AdjustElementAppearance(ElementsToAdjust=label_67, Background="255,255,255")
adjustpos_153 = AdjustElementPositioning(
    ElementsToAdjust=label_67,
    Margin="10,5,0,0",
    AbsolutePositioning=False,
    Width=width_153,
    Height=height_147,
    HorizontalAlignment=Slider(0, range=0..100))
label_68 = CreateLabel(LabelText="Step1:", LabelSize=font_size_38, Justification=0)
adjustpos_154 = AdjustElementPositioning(
    ElementsToAdjust=label_68,
    Margin="10,-10,0,10",
    AbsolutePositioning=False,
    Width=width_155,
    Height=height_149,
    HorizontalAlignment=Slider(0, range=0..100))
width_156 = Slider(566, range=0..1000)
height_150 = Slider(38, range=0..1000)
width_157 = Slider(240, range=0..1000)
width_158 = Slider(240, range=0..1000)
height_151 = Slider(35, range=0..1000)
height_152 = Slider(35, range=0..1000)
height_153 = Slider(30, range=0..30)
width_159 = Slider(50, range=0..400)
width_160 = Slider(240, range=0..1000)
height_154 = Slider(35, range=0..1000)
label_69 = CreateLabel(LabelText="Max", LabelSize=12, Justification=0)
label_70 = CreateLabel(LabelText="Instant Translation Kinetic Unit", LabelSize=12, Justification=0)
adjustpos_155 = AdjustElementPositioning(
    ElementsToAdjust=label_69,
    Margin="280,-35,0,5",
    AbsolutePositioning=False,
    Width=width_159,
    Height=height_153,
    HorizontalAlignment=Slider(0, range=0..100))
button_43 = CreateButton(ButtonName="Select the end-effector", ButtonStyle=0)
adjustelem_36 = AdjustElementAppearance(ElementsToAdjust=label_69, Background="255,255,255")
button_44 = CreateButton(ButtonName="Select the target body", ButtonStyle=0)
button_45 = CreateButton(ButtonName="Select the translation axis and the segment", ButtonStyle=0)
adjustpos_156 = AdjustElementPositioning(
    ElementsToAdjust=button_44,
    Margin="70,-45,0,10",
    AbsolutePositioning=False,
    Width=width_160,
    Height=height_154,
    HorizontalAlignment=Slider(0, range=0..100))
adjustpos_157 = AdjustElementPositioning(
    ElementsToAdjust=label_70,
    Margin="0,5,0,10",
    AbsolutePositioning=False,
    Width=width_156,
    Height=height_150,
    HorizontalAlignment=Slider(0, range=0..100))
adjustpos_158 = AdjustElementPositioning(
    ElementsToAdjust=button_43,
    Margin="70,-45,0,10",
    AbsolutePositioning=False,
    Width=width_157,
    Height=height_151,
    HorizontalAlignment=Slider(0, range=0..100))
energy_min_7 = Slider(4, range=0..9)
adjustpos_159 = AdjustElementPositioning(
    ElementsToAdjust=button_45,
    Margin="70,-50,0,10",
    AbsolutePositioning=False,
    Width=width_158,
    Height=height_152,
    HorizontalAlignment=Slider(0, range=0..100))
displacement_min_2 = Slider(4, range=0..9)
height_155 = Slider(30, range=0..30)
width_161 = Slider(50, range=0..400)
width_162 = Slider(280, range=0..400)
colour_13 = ColourPicker(PickedColour=RGB(51, 121, 200))
height_156 = Slider(30, range=0..30)
width_163 = Slider(280, range=0..400)
height_157 = Slider(30, range=0..30)
label_71 = CreateLabel(LabelText="Max", LabelSize=12, Justification=0)
slider_21 = CreateSlider(Slider=energy_min_7, ShowBounds=False, ShowTicks=False, ShowTooltip=False, ShowValLabel=True, showLabel=True)
adjustpos_160 = AdjustElementPositioning(
    ElementsToAdjust=label_71,
    Margin="280,-45,0,5",
    AbsolutePositioning=False,
    Width=width_161,
    Height=height_155,
    HorizontalAlignment=Slider(0, range=0..100))
adjustelem_37 = AdjustElementAppearance(ElementsToAdjust=label_71, Background="255,255,255")
slider_22 = CreateSlider(Slider=displacement_min_2, ShowBounds=False, ShowTicks=False, ShowTooltip=False, ShowValLabel=True, showLabel=True)
titlesize_8 = Slider(15, range=0..30)
adjustpos_161 = AdjustElementPositioning(
    ElementsToAdjust=slider_22,
    Margin="20,5,0,10",
    AbsolutePositioning=False,
    Width=width_162,
    Height=height_156,
    HorizontalAlignment=Slider(0, range=0..100))
adjustpos_162 = AdjustElementPositioning(
    ElementsToAdjust=slider_21,
    Margin="20,0,0,5",
    AbsolutePositioning=False,
    Width=width_163,
    Height=height_157,
    HorizontalAlignment=Slider(0, range=0..100))
adjustelem_38 = AdjustElementAppearance(ElementsToAdjust=label_70, Foreground=colour_13, FontSize=titlesize_8)
colour_14 = ColourPicker(PickedColour=RGB(230, 230, 230))
separatorheight_7 = Slider(10, range=0..10)
width_164 = Slider(400, range=0..1000)
button_46 = CreateButton(ButtonName="Preview", ButtonStyle=0)
width_165 = Slider(80, range=0..1000)
height_158 = Slider(30, range=0..1000)
width_166 = Slider(450, range=0..1000)
checkbox_10 = CreateCheckbox(Label="Add a lock", StartingValue=False)
height_159 = Slider(35, range=0..1000)
width_167 = Slider(80, range=0..1000)
height_160 = Slider(30, range=0..1000)
button_47 = CreateButton(ButtonName="Finish", ButtonStyle=0)
separator_7 = CreateSeparator(Thickness=0.5, Horizontal=True, Color=colour_14, Width=width_164, Height=separatorheight_7)
merge_7 = Merge(
    Data2=label_70,
    Data3=label_68,
    Data4=button_44,
    Data5=label_66,
    Data6=button_45,
    Data7=label_67,
    Data8=slider_22,
    Data9=label_71,
    Data10=slider_21,
    Data11=label_69,
    Data12=label_65,
    Data13=button_43,
    Data19=separator_7,
    Data20=checkbox_10,
    Data21=button_46,
    Data22=button_47)
adjustpos_163 = AdjustElementPositioning(
    ElementsToAdjust=button_46,
    Margin="140,-45,0,10",
    AbsolutePositioning=False,
    Width=width_165,
    Height=height_158,
    HorizontalAlignment=Slider(0, range=0..100))
stack_7 = CreateStack(UIElements=merge_7, Horizontal=Toggle(False))
adjustpos_164 = AdjustElementPositioning(ElementsToAdjust=checkbox_10, Margin="10,5,0,10", AbsolutePositioning=False, Width=width_166, Height=height_159)
adjustpos_165 = AdjustElementPositioning(
    ElementsToAdjust=button_47,
    Margin="230,-45,0,10",
    AbsolutePositioning=False,
    Width=width_167,
    Height=height_160,
    HorizontalAlignment=Slider(0, range=0..100))
hideshow_7 = HideShowElement(ElementToHideShow=stack_7, Show=motionselection.InsTransPanel, Collapse=Toggle(True), Disable=Toggle(False))

# ---- group: Default Control Panel
width_168 = Slider(860, range=0..1000)
height_161 = Slider(35, range=0..1000)
colour_15 = ColourPicker(PickedColour=RGB(200, 200, 200))
label_72 = CreateLabel(LabelText="Please select a target motion...", LabelSize=12, Justification=0)
adjustpos_166 = AdjustElementPositioning(
    ElementsToAdjust=label_72,
    Margin="75,100,0,10",
    AbsolutePositioning=False,
    Width=width_168,
    Height=height_161,
    HorizontalAlignment=Slider(0, range=0..100))
stack_8 = CreateStack(UIElements=label_72, Horizontal=Toggle(False))
adjustelem_39 = AdjustElementAppearance(ElementsToAdjust=label_72, Foreground=colour_15)
hideshow_8 = HideShowElement(ElementToHideShow=stack_8, Show=motionselection.DefaultPanel, Collapse=Toggle(True), Disable=Toggle(False))

# ----
energylistener = ValueListener(Elements=slider_9, SomeProperty=True)  # -> Values, Indices
energylistener_2 = ValueListener(Elements=slider_15, SomeProperty=True)  # -> Values, Indices
energylistener_3 = ValueListener(Elements=slider_7, SomeProperty=True)  # -> Values, Indices
seteepos = ValueListener(Elements=button_20, SomeProperty=True)  # -> Values, Indices
setreciprocationdir = ValueListener(Elements=button_21, SomeProperty=True)  # -> Values, Indices
enregylistener = ValueListener(Elements=slider, SomeProperty=True)  # -> Values, Indices
values_turn_selected = ValueListener(Elements=radiobtn_6, SomeProperty=True)  # -> Values, Indices
selectcontrolpos = ValueListener(Elements=button_22, SomeProperty=True)  # -> Values, Indices
regionselectionlistener = ValueListener(Elements=button_23, SomeProperty=True)  # -> Values, Indices
values_press_selected = ValueListener(Elements=radiobtn_5, SomeProperty=True)  # -> Values, Indices
speedlistener = ValueListener(Elements=slider_11, SomeProperty=True)  # -> Values, Indices
amplitudelistener = ValueListener(Elements=slider_10, SomeProperty=True)  # -> Values, Indices
previewlistener = ValueListener(Elements=button_24, SomeProperty=True)  # -> Values, Indices
addlocklistener = ValueListener(Elements=checkbox_5, SomeProperty=True)  # -> Values, Indices
bakelistener = ValueListener(Elements=button_25, SomeProperty=True)  # -> Values, Indices
strokelistener = ValueListener(Elements=slider_12, SomeProperty=True)  # -> Values, Indices
panel_8 = Panel(motionselection.RecipPanel)
seteepos_2 = ValueListener(Elements=button_14, SomeProperty=True)  # -> Values, Indices
setreciprocationdir_2 = ValueListener(Elements=button_15, SomeProperty=True)  # -> Values, Indices
values_turn_selected_2 = ValueListener(Elements=radiobtn_4, SomeProperty=True)  # -> Values, Indices
setcontrolpos = ValueListener(Elements=button_28, SomeProperty=True)  # -> Values, Indices
selectcontrolpos_2 = ValueListener(Elements=button_16, SomeProperty=True)  # -> Values, Indices
values_press_selected_2 = ValueListener(Elements=radiobtn_7, SomeProperty=True)  # -> Values, Indices
seteepos_3 = ValueListener(Elements=button_26, SomeProperty=True)  # -> Values, Indices
bakelistener_2 = ValueListener(Elements=button_31, SomeProperty=True)  # -> Values, Indices
values_turn_selected_3 = ValueListener(Elements=radiobtn_8, SomeProperty=True)  # -> Values, Indices
regionselectionlistener_2 = ValueListener(Elements=button_29, SomeProperty=True)  # -> Values, Indices
previewlistener_2 = ValueListener(Elements=button_30, SomeProperty=True)  # -> Values, Indices
setrotationaxisdir = ValueListener(Elements=button_27, SomeProperty=True)  # -> Values, Indices
regionselectionlistener_3 = ValueListener(Elements=button_17, SomeProperty=True)  # -> Values, Indices
values_press_selected_3 = ValueListener(Elements=radiobtn_3, SomeProperty=True)  # -> Values, Indices
setmotioninputpos = ValueListener(Elements=button_34, SomeProperty=True)  # -> Values, Indices
energylistener_4 = ValueListener(Elements=slider_18, SomeProperty=True)  # -> Values, Indices
seteepos_4 = ValueListener(Elements=button_32, SomeProperty=True)  # -> Values, Indices
speedlistener_2 = ValueListener(Elements=slider_6, SomeProperty=True)  # -> Values, Indices
regionselectionlistener_4 = ValueListener(Elements=button_35, SomeProperty=True)  # -> Values, Indices
rangelistener = ValueListener(Elements=slider_5, SomeProperty=True)  # -> Values, Indices
values_press_selected_4 = ValueListener(Elements=radiobtn_9, SomeProperty=True)  # -> Values, Indices
speedlistener_3 = ValueListener(Elements=slider_14, SomeProperty=True)  # -> Values, Indices
revolutionlistener = ValueListener(Elements=slider_13, SomeProperty=True)  # -> Values, Indices
values_turn_selected_4 = ValueListener(Elements=radiobtn_10, SomeProperty=True)  # -> Values, Indices
settransaxisdir = ValueListener(Elements=button_33, SomeProperty=True)  # -> Values, Indices
addlocklistener_2 = ValueListener(Elements=checkbox_6, SomeProperty=True)  # -> Values, Indices
distancelistener = ValueListener(Elements=slider_16, SomeProperty=True)  # -> Values, Indices
speedlistener_4 = ValueListener(Elements=slider_17, SomeProperty=True)  # -> Values, Indices
addlocklistener_3 = ValueListener(Elements=checkbox_4, SomeProperty=True)  # -> Values, Indices
previewlistener_3 = ValueListener(Elements=button_18, SomeProperty=True)  # -> Values, Indices
bakelistener_3 = ValueListener(Elements=button_19, SomeProperty=True)  # -> Values, Indices
seteepos_5 = ValueListener(Elements=button_8, SomeProperty=True)  # -> Values, Indices
setreciprocationdir_3 = ValueListener(Elements=button_9, SomeProperty=True)  # -> Values, Indices
values_turn_selected_5 = ValueListener(Elements=radiobtn_2, SomeProperty=True)  # -> Values, Indices
selectcontrolpos_3 = ValueListener(Elements=button_10, SomeProperty=True)  # -> Values, Indices
strokelistener_2 = ValueListener(Elements=slider_8, SomeProperty=True)  # -> Values, Indices
regionselectionlistener_5 = ValueListener(Elements=button_11, SomeProperty=True)  # -> Values, Indices
values_press_selected_5 = ValueListener(Elements=radiobtn, SomeProperty=True)  # -> Values, Indices
speedlistener_5 = ValueListener(Elements=slider_3, SomeProperty=True)  # -> Values, Indices
bakelistener_4 = ValueListener(Elements=button_13, SomeProperty=True)  # -> Values, Indices
intervalanglelistener = ValueListener(Elements=slider_2, SomeProperty=True)  # -> Values, Indices
previewlistener_4 = ValueListener(Elements=button_12, SomeProperty=True)  # -> Values, Indices
addlocklistener_4 = ValueListener(Elements=checkbox_3, SomeProperty=True)  # -> Values, Indices
strokelistener_3 = ValueListener(Elements=slider_4, SomeProperty=True)  # -> Values, Indices
addlocklistener_5 = ValueListener(Elements=checkbox_7, SomeProperty=True)  # -> Values, Indices
previewlistener_5 = ValueListener(Elements=button_36, SomeProperty=True)  # -> Values, Indices
bakelistener_5 = ValueListener(Elements=button_37, SomeProperty=True)  # -> Values, Indices
python_8 = GhPythonScript(x=values_press_selected.Values, y=values_turn_selected.Values)  # -> out, a
# ---------- python_8: Python ----------
__author__ = "ediga"
__version__ = "2021.08.18"

import rhinoscriptsyntax as rs

if x == False and y == False:
    a = 0
elif x == True and y == False:
    a = 1
elif x == False and y == True:
    a = 2
else:
    a = 0
# ---------- end python_8 ----------
setregionvaluelistener = ValueListener(Elements=button_44, SomeProperty=True)  # -> Values, Indices
translationaxislistener = ValueListener(Elements=button_45, SomeProperty=True)  # -> Values, Indices
bakelistener_6 = ValueListener(Elements=button_47, SomeProperty=True)  # -> Values, Indices
python_9 = GhPythonScript(x=values_press_selected_3.Values, y=values_turn_selected_2.Values)  # -> out, a; same code as python_8
lockvaluelistener = ValueListener(Elements=checkbox_10, SomeProperty=True)  # -> Values, Indices
displacementvaluelistener = ValueListener(Elements=slider_22, SomeProperty=True)  # -> Values, Indices
previewvaluelistener = ValueListener(Elements=button_46, SomeProperty=True)  # -> Values, Indices
python_10 = GhPythonScript(x=values_press_selected_2.Values, y=values_turn_selected_3.Values)  # -> out, a; same code as python_8
strengthlistener = ValueListener(Elements=slider_20, SomeProperty=True)  # -> Values, Indices
addlocklistener_6 = ValueListener(Elements=checkbox_9, SomeProperty=True)  # -> Values, Indices
python_11 = GhPythonScript(x=values_press_selected_4.Values, y=values_turn_selected_4.Values)  # -> out, a; same code as python_8
bakelistener_7 = ValueListener(Elements=button_42, SomeProperty=True)  # -> Values, Indices
python_12 = GhPythonScript(x=values_press_selected_5.Values, y=values_turn_selected_5.Values)  # -> out, a; same code as python_8
rotationdirectionreverse_3 = ValueListener(Elements=checkbox_8, SomeProperty=True)  # -> Values, Indices
regionselectionlistener_6 = ValueListener(Elements=button_40, SomeProperty=True)  # -> Values, Indices
setendeffectorvaluelistener = ValueListener(Elements=button_43, SomeProperty=True)  # -> Values, Indices
energyvaluelistener = ValueListener(Elements=slider_21, SomeProperty=True)  # -> Values, Indices
rotationaxis = ValueListener(Elements=button_39, SomeProperty=True)  # -> Values, Indices
endeffectorselectionlistener = ValueListener(Elements=button_38, SomeProperty=True)  # -> Values, Indices
anglelistener = ValueListener(Elements=slider_19, SomeProperty=True)  # -> Values, Indices
previewlistener_6 = ValueListener(Elements=button_41, SomeProperty=True)  # -> Values, Indices
itmoudle = InstantTranslationModule(
    RegionSelection=setregionvaluelistener.Values,
    AxisSelection=translationaxislistener.Values,
    EndeffectorSetting=setendeffectorvaluelistener.Values,
    AddLock=lockvaluelistener.Values,
    Preview=previewvaluelistener.Values,
    CompressionDisplacement=displacementvaluelistener.Values,
    Energy=energyvaluelistener.Values,
    ComponentsBake=bakelistener_6.Values)  # -> KineticUnit, Models, PreviewLauncher
crmodule = ContinuousRotationModule(
    RegionSelection=regionselectionlistener_2.Values,
    MotionControlMethod=python_10.a,
    SetMotionControlPos=setcontrolpos.Values,
    SetEEPos=seteepos_3.Values,
    SetAxisDir=setrotationaxisdir.Values,
    AddLock=addlocklistener_2.Values,
    Preview=previewlistener_2.Values,
    Speed=speedlistener_3.Values,
    Rounds=revolutionlistener.Values,
    Energy=energylistener_2.Values,
    ComponentsBake=bakelistener_2.Values,
    DirectionReverse=rotationdirectionreverse.Values)  # -> KineticUnit, Models, PreviewLauncher

# ---- group: Simulation for Instant Translation
height_162 = Slider(500, range=0..900)
width_169 = Slider(400, range=0..1440)
sph = Sphere(Base=PlaneXY(0, 0, 0), Radius=1)
button_48 = CreateButton(ButtonName="Load motion", ButtonStyle=0)
button_49 = CreateButton(ButtonName="Release", ButtonStyle=0)
_3dview = Create3DView(MeshToDisplay=sph, MeshColors=RGB(255, 0, 0), ViewWidth=width_169, ViewHeight=height_162)
merge_8 = Merge(Data1=button_48, Data2=button_49)
stack_9 = CreateStack(UIElements=merge_8, Horizontal=True)
rgb = ColourRGB(Alpha=255, Red="255", Green=0, Blue=0)
values_8 = ValueListener(Elements=button_49, SomeProperty=True)  # -> Values, Indices
values_9 = ValueListener(Elements=button_48, SomeProperty=True)  # -> Values, Indices
merge_9 = Merge(Data1=_3dview, Data2=stack_9)
height_163 = Slider(700, range=0..900)
width_170 = Slider(500, range=0..1440)
kms = KinergyMotionSimulatorForHumanUI(
    _3DView=_3dview,
    KineticUnitToSimulate=crmodule.KineticUnit,
    MeshColors=rgb,
    Start=crmodule.PreviewLauncher,
    Load=values_9.Values,
    Release=values_8.Values)
launchwin = LaunchWindow(
    Show=crmodule.PreviewLauncher,
    Name="Kinergy Preview Window",
    Width=width_170,
    Height=height_163,
    ChildStatus=0,
    EnableHorizScroll=False)
addelems = AddElements(Window=launchwin, Elements=flatten(merge_9), DoVLChecking=True)  # -> AddedElements, ElementNames

# ----
irmodule = IntermittentRotationModule(
    RegionSelection=regionselectionlistener_5.Values,
    MotionControlMethod=python_12.a,
    SetMotionControlPos=selectcontrolpos_3.Values,
    SetEEPos=seteepos_5.Values,
    SetAxisDir=setreciprocationdir_3.Values,
    AddLock=addlocklistener_4.Values,
    Preview=previewlistener_4.Values,
    Speed=speedlistener_5.Values,
    IntervalRotationAngle=intervalanglelistener.Values,
    ComponentsBake=bakelistener_4.Values,
    Stroke=strokelistener_3.Values,
    Energy=enregylistener.Values,
    DirectionReverse=rotationdirectionreverse_2.Values)  # -> KineticUnit, Models, PreviewLauncher
iomodule = IntermittentOscillation(
    RegionSelection=regionselectionlistener_3.Values,
    MotionControlMethod=python_9.a,
    SetMotionControlPos=selectcontrolpos_2.Values,
    SetEEPos=seteepos_2.Values,
    SetAxisDir=setreciprocationdir_2.Values,
    AddLock=addlocklistener_3.Values,
    Preview=previewlistener_3.Values,
    Speed=speedlistener_2.Values,
    Range=rangelistener.Values,
    ComponentsBake=bakelistener_3.Values,
    Stroke=strokelistener_2.Values,
    Energy=energylistener_3.Values)  # -> KineticUnit, Models, PreviewLauncher

# ---- group: Simulation for Instant Translation
height_164 = Slider(500, range=0..900)
width_171 = Slider(400, range=0..1440)
sph_2 = Sphere(Base=PlaneXY(0, 0, 0), Radius=1)
button_50 = CreateButton(ButtonName="Load motion", ButtonStyle=0)
button_51 = CreateButton(ButtonName="Release", ButtonStyle=0)
_3dview_2 = Create3DView(MeshToDisplay=sph_2, MeshColors=RGB(255, 0, 0), ViewWidth=width_171, ViewHeight=height_164)
merge_10 = Merge(Data1=button_50, Data2=button_51)
stack_10 = CreateStack(UIElements=merge_10, Horizontal=True)
rgb_2 = ColourRGB(Alpha=255, Red="255", Green=0, Blue=0)
values_10 = ValueListener(Elements=button_51, SomeProperty=True)  # -> Values, Indices
values_11 = ValueListener(Elements=button_50, SomeProperty=True)  # -> Values, Indices
merge_11 = Merge(Data1=_3dview_2, Data2=stack_10)
height_165 = Slider(700, range=0..900)
width_172 = Slider(310, range=0..1440)
kms_2 = KinergyMotionSimulatorForHumanUI(
    _3DView=_3dview_2,
    KineticUnitToSimulate=iomodule.KineticUnit,
    MeshColors=rgb_2,
    Start=iomodule.PreviewLauncher,
    Load=values_11.Values,
    Release=values_10.Values)
launchwin_2 = LaunchWindow(
    Show=iomodule.PreviewLauncher,
    Name="Kinergy Preview Window",
    Width=width_172,
    Height=height_165,
    ChildStatus=0,
    EnableHorizScroll=False)
addelems_2 = AddElements(Window=launchwin_2, Elements=flatten(merge_11), DoVLChecking=True)  # -> AddedElements, ElementNames

# ----
ctmodule = ContinuousTranslationModule(
    RegionSelection=regionselectionlistener_4.Values,
    MotionControlMethod=python_11.a,
    SetMotionControlPos=setmotioninputpos.Values,
    SetEEPos=seteepos_4.Values,
    SetAxisDir=settransaxisdir.Values,
    AddLock=addlocklistener_5.Values,
    Preview=previewlistener_5.Values,
    Speed=speedlistener_4.Values,
    Distance=distancelistener.Values,
    Energy=energylistener_4.Values,
    ComponentsBake=bakelistener_5.Values)  # -> KineticUnit, Models, PreviewLauncher

# ---- group: Simulation for Instant Translation
height_166 = Slider(500, range=0..900)
width_173 = Slider(400, range=0..1440)
sph_3 = Sphere(Base=PlaneXY(0, 0, 0), Radius=1)
button_52 = CreateButton(ButtonName="Load motion", ButtonStyle=0)
button_53 = CreateButton(ButtonName="Release", ButtonStyle=0)
_3dview_3 = Create3DView(MeshToDisplay=sph_3, MeshColors=RGB(255, 0, 0), ViewWidth=width_173, ViewHeight=height_166)
merge_12 = Merge(Data1=button_52, Data2=button_53)
stack_11 = CreateStack(UIElements=merge_12, Horizontal=True)
rgb_3 = ColourRGB(Alpha=255, Red="255", Green=0, Blue=0)
values_12 = ValueListener(Elements=button_53, SomeProperty=True)  # -> Values, Indices
values_13 = ValueListener(Elements=button_52, SomeProperty=True)  # -> Values, Indices
merge_13 = Merge(Data1=_3dview_3, Data2=stack_11)
height_167 = Slider(700, range=0..900)
width_174 = Slider(310, range=0..1440)
kms_3 = KinergyMotionSimulatorForHumanUI(
    _3DView=_3dview_3,
    KineticUnitToSimulate=ctmodule.KineticUnit,
    MeshColors=rgb_3,
    Start=ctmodule.PreviewLauncher,
    Load=values_13.Values,
    Release=values_12.Values)
launchwin_3 = LaunchWindow(
    Show=ctmodule.PreviewLauncher,
    Name="Kinergy Preview Window",
    Width=width_174,
    Height=height_167,
    ChildStatus=0,
    EnableHorizScroll=False)
addelems_3 = AddElements(Window=launchwin_3, Elements=flatten(merge_13), DoVLChecking=True)  # -> AddedElements, ElementNames

height_168 = Slider(500, range=0..900)
width_175 = Slider(400, range=0..1440)
sph_4 = Sphere(Base=PlaneXY(0, 0, 0), Radius=1)
button_54 = CreateButton(ButtonName="Load motion", ButtonStyle=0)
button_55 = CreateButton(ButtonName="Release", ButtonStyle=0)
_3dview_4 = Create3DView(MeshToDisplay=sph_4, MeshColors=RGB(255, 0, 0), ViewWidth=width_175, ViewHeight=height_168)
merge_14 = Merge(Data1=button_54, Data2=button_55)
stack_12 = CreateStack(UIElements=merge_14, Horizontal=True)
rgb_4 = ColourRGB(Alpha=255, Red="255", Green=0, Blue=0)
values_14 = ValueListener(Elements=button_55, SomeProperty=True)  # -> Values, Indices
values_15 = ValueListener(Elements=button_54, SomeProperty=True)  # -> Values, Indices
merge_15 = Merge(Data1=_3dview_4, Data2=stack_12)
width_176 = Slider(310, range=0..1440)
height_169 = Slider(700, range=0..900)
kms_4 = KinergyMotionSimulatorForHumanUI(
    _3DView=_3dview_4,
    KineticUnitToSimulate=irmodule.KineticUnit,
    MeshColors=rgb_4,
    Start=irmodule.PreviewLauncher,
    Load=values_15.Values,
    Release=values_14.Values)
launchwin_4 = LaunchWindow(
    Show=irmodule.PreviewLauncher,
    Name="Kinergy Preview Window",
    Width=width_176,
    Height=height_169,
    ChildStatus=0,
    EnableHorizScroll=False)
addelems_4 = AddElements(Window=launchwin_4, Elements=flatten(merge_15), DoVLChecking=True)  # -> AddedElements, ElementNames

# ----
irmoudle = InstantRotationModule(
    RegionSelection=regionselectionlistener_6.Values,
    AxisSelection=rotationaxis.Values,
    EndeffectorSetting=endeffectorselectionlistener.Values,
    AddLock=addlocklistener_6.Values,
    Preview=previewlistener_6.Values,
    Energy=strengthlistener.Values,
    MaxRev=anglelistener.Values,
    ComponentsBake=bakelistener_7.Values,
    DirectionReverse=rotationdirectionreverse_3.Values)  # -> KineticUnit, Models, PreviewLauncher

# ---- group: Simulation for Instant Translation
height_170 = Slider(500, range=0..900)
width_177 = Slider(400, range=0..1440)
sph_5 = Sphere(Base=PlaneXY(0, 0, 0), Radius=1)
button_56 = CreateButton(ButtonName="Load motion", ButtonStyle=0)
button_57 = CreateButton(ButtonName="Release", ButtonStyle=0)
_3dview_5 = Create3DView(MeshToDisplay=sph_5, MeshColors=RGB(255, 0, 0), ViewWidth=width_177, ViewHeight=height_170)
merge_16 = Merge(Data1=button_56, Data2=button_57)
stack_13 = CreateStack(UIElements=merge_16, Horizontal=True)
rgb_5 = ColourRGB(Alpha=255, Red="255", Green=0, Blue=0)
values_16 = ValueListener(Elements=button_57, SomeProperty=True)  # -> Values, Indices
values_17 = ValueListener(Elements=button_56, SomeProperty=True)  # -> Values, Indices
merge_17 = Merge(Data1=_3dview_5, Data2=stack_13)
height_171 = Slider(700, range=0..900)
width_178 = Slider(310, range=0..1440)
kms_5 = KinergyMotionSimulatorForHumanUI(
    _3DView=_3dview_5,
    KineticUnitToSimulate=irmoudle.KineticUnit,
    MeshColors=rgb_5,
    Start=irmoudle.PreviewLauncher,
    Load=values_17.Values,
    Release=values_16.Values)
launchwin_5 = LaunchWindow(
    Show=irmoudle.PreviewLauncher,
    Name="Kinergy Preview Window",
    Width=width_178,
    Height=height_171,
    ChildStatus=0,
    EnableHorizScroll=False)
addelems_5 = AddElements(Window=launchwin_5, Elements=flatten(merge_17), DoVLChecking=True)  # -> AddedElements, ElementNames

height_172 = Slider(600, range=0..900)
width_179 = Slider(800, range=0..1440)
sph_6 = Sphere(Base=PlaneXY(0, 0, 0), Radius=1)
button_58 = CreateButton(ButtonName="Load the motion and lock", ButtonStyle=0)
button_59 = CreateButton(ButtonName="Release the lock", ButtonStyle=0)
_3dview_6 = Create3DView(MeshToDisplay=sph_6, MeshColors=RGB(255, 0, 0), ViewWidth=width_179, ViewHeight=height_172)
merge_18 = Merge(Data1=button_58, Data2=button_59)
rgb_6 = ColourRGB(Alpha=255, Red="255", Green="140", Blue="8")
stack_14 = CreateStack(UIElements=merge_18, Horizontal=True)
values_18 = ValueListener(Elements=button_59, SomeProperty=True)  # -> Values, Indices
merge_19 = Merge(Data1=_3dview_6, Data2=stack_14)
values_19 = ValueListener(Elements=button_58, SomeProperty=True)  # -> Values, Indices
width_180 = Slider(810, range=0..1440)
height_173 = Slider(690, range=0..900)
kms_6 = KinergyMotionSimulatorForHumanUI(
    _3DView=_3dview_6,
    KineticUnitToSimulate=itmoudle.KineticUnit,
    MeshColors=rgb_6,
    Start=itmoudle.PreviewLauncher,
    Load=values_19.Values,
    Release=values_18.Values)
launchwin_6 = LaunchWindow(
    Show=itmoudle.PreviewLauncher,
    Name="Instant Translation Motion Preview ",
    Width=width_180,
    Height=height_173,
    ChildStatus=0,
    EnableHorizScroll=False)
addelems_6 = AddElements(Window=launchwin_6, Elements=flatten(merge_19), DoVLChecking=True)  # -> AddedElements, ElementNames

# ----
rmodule = ReciprocationModule(
    RegionSelection=regionselectionlistener.Values,
    MotionControlMethod=python_8.a,
    SetMotionControlPos=selectcontrolpos.Values,
    SetEEPos=seteepos.Values,
    SetAxisDir=setreciprocationdir.Values,
    AddLock=addlocklistener.Values,
    Preview=previewlistener.Values,
    Speed=speedlistener.Values,
    Amplitude=amplitudelistener.Values,
    ComponentsBake=bakelistener.Values,
    Stroke=strokelistener.Values,
    Energy=energylistener.Values)  # -> KineticUnit, Models, PreviewLauncher

# ---- group: Simulation for Instant Translation
height_174 = Slider(500, range=0..900)
width_181 = Slider(400, range=0..1440)
sph_7 = Sphere(Base=PlaneXY(0, 0, 0), Radius=1)
button_60 = CreateButton(ButtonName="Load motion", ButtonStyle=0)
button_61 = CreateButton(ButtonName="Release", ButtonStyle=0)
_3dview_7 = Create3DView(MeshToDisplay=sph_7, MeshColors=RGB(255, 0, 0), ViewWidth=width_181, ViewHeight=height_174)
merge_20 = Merge(Data1=button_60, Data2=button_61)
stack_15 = CreateStack(UIElements=merge_20, Horizontal=True)
rgb_7 = ColourRGB(Alpha=255, Red="255", Green=0, Blue=0)
values_20 = ValueListener(Elements=button_61, SomeProperty=True)  # -> Values, Indices
values_21 = ValueListener(Elements=button_60, SomeProperty=True)  # -> Values, Indices
merge_21 = Merge(Data1=_3dview_7, Data2=stack_15)
width_182 = Slider(310, range=0..1440)
height_175 = Slider(700, range=0..900)
kms_7 = KinergyMotionSimulatorForHumanUI(
    _3DView=_3dview_7,
    KineticUnitToSimulate=rmodule.KineticUnit,
    MeshColors=rgb_7,
    Start=rmodule.PreviewLauncher,
    Load=values_21.Values,
    Release=values_20.Values)
launchwin_7 = LaunchWindow(
    Show=rmodule.PreviewLauncher,
    Name="Kinergy Preview Window",
    Width=width_182,
    Height=height_175,
    ChildStatus=0,
    EnableHorizScroll=False)
addelems_7 = AddElements(Window=launchwin_7, Elements=flatten(merge_21), DoVLChecking=True)  # -> AddedElements, ElementNames

# ---- group: MAIN WINDOW
merge_22 = Merge(
    Data1=label_3,
    Data2=label_2,
    Data3=button_3,
    Data4=button_5,
    Data5=button_7,
    Data6=label,
    Data7=button,
    Data8=button_2,
    Data9=button_4,
    Data10=button_6,
    Data11=stack_8,
    Data12=stack_7,
    Data13=stack_6,
    Data14=stack_5,
    Data15=stack_4,
    Data16=stack_3,
    Data17=stack_2,
    Data18=stack)
launchwin_8 = LaunchWindow(
    Show=Toggle(True),
    Name="Kinergy Design Tool",
    Width=Slider(345, range=0..1000),
    Height=Slider(790, range=0..1000),
    ChildStatus=0,
    EnableHorizScroll=False)
addelems_8 = AddElements(Window=launchwin_8, Elements=flatten(merge_22), DoVLChecking=True)  # -> AddedElements, ElementNames

# ----
childwin = MakeChildWindow(ParentWindow=launchwin_8, ChildWindow=launchwin)
childwin_2 = MakeChildWindow(ParentWindow=launchwin_8, ChildWindow=launchwin_4)
childwin_3 = MakeChildWindow(ParentWindow=launchwin_8, ChildWindow=launchwin_2)
childwin_4 = MakeChildWindow(ParentWindow=launchwin_8, ChildWindow=launchwin_3)
childwin_5 = MakeChildWindow(ParentWindow=launchwin_8, ChildWindow=launchwin_5)
childwin_6 = MakeChildWindow(ParentWindow=launchwin_8, ChildWindow=launchwin_6)
childwin_7 = MakeChildWindow(ParentWindow=launchwin_8, ChildWindow=launchwin_7)
