# Grasshopper definition Main Interface.gh (Grasshopper 1.0.7)
# plug-ins: Human UI

c_script = CSharpScript()  # -> out, A
# ---------- c_script: C# ----------
    string str1 = System.AppDomain.CurrentDomain.BaseDirectory;
    A = str1;
# ---------- end c_script ----------

# ---- group: ADVANCED
panel = Panel("C:\Users\ybliang19970108\Documents\GitHub\Kinergy\Code\pull-back car.jpg")
panel_2 = Panel("C:\Users\ybliang19970108\Documents\GitHub\Kinergy\Code\pull-back car.jpg")
panel_3 = Panel("C:\Users\ybliang19970108\Documents\GitHub\Kinergy\Code\pull-back car.jpg")
panel_4 = Panel("C:\Users\ybliang19970108\Documents\GitHub\Kinergy\Code\pull-back car.jpg")
button = CreateButton(ImagePath=panel, ButtonStyle=0)
button_2 = CreateButton(ImagePath=panel_2, ButtonStyle=0)
button_3 = CreateButton(ImagePath=panel_3, ButtonStyle=0)
button_4 = CreateButton(ImagePath=panel_4, ButtonStyle=0)
merge = Merge(Data1=button, Data2=button_2, Data3=button_3, Data4=button_4)
expander = CreateExpander(UIElements=merge, Header="ADVANCED", Open=True)
values = ValueListener(Elements=button_2, SomeProperty=True)  # -> Values, Indices
values_2 = ValueListener(Elements=button_3, SomeProperty=True)  # -> Values, Indices
values_3 = ValueListener(Elements=button_4, SomeProperty=True)  # -> Values, Indices
values_4 = ValueListener(Elements=button, SomeProperty=True)  # -> Values, Indices

# ----
python = GhPythonScript()  # -> out, a
# ---------- python: Python ----------
__author__ = "ybliang19970108"
__version__ = "2020.03.11"

import rhinoscriptsyntax as rs

import os

a=os.path.abspath('.')+"\pull-back car.jpg"
# ---------- end python ----------
panel_5 = Panel(c_script.A)
panel_6 = Panel(python.a)

# ---- group: BASIC
panel_7 = Panel("C:\Users\ybliang19970108\Documents\GitHub\Kinergy\Code\pull-back car.jpg")
panel_8 = Panel("C:\Users\ybliang19970108\Documents\GitHub\Kinergy\Code\pull-back car.jpg")
button_5 = CreateButton(ImagePath=panel_8, ButtonStyle=0)
button_6 = CreateButton(ImagePath=panel_7, ButtonStyle=0)
number_slider = Slider(0, range=0..100)
number_slider_2 = Slider(150, range=0..1000)
merge_2 = Merge(Data1=button_5, Data2=button_6)
expander_2 = CreateExpander(UIElements=merge_2, Header="BASIC", Open=True)
values_5 = ValueListener(Elements=button_5, SomeProperty=True)  # -> Values, Indices
values_6 = ValueListener(Elements=button_6, SomeProperty=True)  # -> Values, Indices

# ---- group: INTERMEDIATE
panel_9 = Panel("C:\Users\ybliang19970108\Documents\GitHub\Kinergy\Code\pull-back car.jpg")
panel_10 = Panel("C:\Users\ybliang19970108\Documents\GitHub\Kinergy\Code\pull-back car.jpg")
panel_11 = Panel("C:\Users\ybliang19970108\Documents\GitHub\Kinergy\Code\pull-back car.jpg")
panel_12 = Panel("C:\Users\ybliang19970108\Documents\GitHub\Kinergy\Code\pull-back car.jpg")
panel_13 = Panel("C:\Users\ybliang19970108\Documents\GitHub\Kinergy\Code\pull-back car.jpg")
button_7 = CreateButton(ImagePath=panel_11, ButtonStyle=0)
button_8 = CreateButton(ImagePath=panel_9, ButtonStyle=0)
button_9 = CreateButton(ImagePath=panel_12, ButtonStyle=0)
button_10 = CreateButton(ImagePath=panel_13, ButtonStyle=0)
button_11 = CreateButton(ImagePath=panel_10, ButtonStyle=0)
adjustpos = AdjustElementPositioning(
    ElementsToAdjust=[button_6, button_8, button_9, button_2, button_4],
    Margin="0,-150,-170,0",
    AbsolutePositioning=False,
    Width=number_slider_2,
    Height=number_slider_2)
adjustpos_2 = AdjustElementPositioning(
    ElementsToAdjust=[button_11, button_10, button_3],
    Margin="10,10,0,0",
    AbsolutePositioning=False,
    Width=number_slider_2,
    Height=number_slider_2,
    HorizontalAlignment=number_slider)
merge_3 = Merge(Data1=button_7, Data2=button_8, Data3=button_11, Data4=button_9, Data5=button_10)
expander_3 = CreateExpander(UIElements=merge_3, Header="INTERMEDIATE", Open=True)
values_7 = ValueListener(Elements=button_7, SomeProperty=True)  # -> Values, Indices
values_8 = ValueListener(Elements=button_8, SomeProperty=True)  # -> Values, Indices
values_9 = ValueListener(Elements=button_11, SomeProperty=True)  # -> Values, Indices
values_10 = ValueListener(Elements=button_9, SomeProperty=True)  # -> Values, Indices
values_11 = ValueListener(Elements=button_10, SomeProperty=True)  # -> Values, Indices

# ---- group: BASIC (continued)
adjustpos_3 = AdjustElementPositioning(
    ElementsToAdjust=[button_5, button_7, button],
    Margin="10,0,0,0",
    AbsolutePositioning=False,
    Width=number_slider_2,
    Height=number_slider_2,
    HorizontalAlignment=number_slider)

# ---- group: MAIN WINDOW
merge_4 = Merge(Data1=expander_2, Data2=expander_3, Data3=expander)
launchwin = LaunchWindow(
    Show=Toggle(True),
    Name="MOTION",
    Width=Slider(400, range=0..1000),
    Height=Slider(940, range=0..1000),
    ChildStatus=0,
    EnableHorizScroll=False)
addelems = AddElements(Window=launchwin, Elements=flatten(merge_4), DoVLChecking=True)  # -> AddedElements, ElementNames

# ----
selectchildwindow = GhPythonScript(
    c0=values_5.Values,
    c1=values_6.Values,
    c2=values_7.Values,
    c3=values_8.Values,
    c4=values_9.Values,
    c5=values_10.Values,
    c6=values_11.Values,
    c7=values_4.Values,
    c8=values.Values,
    c9=values_2.Values,
    c10=values_3.Values)  # -> c0_2, c1_2, c2_2, c3_2, c4_2, c5_2, c6_2, c7_2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; inputs c0: Boolean, c1: Boolean, c2: Boolean, c3: Boolean, c4: Boolean, c5: Boolean, c6: Boolean, c7: Boolean, c8: Boolean, c9: Boolean, c10: Boolean
# ---------- selectchildwindow: Python ----------
__author__ = "ybliang19970108"
__version__ = "2020.03.04"

import rhinoscriptsyntax as rs
def compareValue(a,b):
    if(a==b):
        return False;
    return True;

#Make persistent value to keep track of last value
if "lastValue" not in globals():
    lastValue=[c0,c1,c2,c3,c4,c5,c6,c7,c8,c9,c10];

#Check that current value is different from last value
newValue=[c0,c1,c2,c3,c4,c5,c6,c7,c8,c9,c10];
for i,val in enumerate(newValue):
    if val==True:
        lastValue=[False,False,False,False,False,False,False,False,False,False,False];
        lastValue[i]=True;
        break;
        
c0_2=lastValue[0];
c1_2=lastValue[1];
c2_2=lastValue[2];
c3_2=lastValue[3];
c4_2=lastValue[4];
c5_2=lastValue[5];
c6_2=lastValue[6];
c7_2=lastValue[7];
c8_2=lastValue[8];
c9_2=lastValue[9];
c10_2=lastValue[10];
# ---------- end selectchildwindow ----------

# ---- group: TOADD: CHILDWINDOW
launchwin_2 = LaunchWindow(
    Show=selectchildwindow.c9_2,
    Name="Advanced-DiscreteRepeated-Curved",
    Width=370,
    Height=400,
    ChildStatus=0,
    EnableHorizScroll=False)
launchwin_3 = LaunchWindow(
    Show=selectchildwindow.c10_2,
    Name="Advanced-DiscreteRepeated-Linear",
    Width=370,
    Height=400,
    ChildStatus=0,
    EnableHorizScroll=False)
launchwin_4 = LaunchWindow(Show=selectchildwindow.c0_2, Name="BASIC-HELICAL", Width=370, Height=400, ChildStatus=0, EnableHorizScroll=False)
launchwin_5 = LaunchWindow(Show=selectchildwindow.c1_2, Name="Basic-Spiral", Width=370, Height=400, ChildStatus=0, EnableHorizScroll=False)
launchwin_6 = LaunchWindow(
    Show=selectchildwindow.c2_2,
    Name="Intermediate-ContinousCircling-Press",
    Width=370,
    Height=400,
    ChildStatus=0,
    EnableHorizScroll=False)
launchwin_7 = LaunchWindow(
    Show=selectchildwindow.c3_2,
    Name="Intermediate-ContinousCircling-Rotate",
    Width=370,
    Height=400,
    ChildStatus=0,
    EnableHorizScroll=False)
launchwin_8 = LaunchWindow(
    Show=selectchildwindow.c4_2,
    Name="Intermediate-ContinousMoving-Press",
    Width=370,
    Height=400,
    ChildStatus=0,
    EnableHorizScroll=False)
launchwin_9 = LaunchWindow(
    Show=selectchildwindow.c5_2,
    Name="Intermediate-ContinousMoving-Rotate",
    Width=370,
    Height=400,
    ChildStatus=0,
    EnableHorizScroll=False)
launchwin_10 = LaunchWindow(
    Show=selectchildwindow.c6_2,
    Name="Intermediate-Projectile",
    Width=370,
    Height=400,
    ChildStatus=0,
    EnableHorizScroll=False)
launchwin_11 = LaunchWindow(
    Show=selectchildwindow.c7_2,
    Name="Advanced-ContinousRepeated-Curved",
    Width=370,
    Height=400,
    ChildStatus=0,
    EnableHorizScroll=False)
launchwin_12 = LaunchWindow(
    Show=selectchildwindow.c8_2,
    Name="Advanced-ContinousRepeated-Linear",
    Width=370,
    Height=400,
    ChildStatus=0,
    EnableHorizScroll=False)
childwin = MakeChildWindow(ParentWindow=launchwin, ChildWindow=launchwin_2)
childwin_2 = MakeChildWindow(ParentWindow=launchwin, ChildWindow=launchwin_3)
childwin_3 = MakeChildWindow(ParentWindow=launchwin, ChildWindow=launchwin_4)
childwin_4 = MakeChildWindow(ParentWindow=launchwin, ChildWindow=launchwin_5)
childwin_5 = MakeChildWindow(ParentWindow=launchwin, ChildWindow=launchwin_6)
childwin_6 = MakeChildWindow(ParentWindow=launchwin, ChildWindow=launchwin_7)
childwin_7 = MakeChildWindow(ParentWindow=launchwin, ChildWindow=launchwin_8)
childwin_8 = MakeChildWindow(ParentWindow=launchwin, ChildWindow=launchwin_9)
childwin_9 = MakeChildWindow(ParentWindow=launchwin, ChildWindow=launchwin_10)
childwin_10 = MakeChildWindow(ParentWindow=launchwin, ChildWindow=launchwin_11)
childwin_11 = MakeChildWindow(ParentWindow=launchwin, ChildWindow=launchwin_12)
