# Grasshopper definition ie_Trial.gh (Grasshopper 1.0.7)
# plug-ins: InstantExtension, KinergyUtilities

brep = Brep(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)
brep_2 = Brep(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)
brep_3 = Brep(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)
ie = InstantExtension(
    Start=Toggle(True),
    Model=brep_3,
    CurvedModel=Toggle(True),
    Energy=Slider(1, range=0..1),
    Distance=Slider(0.5, range=0..1))
preprocessie = _01ModelPreprocessOfIE(Motion=ie)  # -> Motion, SpringPositionCandidates, ModelSkeleton
sp = SelectPosition(PositionCandidates=preprocessie.SpringPositionCandidates, Select=Toggle(True))
constructspring = _02ConstructSpringOfIE(Motion=preprocessie.Motion, SpringPosition=sp)  # -> Motion, LockDirectionCandidates, Spring
sd = SelectDirection(DirectionCandidates=constructspring.LockDirectionCandidates, Select=Toggle(True))
nickname = _03GenerateLockPositionCandidateOfIE(Motion=constructspring.Motion, LockDirection=sd)  # -> Motion, LockPositionCandidates
sp_2 = SelectPosition(PositionCandidates=nickname.LockPositionCandidates, Select=Toggle(True))
constructlock = _04ConstructLockOfIE(Motion=nickname.Motion, LockPosition=sp_2)  # -> Motion, Models
