# Grasshopper definition OffsetTrial.gh (Grasshopper 1.0.7)
# plug-ins: Human UI

number_slider = Slider(1, range=0..1)
sph = Sphere(Base=PlaneXY(0, 0, 0), Radius=Slider(10, range=0..10))
nickname = TestingComponentForBrepOffset(Brep=sph, Distance=Slider(3, range=0..10))
