# Grasshopper definition Basic_helical_XS_test_V1.gh (Grasshopper 1.0.7)
# plug-ins: Human UI, MotionSolver

# ---- group: arrow
pt = Point(["0,0,0", "20,0,0", "20,4,0", "28,0,0", "20,-4,0", "20,0,0"])
pline = PolyLine(Vertices=pt, Closed="true")
crv = Curve(pline)

# ---- group: Distance Slider
distance = Slider(1, range=0.3..1)
slider = CreateSlider(Slider=distance, ShowBounds=False, ShowTicks=False, ShowTooltip=False, ShowValLabel=True, showLabel=True)
values = ValueListener(Elements=slider, SomeProperty=True)  # -> Values, Indices

# ---- group: Speed Slider
energy = Slider(3, range=1..5)
slider_2 = CreateSlider(Slider=energy, ShowBounds=False, ShowTicks=False, ShowTooltip=False, ShowValLabel=True, showLabel=True)
values_2 = ValueListener(Elements=slider_2, SomeProperty=True)  # -> Values, Indices

# ---- group: Set Direction
true_button = CreateTrueOnlyButton(ButtonName="DIRECTION", ButtonStyle=0)
values_3 = ValueListener(Elements=true_button, SomeProperty=True)  # -> Values, Indices
setdirection = CSharpScript(ToSet=values_3.Values, arrow=crv)  # -> A, B; inputs ToSet: Boolean, arrow: Curve
# ---------- setdirection: C# ----------
    Vector3d v = Vector3d.Unset;
    B = null;
    //A = v;
    if(ToSet)
    {
      //while(v.IsTiny(Rhino.RhinoMath.ZeroTolerance))
      //{
      Rhino.Input.Custom.GetPoint gp = new Rhino.Input.Custom.GetPoint();
      gp.SetCommandPrompt("Start of line");
      gp.Get();
      //if (gp.CommandResult() != Rhino.Commands.Result.Success)
      //return gp.CommandResult();

      Rhino.Geometry.Point3d pt_start = gp.Point();

      gp.SetCommandPrompt("End of line");
      gp.SetBasePoint(pt_start, false);
      gp.DrawLineFromPoint(pt_start, true);
      gp.Get();
      //if (gp.CommandResult() != Rhino.Commands.Result.Success)
      //return gp.CommandResult();

      Rhino.Geometry.Point3d pt_end = gp.Point();
      v = pt_end - pt_start;
      arrow.Transform(Transform.Translation(new Vector3d(pt_start)));
      arrow.Transform(Transform.Rotation(Vector3d.XAxis, v, pt_start));
      B = arrow;
    }
    A = v;
# ---------- end setdirection ----------

# ---- group: Load Kinetic Unit into Model
pickbtn = CreateRhinoPickButton(
    ButtonName="LOAD MODEL",
    Prompt="Please select geometry...",
    AllowMultiple="FALSE",
    AllowNone="FALSE",
    Type=0,
    ButtonStyle=0)
values_4 = ValueListener(Elements=pickbtn, SomeProperty=True)  # -> Values, Indices

# ---- group: Set Energy Control
checkbox = CreateCheckbox(Label="ADD LOCK", StartingValue=False)
values_5 = ValueListener(Elements=checkbox, SomeProperty=True)  # -> Values, Indices

# ----
true_button_2 = CreateTrueOnlyButton(ButtonName="START", ButtonStyle=0)
values_6 = ValueListener(Elements=true_button_2, SomeProperty=True)  # -> Values, Indices

merge = Merge(Data1=values_2.Values, Data2=values.Values)
ms = MotionSolver(Start=values_6.Values, Type=1, Brep=values_4.Values, Vector3d=setdirection.A, Parameter=merge, Lock=values_5.Values)  # -> Model, Structure, Lock

# ---- group: Export
true_button_3 = CreateTrueOnlyButton(ButtonName="EXPORT", ButtonStyle=0)
values_7 = ValueListener(Elements=true_button_3, SomeProperty=True)  # -> Values, Indices
merge_2 = Merge(Data1=flatten(ms.Model), Data2=flatten(ms.Structure), Data3=flatten(ms.Lock))
export = CSharpScript(export=values_7.Values, brep=merge_2)  # inputs export: Boolean, brep: list of Brep
# ---------- export: C# ----------
    if(export)
    {
      RhinoDoc myDoc = RhinoDoc.ActiveDoc;
      foreach(Brep brep0 in brep)
        myDoc.Objects.AddBrep(brep0);
    }
    return;
# ---------- end export ----------

# ---- group: Interface
merge_3 = Merge(Data2=checkbox, Data3=pickbtn, Data4=true_button_2)
merge_4 = Merge(Data1=slider, Data2=slider_2, Data3=true_button)
expander = CreateExpander(UIElements=merge_3, Header="MODEL CONFIGURATIONS", Open=True)
adjustpos = AdjustElementPositioning(ElementsToAdjust=[pickbtn, true_button, true_button_3], AbsolutePositioning=False, Width=Slider(300, range=0..1000))
expander_2 = CreateExpander(UIElements=merge_4, Header="MOTION DESIGN", Open=True)
merge_5 = Merge(Data2=expander_2, Data3=expander, Data5=true_button_3)
launchwin = LaunchWindow(
    Show=Toggle(True),
    Name="Control Window",
    Width=Slider(400, range=0..1000),
    Height=Slider(400, range=0..1000),
    ChildStatus=0,
    EnableHorizScroll=False)
addelems = AddElements(Window=launchwin, Elements=flatten(merge_5), DoVLChecking=True)  # -> AddedElements, ElementNames
