# Grasshopper definition IE_trial_HumanUI.gh (Grasshopper 1.0.7)
# plug-ins: Human UI

number_slider = Slider(1, range=0..1)
brep = Brep(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)
Z = UnitZ(Factor=1)
toggle = BooleanToggle(True)
ie = InstantExtension(Start=toggle, Model=brep, CurvedModel=toggle, Energy=Slider(2, range=0..10), Distance=Slider(0.5, range=0..1))
preprocessie = _01ModelPreprocessOfIE(KineticUnit=ie)  # -> KineticUnit, SpringPositionCandidates, ModelSkeleton
sp = SelectPosition(PositionCandidates=preprocessie.SpringPositionCandidates, Select=Toggle(True))
constructspring = _02ConstructSpringOfIE(KineticUnit=preprocessie.KineticUnit, SpringPosition=sp)  # -> KineticUnit, LockDirectionCandidates, Spring, SpringSkeleton
sd = SelectDirection(DirectionCandidates=constructspring.LockDirectionCandidates, Select=Toggle(True))
nickname = _03GenerateLockPositionCandidateOfIE(KineticUnit=constructspring.KineticUnit, LockDirection=sd)  # -> KineticUnit, LockPositionCandidates
sp_2 = SelectPosition(PositionCandidates=nickname.LockPositionCandidates, Select=Toggle(True))
constructlock = _04ConstructLockOfIE(KineticUnit=nickname.KineticUnit, LockPosition=sp_2)  # -> KineticUnit, Models
launchwin = LaunchWindow(
    Show=Toggle(True),
    Name="3D Model Configurator",
    Width=Slider(387, range=0..1000),
    Height=Slider(634, range=0..1000),
    ChildStatus=0,
    EnableHorizScroll=False)
button = CreateButton(ButtonName="LoadMotion", ButtonStyle=0)
button_2 = CreateButton(ButtonName="Release", ButtonStyle=0)
rgb = ColourRGB(Alpha=255, Red=Slider(255, range=0..1000), Green=0, Blue=0)
cyl = Cylinder(Base=PlaneXY(0, 0, 0), Radius=0.5, Length=1)
merge = Merge(Data1=button, Data2=button_2)
_3dview = Create3DView(MeshToDisplay=cyl, MeshColors=RGB(255, 0, 0), ViewWidth=300, ViewHeight=300)
checkbox = CreateCheckbox(Label="Simulate", StartingValue=False)
stack = CreateStack(UIElements=merge, Horizontal=True)
merge_2 = Merge(Data1=_3dview, Data3=stack)
values = ValueListener(Elements=checkbox, SomeProperty=True)  # -> Values, Indices
values_2 = ValueListener(Elements=button_2, SomeProperty=True)  # -> Values, Indices
values_3 = ValueListener(Elements=button, SomeProperty=True)  # -> Values, Indices
expander = CreateExpander(UIElements=merge_2, Open=True)
merge_3 = Merge(Data1=checkbox, Data2=expander)
addelems = AddElements(Window=launchwin, Elements=flatten(merge_3), DoVLChecking=True)  # -> AddedElements, ElementNames
kms = KinergyMotionSimulatorForHumanUI(
    _3DView=_3dview,
    MotionToSimulate=constructlock.KineticUnit,
    MeshColors=rgb,
    Load=values_3.Values,
    Release=values_2.Values)
hideshow = HideShowElement(ElementToHideShow=expander, Show=values.Values, Collapse=True, Disable=False)
