# Grasshopper definition CLMP.gh (Grasshopper 1.0.7)
# plug-ins: ContinuousLinearMovingByPress

X = UnitX(Factor=1)
brep = Brep(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)
brep_2 = Brep(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)
clmp = ContinuousLinearMovingByPress(
    Start=Toggle(False),
    MainBrep=brep_2,
    MoveDirection=X,
    Energy=Slider(1, range=0..1),
    Distance=Slider(0.5, range=0..1),
    AddLock=Toggle(False),
    AddRack=Toggle(False),
    AddWheel=Toggle(False),
    Axle=brep)  # -> Models, Entities, MotionInstance
