# Grasshopper definition PlaneMovingTrial.gh (Grasshopper 1.0.7)
# plug-ins: Human UI

X = UnitX(Factor=1)
brep = Brep(<brep referenced from the Rhino model>)
brep_2 = Brep(<brep referenced from the Rhino model>)
innerbox = GetInnerBox(Brep=brep_2, Direction=X, RegionOfInterestStart=Slider(0.4, range=0..1), RegionOfInterestEnd=Slider(0.8, range=0..1))  # -> InnerBox1, InnerBox2, InnerBox3, Plane1, Plane2, ModelPart1, ModelPart2, ModelPart3
