# Grasshopper definition PreprocessTrialNew2.gh (Grasshopper 1.0.7)
# plug-ins: Human UI

brep = Brep(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)
mpn2 = ModelPreprocessNew2(Brep=brep, InnerSpaceType=Slider(1, range=0..1), Restart=Button())  # -> ModelRegionOfInterest, InnerBox, InnerCylinder, Skeleton, Direction
