# Grasshopper definition PreprocessingTrial.gh (Grasshopper 1.0.7)
# plug-ins: Human UI

brep = Brep(<brep referenced from the Rhino model>)
X = UnitX(Factor=1)
brep_2 = Brep(<brep referenced from the Rhino model>)
mp = ModelPreprocessing(Brep=brep_2, Direction=X)
