# Grasshopper definition SpiralTrial.gh (Grasshopper 1.0.7)
# plug-ins: Human UI

number_slider = Slider(1.39, range=0..2)
xy = XYPlane(Origin=Point(0, 0, 0))
spiral = SpiralSpringComponent(
    BasePlane=xy,
    MinimalRadiusOfSpiralSpring=Slider(5, range=0..10),
    MaximumRadiusOfSpiralSpring=Slider(21, range=0..30),
    ThicknessOfSpiral=number_slider,
    WidthOfSpiralSection=number_slider,
    NumberOfSpiralRounds=Slider(4, range=0..10),
    LoadedAngle=Slider(3, range=0..360))  # -> SpiralSpring, Models
