# Grasshopper definition SpiralTrialNew.gh (Grasshopper 1.0.7)
# plug-ins: Human UI

xy = XYPlane(Origin=Point(0, 0, 0))
nickname = SpiralSpringComponentNew(
    BasePlane=xy,
    MaximumRadiusOfSpiralSpring=Slider(10, range=0..10),
    Energy=Slider(5, range=0..10),
    Displacement=Slider(5, range=0..10))  # -> SpiralSpring, Models
