# Grasshopper definition cuttingTrial.gh (Grasshopper 1.0.7)
# plug-ins: Human UI

number_slider = Slider(1, range=0..1)
Y = UnitY(Factor=1)
X = UnitX(Factor=1)
brep = Brep(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)
mp = ModelPreprocess(Brep=brep, Direction=Y, InnerSpaceType=Slider(2, range=0..10), Restart=Button())  # -> ModelRegionOfInterest, InnerBox, InnerCylinder, Skeleton, Direction
