# Grasshopper definition helical_test_XS.gh (Grasshopper 1.0.7)
# plug-ins: Human UI

angle = Slider(0, range=0..360)
coil_density = Slider(3.3, range=1..10)
panel = Panel("""At Center
Aside""")
angle_2 = Slider(0, range=0..360)
travel = Slider(10, range=0..100)
thickness = Slider(0.365, range=0.1..1)
stretch = Slider(13.252, range=10..40)
length = Slider(31.789, range=15..100)
panel_2 = Panel("""Type A
Type B
Type C""")
checkbox = CreateCheckbox(Label="Shell", StartingValue=False)
radiobtn = CreateRadioButton(RadioButtonName=panel, RadioButtonGroup="Rail", InitiallySelected=False)
checkbox_2 = CreateCheckbox(Label="Lock", StartingValue=False)
radiobtn_2 = CreateRadioButton(RadioButtonName=panel_2, RadioButtonGroup="Lock", InitiallySelected=False)
slider = CreateSlider(Slider=stretch, ShowBounds=False, ShowTicks=False, ShowTooltip=False, ShowValLabel=True, showLabel=True)
slider_2 = CreateSlider(Slider=thickness, ShowBounds=False, ShowTicks=False, ShowTooltip=False, ShowValLabel=True, showLabel=True)
slider_3 = CreateSlider(Slider=coil_density, ShowBounds=False, ShowTicks=False, ShowTooltip=False, ShowValLabel=True, showLabel=True)
slider_4 = CreateSlider(Slider=length, ShowBounds=False, ShowTicks=False, ShowTooltip=False, ShowValLabel=True, showLabel=True)
slider_5 = CreateSlider(Slider=angle, ShowBounds=False, ShowTicks=False, ShowTooltip=False, ShowValLabel=True, showLabel=True)
slider_6 = CreateSlider(Slider=angle_2, ShowBounds=False, ShowTicks=False, ShowTooltip=False, ShowValLabel=True, showLabel=True)
slider_7 = CreateSlider(Slider=travel, ShowBounds=False, ShowTicks=False, ShowTooltip=False, ShowValLabel=True, showLabel=True)
values = ValueListener(Elements=checkbox_2, SomeProperty=True)  # -> Values, Indices
values_2 = ValueListener(Elements=radiobtn, SomeProperty=True)  # -> flatten(Values), Indices
values_3 = ValueListener(Elements=checkbox, SomeProperty=True)  # -> Values, Indices
values_4 = ValueListener(Elements=radiobtn_2, SomeProperty=True)  # -> flatten(Values), Indices
values_5 = ValueListener(Elements=slider_5, SomeProperty=True)  # -> Values, Indices
values_6 = ValueListener(Elements=slider_6, SomeProperty=True)  # -> Values, Indices
item = ListItem(List=values_2.Values, Index=1, Wrap=True)
merge = Merge(Data1=slider_4, Data2=slider, Data3=slider_3, Data4=slider_2)
values_7 = ValueListener(Elements=slider, SomeProperty=True)  # -> Values, Indices
values_8 = ValueListener(Elements=slider_2, SomeProperty=True)  # -> Values, Indices
values_9 = ValueListener(Elements=slider_3, SomeProperty=True)  # -> Values, Indices
values_10 = ValueListener(Elements=slider_4, SomeProperty=True)  # -> Values, Indices

# ----
# Spring Generator
series = Series(Start=0, Step=1, Count=values_10.Values)  # disabled
sin = Sine(Value=series)  # disabled
cos = Cosine(Value=series)  # disabled
multiplication = Multiplication(A=values_9.Values, B=series)  # disabled
# shell and rail generator
multiplication_2 = Multiplication(A=values_7.Values, B=sin)  # disabled
multiplication_3 = Multiplication(A=values_7.Values, B=cos)  # disabled
pt = ConstructPoint(XCoordinate=multiplication, YCoordinate=multiplication_3, ZCoordinate=multiplication_2)  # disabled
intcrv = Interpolate(Degree=3, Periodic=False, KnotStyle=1)  # -> Curve, Length, Domain; disabled
item_2 = ListItem(List=pt, Index=0, Wrap=True)  # disabled
cir = Circle(Plane=PlaneXY(0, 0, 0), Radius=values_8.Values)  # disabled
move = Move(Geometry=cir, Motion=item_2)  # -> Geometry, Transform; disabled
swatch = ColourSwatch(SwatchColor=RGB(148, 143, 255))  # disabled
swp1 = Sweep1(Rail=intcrv.Curve, Sections=move.Geometry, Miter=1)  # disabled
preview = CustomPreview(Geometry=swp1, Material=swatch)  # disabled

values_11 = ValueListener(Elements=slider_7, SomeProperty=True)  # -> Values, Indices
hideshow = HideShowElement(ElementToHideShow=radiobtn_2, Show=values.Values, Collapse=True, Disable=False)
expander = CreateExpander(UIElements=merge, Header="Spring Parameter", Open=True)
hideshow_2 = HideShowElement(ElementToHideShow=slider_5, Show=item, Collapse=True, Disable=False)
item_3 = ListItem(List=values_4.Values, Index=1, Wrap=True)
item_4 = ListItem(List=values_4.Values, Index=2, Wrap=True)
or = GateOr(A=item_3, B=item_4)
and = GateAnd(A=values.Values, B=or)
checkbox_3 = CreateCheckbox(Label="Rail", StartingValue=False)
hideshow_3 = HideShowElement(ElementToHideShow=slider_6, Show=and, Collapse=True, Disable=False)
hideshow_4 = HideShowElement(ElementToHideShow=slider_7, Show=values.Values, Collapse=True, Disable=False)
merge_2 = Merge(Data1=values_10.Values, Data2=values_7.Values, Data3=values_9.Values, Data4=values_8.Values)
values_12 = ValueListener(Elements=checkbox_3, SomeProperty=True)  # -> Values, Indices
hideshow_5 = HideShowElement(ElementToHideShow=radiobtn, Show=values_12.Values, Collapse=True, Disable=False)
python = GhPythonScript(x=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, y=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, z=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)  # -> a
# ---------- python: Python ----------
from ghpythonlib.componentbase import executingcomponent as component
import Grasshopper, GhPython
import System
import Rhino
import rhinoscriptsyntax as rs

class MyComponent(component):
    
    def RunScript(self, x, y,z):
        """Collects all lock models and return a dictionary.
            Inputs:
                x: The moving part of lock
                y: The locker structure 1
                z: The locker structure 2
            Output:
                a: The model dictionary"""
        
        __author__ = "suxia"
        __version__ = "2020.02.28"
        
        import rhinoscriptsyntax as rs
        a=[x,y,z]
        # return outputs if you have them; here I try it for you:
        return a
# ---------- end python ----------
merge_3 = Merge(
    Data1=checkbox_3,
    Data2=radiobtn,
    Data3=slider_5,
    Data4=checkbox,
    Data5=checkbox_2,
    Data6=radiobtn_2,
    Data7=slider_6,
    Data8=slider_7)
merge_4 = Merge(
    Data1=values_12.Values,
    Data2=values_2.Values,
    Data3=values_5.Values,
    Data4=values_3.Values,
    Data5=values.Values,
    Data6=values_4.Values,
    Data7=values_6.Values,
    Data8=values_11.Values)

# ----
# This is the main body of generator
python_2 = GhPythonScript(x=merge_4, y=merge_2, z=python)  # -> a, b, c, d; inputs x: list, y: list, z: list of Brep
#   port x: Input from checklist,including whether to add rail and shell(integer)
# ---------- python_2: Python ----------
from ghpythonlib.componentbase import executingcomponent as component
import Grasshopper, GhPython
import System
import Rhino
import rhinoscriptsyntax as rs
#version:2020/02/27
#author: Xia
class MyComponent(component):
    
    def RunScript(self, x, y, z):
        #script to collect feedback from humanUI interface and generate spring and lock structure
        """Constructs spring and lock structure.
          Inputs:
            x: Input from UI,including whether to add rail/shell/lock and their parameters
            y: The parameters of spring. (float)
            z: The models of lock structure
          Outputs:
            a: Spring and bases
            b: Shell
            c: Rail
            d: Lock
        """
        import math
        import ghpythonlib.components as ghcomp
        control_points_per_round=10#number of points per round of spring
        modulus=5#base length used at multiple positions
        pi=math.pi
        add_rail=x[0]
        rail_center=x[1]
        rail_aside=x[2]
        rail_angle=x[3]*pi*2/360
        add_shell=x[4]
        add_lock=x[5]
        lock_a=x[6]
        lock_b=x[7]
        lock_c=x[8]
        lock_angle=x[9]
        lock_travel=x[10]
        
        spring_len=y[0]
        spring_radius=y[1]
        spring_dis=y[2]
        spring_thick=y[3]
        points=(spring_len)//(spring_dis/control_points_per_round)#rounds of coil in the middle
        #residual=(spring_len-spring_thick*2)%(spring_dis/control_points_per_round)
        if lock_travel>spring_len-15:
            lock_travel=spring_len-15
        dis=[]
        angle=[]
        
        for i in range(int(points)):
            dis.append(i*spring_dis/control_points_per_round)
            angle.append(2*pi*i/control_points_per_round)
        l=len(dis)
        pts=[]
        for i in range(l):
            p=ghcomp.ConstructPoint(dis[i],math.cos(angle[i])*spring_radius,math.sin(angle[i])*spring_radius)
            pts.append(p)
        curve=ghcomp.Interpolate(pts,3,False,1)[0]
        #print(curve)
        circle=ghcomp.Circle(radius=spring_thick)
        circle=ghcomp.Move(circle,pts[0])[0]
        #print(circle)
        spring=ghcomp.Sweep1(rail=curve,sections=circle)
        #a = spring
        #add bases
        YZplane=ghcomp.YZPlane()
        line1=ghcomp.Line(ghcomp.ConstructPoint(-modulus,0,0),ghcomp.ConstructPoint(0,0,0))
        base1=ghcomp.Pipe(line1,spring_radius*1.1,1)
        line2=ghcomp.Line(ghcomp.ConstructPoint(spring_len,0,0),ghcomp.ConstructPoint(spring_len+modulus,0,0))
        base2=ghcomp.Pipe(line2,spring_radius*1,1)
        
        
        #add shell if asked
        if add_rail:
            if rail_center:
                l=ghcomp.Line(ghcomp.ConstructPoint(0,0,0),ghcomp.ConstructPoint(spring_len+modulus,0,0))
                rail=ghcomp.Pipe(l,spring_radius*0.05,1)
                base2=ghcomp.SolidDifference(base2,rail)
            elif rail_aside:
                connector1=ghcomp.Box2Pt(ghcomp.ConstructPoint(-modulus,-modulus,-modulus),ghcomp.ConstructPoint(0,modulus,modulus))
                connector1=ghcomp.Move(connector1,ghcomp.ConstructPoint(0,-spring_radius,0))[0]
                connector2=ghcomp.Move(connector1,ghcomp.ConstructPoint(spring_len+modulus,0,0))[0]
                l=ghcomp.Line(ghcomp.ConstructPoint(0,0,0),ghcomp.ConstructPoint(spring_len+modulus,0,0))
                rail=ghcomp.Pipe(l,spring_radius*0.05,1)
                rail=ghcomp.Move(rail,ghcomp.ConstructPoint(0,-spring_radius-0.3*modulus,0))[0]
                connector2=ghcomp.SolidDifference(connector2,rail)
                connector1=ghcomp.RotateAxis(connector1,rail_angle,l)[0]
                connector2=ghcomp.RotateAxis(connector2,rail_angle,l)[0]
                rail=ghcomp.RotateAxis(rail,rail_angle,l)[0]
                base1=ghcomp.SolidUnion([base1,connector1])
                base2=ghcomp.SolidUnion([base2,connector2])
        else:
            rail=None
        if add_shell:
            YZplane=ghcomp.YZPlane()
            ring1=ghcomp.Circle(plane=YZplane,radius=spring_radius*1.02)
            ring2=ghcomp.Circle(plane=YZplane,radius=spring_radius*1.05)
            ring=ghcomp.RuledSurface(ring1,ring2)
            vec=ghcomp.Vector2Pt(ghcomp.ConstructPoint(0,0,0),ghcomp.ConstructPoint(spring_len,0,0))[0]
            #shell=ghcomp.Sweep1(rail=vec,sections=ring1)
            shell=ghcomp.Extrude(ring,vec)
            if add_rail and rail_aside:
                box=ghcomp.Box2Pt(ghcomp.ConstructPoint(0,0,-modulus),ghcomp.ConstructPoint(spring_len,-spring_radius-modulus,modulus))
                l=ghcomp.Line(ghcomp.ConstructPoint(0,0,0),ghcomp.ConstructPoint(spring_len+modulus,0,0))
                box=ghcomp.RotateAxis(box,rail_angle,l)[0]
                shell=ghcomp.SolidDifference(shell,box)
        else:
            shell=None
        
        if add_lock:
            if lock_a:
                if add_rail and rail_center:#lock is attached on rail
                    hook=z[0]
                    hook=ghcomp.Move(hook,ghcomp.ConstructPoint(spring_len,-2,0))[0]
                    locker=z[2]
                    locker=ghcomp.Move(locker,ghcomp.ConstructPoint(spring_len-lock_travel-5,0,0))[0]
                    lock=[hook,locker]
                else:#lock is attached to base
                    lock_m=ghcomp.Pipe(ghcomp.Line(ghcomp.ConstructPoint(spring_len-lock_travel-5,0,0),ghcomp.ConstructPoint(spring_len,0,0)),spring_radius*0.05,1)
                    hook=z[0]
                    hook=ghcomp.Move(hook,ghcomp.ConstructPoint(spring_len-lock_travel-5,1,0))[0]
                    lock_m=ghcomp.SolidUnion([lock_m,hook])
                    locker=z[1]
                    locker=ghcomp.Move(locker,ghcomp.ConstructPoint(-5,0,0))[0]
                    hole=ghcomp.Pipe(ghcomp.Line(ghcomp.ConstructPoint(-5,0,0),ghcomp.ConstructPoint(0,0,0)),2.5,1)
                    base1=ghcomp.SolidDifference(base1,hole)
                    #base1=ghcomp.SolidUnion([base1,locker])
                    lock=[lock_m,locker]
            elif lock_b and add_rail and rail_aside:#lock is attached on rail
                l=ghcomp.Line(ghcomp.ConstructPoint(0,0,0),ghcomp.ConstructPoint(1,0,0))
                hook=z[0]
                hook=ghcomp.Move(hook,ghcomp.ConstructPoint(spring_len,-spring_radius-modulus+1,0))[0]
                hook=ghcomp.RotateAxis(hook,rail_angle,l)[0]
                locker=z[2]
                locker=ghcomp.Move(locker,ghcomp.ConstructPoint(spring_len-lock_travel-5,-spring_radius-0.3*modulus,0))[0]
                locker=ghcomp.RotateAxis(locker,rail_angle,l)[0]
                lock=[hook,locker]
            elif lock_c and add_shell and add_rail and rail_aside:#lock is on shell
                hook=z[0]
                l=ghcomp.Line(ghcomp.ConstructPoint(0,0,0),ghcomp.ConstructPoint(1,0,0))
                hook=ghcomp.RotateAxis(hook,1.5*pi,l)[0]
                hook=ghcomp.Move(hook,ghcomp.ConstructPoint(spring_len,-spring_radius,-modulus))[0]
                hook=ghcomp.RotateAxis(hook,rail_angle,l)[0]
                lock=hook
                box=ghcomp.Box2Pt(ghcomp.ConstructPoint(spring_len-lock_travel-7,-spring_radius+5,-modulus-1),ghcomp.ConstructPoint(spring_len-lock_travel-5,-spring_radius-modulus-6,-modulus+5))
                
                box=ghcomp.RotateAxis(box,rail_angle,l)[0]
                shell=ghcomp.SolidDifference(shell,box)
            elif lock_c and add_shell and not add_rail or lock_c and add_shell and add_rail and rail_center:
                connector1=ghcomp.Box2Pt(ghcomp.ConstructPoint(-0.5*modulus,-0.5*modulus,-0.5*modulus),ghcomp.ConstructPoint(0,0.5*modulus,0.5*modulus))
                connector1=ghcomp.Move(connector1,ghcomp.ConstructPoint(0,-spring_radius,0))[0]
                connector2=ghcomp.Move(connector1,ghcomp.ConstructPoint(spring_len+0.5*modulus,0,0))[0]
                l=ghcomp.Line(ghcomp.ConstructPoint(0,0,0),ghcomp.ConstructPoint(spring_len+modulus,0,0))
                connector2=ghcomp.RotateAxis(connector2,lock_angle,l)[0]
                rail=ghcomp.RotateAxis(rail,rail_angle,l)[0]
                base1=ghcomp.SolidUnion([base1,connector1])
                base2=ghcomp.SolidUnion([base2,connector2])
                box=ghcomp.Box2Pt(ghcomp.ConstructPoint(0,0,-0.5*modulus),ghcomp.ConstructPoint(spring_len,-spring_radius-0.5*modulus,0.5*modulus))
                l=ghcomp.Line(ghcomp.ConstructPoint(0,0,0),ghcomp.ConstructPoint(spring_len+0.5*modulus,0,0))
                box=ghcomp.RotateAxis(box,lock_angle,l)[0]
                shell=ghcomp.SolidDifference(shell,box)
                hook=z[0]
                
                hook=ghcomp.RotateAxis(hook,1.5*pi,l)[0]
                hook=ghcomp.Move(hook,ghcomp.ConstructPoint(spring_len,-spring_radius-0.5,-0.5*modulus))[0]
                hook=ghcomp.RotateAxis(hook,lock_angle,l)[0]
                lock=hook
                box=ghcomp.Box2Pt(ghcomp.ConstructPoint(spring_len-lock_travel-7,-spring_radius+5,-0.5*modulus-1),ghcomp.ConstructPoint(spring_len-lock_travel-5,-spring_radius-0.5*modulus-6,-modulus+5))
                
                box=ghcomp.RotateAxis(box,lock_angle,l)[0]
                shell=ghcomp.SolidDifference(shell,box)
            else:
                lock=None
        else:
            lock=None
        
        b=shell
        a=[spring,base1,base2]
        c=rail
        d=lock
        return a,b,c,d
# ---------- end python_2 ----------

merge_5 = Merge(Data1=expander, Data2=merge_3)
launchwin = LaunchWindow(Show=Toggle(False), Name="Spring Design", Width=370, Height=400, ChildStatus=0, EnableHorizScroll=False)
preview_2 = CustomPreview(Geometry=python_2.a, Material=ColourSwatch(SwatchColor=RGB(148, 143, 255)))
preview_3 = CustomPreview(Geometry=python_2.b, Material=ColourSwatch(SwatchColor=RGBA(163, 163, 163, 71)))
addelems = AddElements(Window=launchwin, Elements=merge_5, DoVLChecking=True)  # -> AddedElements, ElementNames
preview_4 = CustomPreview(Geometry=python_2.c, Material=ColourSwatch(SwatchColor=RGB(255, 231, 143)))
preview_5 = CustomPreview(Geometry=python_2.d, Material=ColourSwatch(SwatchColor=RGB(255, 143, 143)))
