# Grasshopper definition IE_trial.gh (Grasshopper 1.0.7)
# plug-ins: InstantExtension, KinergyUtilities

Z = UnitZ(Factor=1)
brep = Brep(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)
ie = InstantExtension(Start=Toggle(True), Model=brep, SpringDirection=Z, Energy=Slider(1, range=0..1), Distance=Slider(0.5, range=0..1))
number_slider = Slider(1, range=0..1)
mr = MotionReader()  # -> Entities, Components, Locks
preprocessie = _01ModelPreprocessOfIE(Motion=ie)  # -> Motion, SpringPositionCandidates
sp = SelectPosition(PositionCandidates=preprocessie.SpringPositionCandidates, Select=Toggle(True))
constructspring = _02ConstructSpringOfIE(Motion=preprocessie.Motion, SpringPosition=sp)  # -> Motion, LockDirectionCandidates, Spring
sd = SelectDirection(DirectionCandidates=constructspring.LockDirectionCandidates, Select=Toggle(True))
adjustspringparameter = AdjustSpringParameter(Spring=constructspring.Spring, RadiusAdjustment=number_slider, RoundNumberAdjustment=number_slider)
nickname = _03GenerateLockPositionCandidateOfIE(Motion=constructspring.Motion, LockDirection=sd)  # -> Motion, LockPositionCandidates
sp_2 = SelectPosition(PositionCandidates=nickname.LockPositionCandidates, Select=Toggle(True))
number_slider_2 = Slider(20, range=0..100)
constructlock = _04ConstructLockOfIE(Motion=nickname.Motion, LockPosition=sp_2)  # -> Motion, Models
ms = MotionSimulator(Motion=constructlock.Motion, Start=Toggle(False))
