# Grasshopper definition IE.gh (Grasshopper 1.0.7)
# plug-ins: InstantExtension

Z = UnitZ(Factor=1)
vec = Vector(Z)
brep = Brep(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)
insext = InstantExtension(
    Start=Toggle(False),
    Model=brep,
    SpringDirection=vec,
    Energy=Slider(1, range=0..1),
    Distance=Slider(0.5, range=0..1),
    AddLock=Toggle(False))  # -> Models, Entities, MotionInstance
